# Grasshopper definition 20211117_Closed Block_NoUI.gh (Grasshopper 1.0.7)
# Copyright: Liljewall Arkitekter
# Copyright: SS
# Copyright: ss
# Copyright: 2017
# plug-ins: Human, Sasquatch, LunchBox, MetaHopper, EleFront, Pufferfish, Squid (ShapeDiver Edition)

building_1_floor_height = Slider(3, range=3..8)
building_2_floor_height = Slider(3, range=3..8)
building_3_floor_height = Slider(3, range=3..8)
building_4_floor_height = Slider(3, range=3..8)
building_5_floor_height = Slider(3, range=3..8)
building_6_floor_height = Slider(3, range=3..8)
building_7_floor_height = Slider(3, range=3..8)
building_8_floor_height = Slider(3, range=3..8)
building_9_floor_height = Slider(3, range=3..8)
building_10_floor_height = Slider(3, range=3..8)
building_11_floor_height = Slider(3, range=3..8)
building_12_floor_height = Slider(3, range=3..8)
building_13_floor_height = Slider(3, range=3..8)
building_14_floor_height = Slider(3, range=3..8)
building_15_floor_height = Slider(3, range=3..8)
building_16_floor_height = Slider(3, range=3..8)
building_17_floor_height = Slider(3, range=3..8)
building_18_floor_height = Slider(3, range=3..8)
building_19_floor_height = Slider(3, range=3..8)
building_20_floor_height = Slider(3, range=3..8)
unit_division_type = ValueList({"Divide by Count": 0, "Divide by Distance": 1}, selected="Divide by Distance")
color_building_by = ValueList({"Default": 0, "Floorplate Area": 1, "Block Area": 2, "Shape": 3}, selected="Default")
label_building_by = ValueList({"Floor Plate Area": 0, "Block Area": 1}, selected="Floor Plate Area")

# ---- group: Save and Export
save_to_rhino = Button()
create_materials = Button()
override_config_and_save_to_rhino = Button()
delete_from_rhino = Button()
export_to_sketchup = Button()
save_to_excel = Button()
save_chart = Button()

# ----
merge = Merge(
    Data1=building_1_floor_height,
    Data2=building_2_floor_height,
    Data3=building_3_floor_height,
    Data4=building_4_floor_height,
    Data5=building_5_floor_height,
    Data6=building_6_floor_height,
    Data7=building_7_floor_height,
    Data8=building_8_floor_height,
    Data9=building_9_floor_height,
    Data10=building_10_floor_height,
    Data11=building_11_floor_height,
    Data12=building_12_floor_height,
    Data13=building_13_floor_height,
    Data14=building_14_floor_height,
    Data15=building_15_floor_height,
    Data16=building_16_floor_height,
    Data17=building_17_floor_height,
    Data18=building_18_floor_height,
    Data19=building_19_floor_height,
    Data20=building_20_floor_height)
building_1_number_of_floors = Slider(4, range=1..30)
building_2_number_of_floors = Slider(5, range=1..30)
building_3_number_of_floors = Slider(6, range=1..30)
building_4_number_of_floors = Slider(5, range=1..30)
building_5_number_of_floors = Slider(4, range=1..30)
building_6_number_of_floors = Slider(6, range=1..30)
building_7_number_of_floors = Slider(6, range=1..30)
building_8_number_of_floors = Slider(4, range=1..30)
building_9_number_of_floors = Slider(3, range=1..30)
building_10_number_of_floors = Slider(5, range=1..30)
building_11_number_of_floors = Slider(6, range=1..30)
building_12_number_of_floors = Slider(5, range=1..31)
building_13_number_of_floors = Slider(4, range=1..30)
building_14_number_of_floors = Slider(4, range=1..30)
building_15_number_of_floors = Slider(6, range=1..30)
building_16_number_of_floors = Slider(8, range=1..30)
building_17_number_of_floors = Slider(10, range=1..30)
building_18_number_of_floors = Slider(12, range=1..30)
building_19_number_of_floors = Slider(8, range=1..30)
building_20_number_of_floors = Slider(6, range=1..30)
ghpython_script = GhPythonScript(show=Button())  # -> out, a, b
# ---------- ghpython_script: Python ----------
import Rhino
import System
import Rhino.UI
import Eto.Drawing as drawing
import Eto.Forms as forms

class EtoSliderForm(forms.Form):

    def __init__(self):
        self.Title = 'Eto Slider'
        self.Padding = drawing.Padding(10)
        self.Resizable = False
        self.Width = 500
        self.Height = 100

#Label 1
        self.m_label = forms.Label(Text = 'Enter the Room Number:')
#Label 2
        self.m_label2 = forms.Label(Text = 'Enter the Room Number:')
        
#Slider 1
        self.m_slider = forms.Slider()
        self.m_slider.MinValue = 1
        self.m_slider.MaxValue = 50
        self.m_slider.Value = value
        self.m_slider.ValueChanged += self.OnSliderValueChanged

# Slider 2
        self.m_slider2 = forms.Slider()
        self.m_slider2.MinValue = 1
        self.m_slider2.MaxValue = 50
        self.m_slider2.Value = value2
        self.m_slider2.ValueChanged += self.OnSliderValueChanged

        layout = forms.DynamicLayout()
        layout.Spacing = drawing.Size(5, 5)
        layout.AddRow(self.m_label,self.m_slider)
        layout.AddRow(self.m_label2,self.m_slider2)

        self.Content = layout
        
    def OnSliderValueChanged(self, sender, e):
        ghenv.Component.ExpireSolution(True)

    def GetNumber(self):
        return self.m_slider.Value,self.m_slider2.Value

if show:
    if 'form' in globals():
        form.Close()
    form = EtoSliderForm();
    form.Show()

if 'form' in globals():
    value,value2 = form.GetNumber()
if 'value' not in globals():
    value = 1
if 'value2' not in globals():
    value2 = 1
a = value
b = value2
# ---------- end ghpython_script ----------

global_ground_floor = Slider(4.5, range=0..10)
global_last_floor = Slider(4.5, range=0..10)

divide_by_distance_true_count_false = BooleanToggle(False)
label_by_building_by_0_1 = BooleanToggle(True)
default_floor_number = Slider(4, range=0..10)
default_floor_height = Slider(3, range=0..10)
check_minimum_floor_area = Slider(100, range=80..300)
check_minimum_edge_length = Slider(2, range=0..100)
check_minimum_angle_tolerence = Slider(10, range=0..100)
color_building_by_0_1_2_3_4 = Slider(0, range=0..4)
label_by_building_by_0_1_2 = Slider(1, range=0..1)

building_depth = Slider(12, range=6..20)
sidewalk_height = Slider(-0.5, range=-4..4)
sidewalk_depth = Slider(3, range=0..10)
courtyard_offset = Slider(2, range=0..10)
corner_unit_tolerance = Slider(6, range=0..20)
unit_divide_count = Slider(12, range=0..30)

unit_divide_distance = Slider(28, range=10..60)

# ---- group: Roof Config
default_roof_type = ValueList({"Flat": 0, "Green": 1, "Sloped": 2}, selected="Sloped")
green_roof_offset = Slider(1, range=0..10)
roof_sloped_height = Slider(4.5, range=1..10)
roof_offset = Slider(6, range=2..10)
roof_vertical_height = Slider(1.5, range=0..10)

# ----
courtyard = ColourSwatch(SwatchColor=RGB(102, 112, 71))
sloped_roofs = ColourSwatch(SwatchColor=RGB(219, 129, 146))
flat_roof = ColourSwatch(SwatchColor=RGB(98, 106, 133))
sidewalk = ColourSwatch(SwatchColor=RGB(175, 170, 181))
buildings = ColourSwatch(SwatchColor=RGB(230, 232, 247))

read_from_existing_file = BooleanToggle(False)
save_config_to_file = Button()
hide_all_issues = BooleanToggle(False)
show_corner_unit_circle = BooleanToggle(False)
select_active_curve = Slider(0, range=0..20)
panel = Panel([ghpython_script.a, ghpython_script.b])
hide_all_annotations = BooleanToggle(False)
flip_open_curve = BooleanToggle(True)
panel_2 = Panel(courtyard)
panel_3 = Panel(sidewalk)
panel_4 = Panel(buildings)
panel_5 = Panel(sloped_roofs)
panel_6 = Panel(flat_roof)
merge_2 = Merge(
    Data1=building_1_number_of_floors,
    Data2=building_2_number_of_floors,
    Data3=building_3_number_of_floors,
    Data4=building_4_number_of_floors,
    Data5=building_5_number_of_floors,
    Data6=building_6_number_of_floors,
    Data7=building_7_number_of_floors,
    Data8=building_8_number_of_floors,
    Data9=building_9_number_of_floors,
    Data10=building_10_number_of_floors,
    Data11=building_11_number_of_floors,
    Data12=building_12_number_of_floors,
    Data13=building_13_number_of_floors,
    Data14=building_14_number_of_floors,
    Data15=building_15_number_of_floors,
    Data16=building_16_number_of_floors,
    Data17=building_17_number_of_floors,
    Data18=building_18_number_of_floors,
    Data19=building_19_number_of_floors,
    Data20=building_20_number_of_floors)
default_roof_0_flat_1_green_2_sloped = Slider(0, range=0..2)
building_1_roof_type = Slider(2, range=0..2)
building_2_roof_type = Slider(1, range=0..2)
building_3_roof_type = Slider(2, range=0..2)
building_4_roof_type = Slider(1, range=0..2)
building_5_roof_type = Slider(0, range=0..2)
building_6_roof_type = Slider(2, range=0..2)
building_7_roof_type = Slider(1, range=0..2)
building_8_roof_type = Slider(0, range=0..2)
building_9_roof_type = Slider(2, range=0..2)
building_10_roof_type = Slider(0, range=0..2)
building_11_roof_type = Slider(1, range=0..2)
building_12_roof_type = Slider(2, range=0..2)
building_13_roof_type = Slider(0, range=0..2)
building_14_roof_type = Slider(1, range=0..2)
building_15_roof_type = Slider(2, range=0..2)
building_16_roof_type = Slider(1, range=0..2)
building_17_roof_type = Slider(0, range=0..2)
building_18_roof_type = Slider(1, range=0..2)
building_19_roof_type = Slider(2, range=0..2)
building_20_roof_type = Slider(0, range=0..2)
gate_or = GateOr(A=save_config_to_file, B=override_config_and_save_to_rhino)
merge_3 = Merge(
    Data1=building_1_roof_type,
    Data2=building_2_roof_type,
    Data3=building_3_roof_type,
    Data4=building_4_roof_type,
    Data5=building_5_roof_type,
    Data6=building_6_roof_type,
    Data7=building_7_roof_type,
    Data8=building_8_roof_type,
    Data9=building_9_roof_type,
    Data10=building_10_roof_type,
    Data11=building_11_roof_type,
    Data12=building_12_roof_type,
    Data13=building_13_roof_type,
    Data14=building_14_roof_type,
    Data15=building_15_roof_type,
    Data16=building_16_roof_type,
    Data17=building_17_roof_type,
    Data18=building_18_roof_type,
    Data19=building_19_roof_type,
    Data20=building_20_roof_type)
ghpython_script_2 = GhPythonScript(x=merge_3)  # -> out, a; inputs x: list
# ---------- ghpython_script_2: Python ----------
a = []
for roof in x:
    if roof == 0:
        a.append('flat')
    elif roof == 1:
        a.append('green')
    elif roof == 2:
        a.append('gable')
# ---------- end ghpython_script_2 ----------
ghpython_script_3 = GhPythonScript(
    save=gate_or,
    read_from_file=read_from_existing_file,
    active_curve=select_active_curve,
    default_flr_ht=default_floor_height,
    default_flr_no=default_floor_number,
    check_min_flr_area=check_minimum_floor_area,
    check_min_edge_length=check_minimum_edge_length,
    check_min_angle=check_minimum_angle_tolerence,
    div_unit_type=divide_by_distance_true_count_false,
    color_bldg_by=color_building_by_0_1_2_3_4,
    label_bldg_by=label_by_building_by_0_1_2,
    input_bldg_depth=building_depth,
    input_sidewalk_ht=sidewalk_height,
    input_sidewalk_depth=sidewalk_depth,
    input_unit_divide_count=unit_divide_count,
    input_unit_divide_distance=unit_divide_distance,
    input_courtyard_offset=courtyard_offset,
    input_corner_unit_buffer=corner_unit_tolerance,
    default_roof_type=default_roof_0_flat_1_green_2_sloped,
    input_grn_roof_offset=green_roof_offset,
    input_roof_offset=roof_offset,
    input_roof_sloped_ht=roof_sloped_height,
    input_roof_vertical_ht=roof_vertical_height,
    color_courtyard=panel_2,
    color_sidewalk=panel_3,
    color_buildings=panel_4,
    color_sloped_roof=panel_5,
    color_flat_roof=panel_6,
    global_ground=global_ground_floor,
    global_last=global_last_floor,
    list_floor_ht=merge,
    list_floor_num=merge_2,
    list_roof_type=ghpython_script_2.a)  # -> out, test, active_curve, default_flr_ht, default_flr_no, check_min_flr_area, check_min_edge_length, check_min_angle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; inputs save: Boolean, active_curve: Int32, default_flr_no: Int32, check_min_flr_area: Int32, div_unit_type: Int32, color_bldg_by: Int32, label_bldg_by: Int32, default_roof_type: Int32, list_floor_ht: list, list_floor_num: list, list_roof_type: list
# ---------- ghpython_script_3: Python ----------
import Grasshopper as gh
import os
import json
from os.path import exists
#Geth the local directory
gh_path = str(os.path.dirname(gh.Instances.DocumentServer.Document[0].FilePath))+'\config'
if not os.path.exists(gh_path):
    os.makedirs(gh_path)
config_key = [
'active_curve',
'default_flr_ht',
'default_flr_no',
'check_min_flr_area',
'check_min_edge_length',
'check_min_angle',
'div_unit_type',
'color_bldg_by',
'label_bldg_by',
'input_bldg_depth',
'input_sidewalk_ht',
'input_sidewalk_depth',
'input_unit_divide_count',
'input_unit_divide_distance',
'input_courtyard_offset',
'input_corner_unit_buffer',
'default_roof_type',
'input_grn_roof_offset',
'input_roof_offset',
'input_roof_sloped_ht',
'input_roof_vertical_ht',
'color_courtyard',
'color_sidewalk',
'color_buildings',
'color_sloped_roof',
'color_flat_roof',
'global_ground',
'global_last',
'list_floor_ht',
'list_floor_num',
'list_roof_type'
]
config_in_val = [
_active_curve,
_default_flr_ht,
_default_flr_no,
_check_min_flr_area,
_check_min_edge_length,
_check_min_angle,
_div_unit_type,
_color_bldg_by,
_label_bldg_by,
_input_bldg_depth,
_input_sidewalk_ht,
_input_sidewalk_depth,
_input_unit_divide_count,
_input_unit_divide_distance,
_input_courtyard_offset,
_input_corner_unit_buffer,
_default_roof_type,
_input_grn_roof_offset,
_input_roof_offset,
_input_roof_sloped_ht,
_input_roof_vertical_ht,
_color_courtyard,
_color_sidewalk,
_color_buildings,
_color_sloped_roof,
_color_flat_roof,
_global_ground,
_global_last,
_list_floor_ht,
_list_floor_num,
_list_roof_type
]
config_out_val = [
active_curve_,
default_flr_ht_,
default_flr_no_,
check_min_flr_area_,
check_min_edge_length_,
check_min_angle_,
div_unit_type_,
color_bldg_by_,
label_bldg_by_,
input_bldg_depth_,
input_sidewalk_ht_,
input_sidewalk_depth_,
input_unit_divide_count_,
input_unit_divide_distance_,
input_courtyard_offset_,
input_corner_unit_buffer_,
default_roof_type_,
input_grn_roof_offset_,
input_roof_offset_,
input_roof_sloped_ht_,
input_roof_vertical_ht_,
color_courtyard_,
color_sidewalk_,
color_buildings_,
color_sloped_roof_,
color_flat_roof_,
global_ground_,
global_last_,
list_floor_ht_,
list_floor_num_,
list_roof_type_
]

active_curve_path = gh_path+'\config_curve_'+str(_active_curve)+'.json'
in_dict = dict(zip(config_key, config_in_val))
if _save:
    with open(active_curve_path, 'w') as fp:
        json.dump(in_dict, fp, indent = 2)
file_exists = exists(active_curve_path)
if file_exists and _read_from_file:
    with open(active_curve_path) as json_file:
        in_dict = json.load(json_file)
        print ('We found a saved configuration!')
        print ('Reading from file now...')
else:
    print('No Saved file found, reading from live inputs...')
active_curve_ = in_dict['active_curve']
default_flr_ht_ =in_dict['default_flr_ht']
default_flr_no_ =in_dict['default_flr_no']
check_min_flr_area_ =in_dict['check_min_flr_area']
check_min_edge_length_ =in_dict['check_min_edge_length']
check_min_angle_ =in_dict['check_min_angle']
div_unit_type_ =in_dict['div_unit_type']
color_bldg_by_ =in_dict['color_bldg_by']
label_bldg_by_ =in_dict['label_bldg_by']
input_bldg_depth_ =in_dict['input_bldg_depth']
input_sidewalk_ht_ =in_dict['input_sidewalk_ht']
input_sidewalk_depth_ =in_dict['input_sidewalk_depth']
input_unit_divide_count_ =in_dict['input_unit_divide_count']
input_unit_divide_distance_ =in_dict['input_unit_divide_distance']
input_courtyard_offset_ =in_dict['input_courtyard_offset']
input_corner_unit_buffer_ =in_dict['input_corner_unit_buffer']
default_roof_type_ =in_dict['default_roof_type']
input_grn_roof_offset_ =in_dict['input_grn_roof_offset']
input_roof_offset_ =in_dict['input_roof_offset']
input_roof_sloped_ht_ =in_dict['input_roof_sloped_ht']
input_roof_vertical_ht_ =in_dict['input_roof_vertical_ht']
color_courtyard_ =in_dict['color_courtyard']
color_sidewalk_ =in_dict['color_sidewalk']
color_buildings_ = in_dict['color_buildings']
color_sloped_roof_ =in_dict['color_sloped_roof']
color_flat_roof_ =in_dict['color_flat_roof']
global_ground_ = in_dict['global_ground']
global_last_ = in_dict['global_last']
list_floor_ht_ =in_dict['list_floor_ht']
list_floor_num_ =in_dict['list_floor_num']
list_roof_type_ =in_dict['list_roof_type']
# ---------- end ghpython_script_3 ----------

# ---- group: Check Document Units
geometry_pipeline = GeometryPipeline(
    GroupByLayer=False,
    GroupByType=False,
    IncludeHidden=True,
    IncludeLocked=True,
    LayerFilter="IN",
    NameFilter="*",
    SublayerFiltering=True,
    TypeFilter=4)
document_units = DocumentUnits()
ghpython_script_4 = GhPythonScript(x=document_units)  # -> out, a
# ---------- ghpython_script_4: Python ----------
if x == 'm':
    a = True
else:
    a = False
# ---------- end ghpython_script_4 ----------
stream_gate = StreamGate(Stream=geometry_pipeline, Gate=ghpython_script_4.a)  # -> Target0, Target1
list_item = ListItem(List=stream_gate.Target1, Index=select_active_curve, Wrap=invert(True))

# ---- group: Redirect open and closed curves
closed = Closed(Curve=list_item)  # -> Closed, Periodic
stream_gate_2 = StreamGate(Stream=list_item, Gate=closed.Closed)  # -> Target0, Target1

# ---- group: Open Curve / Make Building
flip_curve = FlipCurve(Curve=stream_gate_2.Target0)  # -> Curve, Flag
negative = Negative(Value=ghpython_script_3.input_bldg_depth)
stream_filter = StreamFilter(Gate=flip_open_curve, Stream0=stream_gate_2.Target0, Stream1=flip_curve.Curve)
stream_filter_2 = StreamFilter(Gate=flip_open_curve, Stream0=ghpython_script_3.input_bldg_depth, Stream1=negative)
explode = Explode(Curve=stream_filter, Recursive=True)  # -> Segments, Vertices
offset_curve = OffsetCurve(Curve=stream_filter, Distance=stream_filter_2, Corners=1)
stream_gate_3 = StreamGate(Stream=stream_filter, Gate=divide_by_distance_true_count_false)  # -> Target0, Target1
loft = Loft(
    Curves=flatten([offset_curve, stream_filter]),
    Options={Adjust=False, Closed=False, LoftEnds=0, LoftSimp=0, LoftType=0, Rebuild=10, Refit=0.01})

# ---- group: INPUT CURVE
# CREATE LAYER FROM USER INPUT IF NOT ALREADY THERE
rectangle = Rectangle(Plane=PlaneXY(0, 0, 0), XSize=Domain(-1, 1), YSize=Domain(-2, 2), Radius=0)  # -> Rectangle, Length
flip_curve_2 = FlipCurve(Curve=stream_gate_2.Target1, Guide=rectangle.Rectangle)  # -> Curve, Flag

# ---- group: Open Curve / Divide floor
divide_distance = DivideDistance(Curve=stream_gate_3.Target1, Distance=ghpython_script_3.input_unit_divide_distance)  # -> Points, Tangents, Parameters
divide_curve = DivideCurve(Curve=stream_gate_3.Target0, Count=ghpython_script_3.input_unit_divide_count, Kinks=False)  # -> Points, Tangents, Parameters

# ---- group: SITE_PARTS / MAKE SIDEWALK
sidewalk_2 = SideWalk(
    edges=[flip_curve_2.Curve, loft],
    distance=ghpython_script_3.input_sidewalk_depth,
    factor=ghpython_script_3.input_sidewalk_ht)

# ---- group: SITE_PARTS
bld_inner = OffsetCurve(Curve=flip_curve_2.Curve, Distance=expr("-x", ghpython_script_3.input_bldg_depth), Corners=1)

# ---- group: SITE_PARTS / MAKE COURTYARD
courtyard_2 = OffsetCurve(Curve=bld_inner, Distance=expr("-x", ghpython_script_3.input_courtyard_offset), Corners=1)
boundary_surfaces = BoundarySurfaces(Edges=courtyard_2)

# ---- group: Open Curve / Buffer Circle
circle_cnr = CircleCNR(Center=explode.Vertices, Normal=Vector(0, 0, 1), Radius=ghpython_script_3.input_corner_unit_buffer)
point_in_curves = PointInCurves(Point=[divide_curve.Points, divide_distance.Points], Curves=circle_cnr)  # -> Relationship, Index, Point
integer = Integer("2")
unit_z = UnitZ(Factor=1)
member_index = MemberIndex(Set=point_in_curves.Relationship, Member=integer)  # -> Index, Count
cross_product = CrossProduct(VectorA=[divide_curve.Tangents, divide_distance.Tangents], VectorB=unit_z, Unitize=invert(False))  # -> Vector, Length
cull_index = CullIndex(List=member_index.Index, Indices="0", Wrap=True)
cull_index_2 = CullIndex(List=[divide_curve.Points, divide_distance.Points], Indices=cull_index, Wrap=True)
cull_index_3 = CullIndex(List=cross_product.Vector, Indices=cull_index, Wrap=True)

# ---- group: CLEAN CORNERS
explode_2 = Explode(Curve=bld_inner, Recursive=True)  # -> Segments, Vertices
clean_corners = CleanCorners(
    plane=explode_2.Vertices,
    radius=ghpython_script_3.input_corner_unit_buffer,
    gate=ghpython_script_3.div_unit_type,
    stream=bld_inner,
    count=ghpython_script_3.input_unit_divide_count,
    divide_distance=ghpython_script_3.input_unit_divide_distance)  # -> index, points, tangents, circle_2, parameters

# ----
boundary_surfaces_2 = BoundarySurfaces(Edges=[clean_corners.circle_2, circle_cnr])
move = Move(Geometry=boundary_surfaces_2, Motion="0,0,-0.1")  # -> Geometry, Transform
polyline = PolyLine(Vertices=explode.Vertices, Closed=invert(False))

# ---- group: MAKE FOOTPRINT
data = Data(clean_corners.index)
unit_z_2 = UnitZ(Factor=1)
cull_index_4 = CullIndex(List=clean_corners.points, Indices=data, Wrap=True)
cull_index_5 = CullIndex(List=clean_corners.tangents, Indices=data, Wrap=True)
cross_product_2 = CrossProduct(VectorA=cull_index_5, VectorB=unit_z_2, Unitize=False)  # -> Vector, Length
boundary_surfaces_3 = BoundarySurfaces(Edges=flatten([bld_inner, flip_curve_2.Curve]))
line_sdl = LineSDL(Start=cull_index_4, Direction=cross_product_2.Vector, Length=ghpython_script_3.input_bldg_depth)
surface_split = SurfaceSplit(Surface=boundary_surfaces_3, Curves=line_sdl)

# ----
stream_gate_4 = StreamGate(Stream=move.Geometry, Gate=show_corner_unit_circle)  # -> Target0, Target1
custom_preview = CustomPreview(
    Geometry=stream_gate_4.Target1,
    Material={diffuse=RGB(221, 160, 221), emission=RGB(66, 48, 66), shine=0.5, specular=RGB(255, 255, 255), transparency=0})
panel_7 = Panel("Open Curve Error : Try increasing the Corner Unit Tolerence")
merge_4 = Merge()
list_length = ListLength(List=geometry_pipeline)
null_item = NullItem(Item=list_length)  # -> NullFlags, InvalidFlags, Description
stream_filter_3 = StreamFilter(Gate=null_item.NullFlags, Stream0=list_length, Stream1="1")

# ---- group: bake
panel_8 = Panel("Block_")
concatenate = Concatenate(Fragment_A=panel_8, Fragment_B=stream_filter_3, A="_Wall")
concatenate_2 = Concatenate(Fragment_A=panel_8, Fragment_B=stream_filter_3, A="_Courtyard")
concatenate_3 = Concatenate(Fragment_A=panel_8, Fragment_B=stream_filter_3, A="_Sidewalk")
concatenate_4 = Concatenate(Fragment_A=panel_8, Fragment_B=stream_filter_3, A="_Roof")
concatenate_5 = Concatenate(Fragment_A=panel_8, Fragment_B=stream_filter_3, A="_Outline")

# ----
create_modify_layers = CreateModifyLayers(LayerName="IN", DeleteLayer=False, enableFullPath=False)  # -> LayerNames, LayerFullPath
concatenate_6 = Concatenate(Fragment_A=panel_8, Fragment_B=stream_filter_3, A="_TextTags")
concatenate_7 = Concatenate(Fragment_A=panel_8, Fragment_B=stream_filter_3, A="_TextCurve")
concatenate_8 = Concatenate(Fragment_A=panel_8, Fragment_B=stream_filter_3, A="_RoofObjects")

# ---- group: bake
layer_information = LayerInformation(ReferenceToggle=delete_from_rhino)  # -> Names, DisplayColors, GUID
ghpython_script_5 = GhPythonScript(x=layer_information.Names)  # -> out, a; inputs x: list
# ---------- ghpython_script_5: Python ----------
a = []
for i in x:
    if i!= None and 'Block_' in i:
        a.append(x.index(i))
# ---------- end ghpython_script_5 ----------
list_item_2 = ListItem(List=layer_information.Names, Index=ghpython_script_5.a, Wrap=True)
create_modify_layers_2 = CreateModifyLayers(LayerName=list_item_2, DeleteLayer=Toggle(True), enableFullPath=False)  # -> LayerNames, LayerFullPath
deleteonlayer = DeleteOnLayer(Run=delete_from_rhino, Layer=list_item_2, enableFullPath=False)

gate_or_2 = GateOr(A=Toggle(True), B=create_materials)
enable_disable_object = EnableDisableObject(
    Enabled=gate_or_2,
    AllObjects_Object=[concatenate_2, create_modify_layers_3, create_modify_materials, create_modify_materials_2, create_modify_materials_3, create_modify_materials_4, create_modify_materials_5, create_modify_materials_6])

# ----
deleteonlayer_2 = DeleteOnLayer(Run=False, Layer=list_item_2, enableFullPath=False)
rhino_command = RhinoCommand(SendCommandToggle=delete_from_rhino, CommandString="_SelDot Delete _EnterEnd")
define_object_attributes = DefineObjectAttributes()
colour_swatch = ColourSwatch(SwatchColor=RGB(0, 0, 0))
gate_or_3 = GateOr(A=save_to_rhino, B=override_config_and_save_to_rhino)
gate_or_4 = GateOr(A=save_to_rhino, B=override_config_and_save_to_rhino)
gate_or_5 = GateOr(A=save_to_rhino, B=override_config_and_save_to_rhino)
gate_or_6 = GateOr(A=save_to_rhino, B=override_config_and_save_to_rhino)
gate_or_7 = GateOr(A=save_to_rhino, B=override_config_and_save_to_rhino)
gate_or_8 = GateOr(A=save_to_rhino, B=override_config_and_save_to_rhino)
gate_or_9 = GateOr(A=save_to_rhino, B=override_config_and_save_to_rhino)
font = Font(Family="Arial", Size="2", Bold=False, Italic=False, Underline=False)
gate_or_10 = GateOr(A=save_to_rhino, B=override_config_and_save_to_rhino)
save_at_the_end = BooleanToggle(False)
colour_wheel = ColourWheel(
    list_length,
    ColourGrips_Style=40,
    ColourGrips_Grip=[5.880267371, 2.738674717, 1.16787839, 4.309471044],
    ColourGrips_Lum=[0.4739487922, 0.8752416378],
    ColourGrips_Range=[0.4049729867, 0.4049729867, 0.4049729867, 0.4049729867],
    ColourGrips_Sat=[0.2177341734, 0.7451950675])

# ---- group: Sketchup Export
ghpython_script_6 = GhPythonScript(save_skp=export_to_sketchup)  # -> out, skp_command
# ---------- ghpython_script_6: Python ----------
import Grasshopper as gh
import os
import json
from os.path import exists
#Geth the local directory
if save_skp:
    gh_path = str(os.path.dirname(gh.Instances.DocumentServer.Document[0].FilePath))+'\sketchup'
    if not os.path.exists(gh_path):
        os.makedirs(gh_path)
    print gh_path
    skp_path = gh_path + "\\Massing.skp"
    skp_command = "_SelAll _-Export " + '"'+skp_path+'"' + " _S SketchUp2015  _EnterEnd"
    print skp_command
# ---------- end ghpython_script_6 ----------
rhino_command_2 = RhinoCommand(SendCommandToggle=export_to_sketchup, CommandString=ghpython_script_6.skp_command)

# ----
stream_filter_4 = StreamFilter(Gate=save_at_the_end, Stream0=list_length, Stream1=select_active_curve)
gate_or_11 = GateOr(A=override_config_and_save_to_rhino, B=save_to_rhino)
optional_color_palette = Panel("""#001219ff
#005f73ff
#0a9396ff
#94d2bdff
#e9d8a6ff
#ee9b00ff
#ca6702ff
#bb3e03ff
#ae2012ff
#9b2226ff""")
panel_9 = Panel(colour_wheel)
white_text = Panel("#FFFFFF")
colour = Colour(panel_9)
color_palette = Panel("""#fec5bbff
#fcd5ceff
#fae1ddff
#f8edebff
#e8e8e4ff
#d8e2dcff
#ece4dbff
#ffe5d9ff
#ffd7baff
#fec89aff""")
black_text = Panel("#000000")
panel_10 = Panel(colour)
open_chart_in_browser = Button()
ghpython_script_7 = GhPythonScript(x=panel_10)  # -> out, a; inputs x: list
# ---------- ghpython_script_7: Python ----------
def rgb_to_hex(rgb):
    return '#'+'%02x%02x%02x' % rgb
a = []
for c in x:
    print c
    r,g,b = c.split(',')
    a.append(rgb_to_hex((int(r),int(g),int(b))))
# ---------- end ghpython_script_7 ----------
ghpython_script_8 = GhPythonScript(
    write_chart=save_chart,
    crv=geometry_pipeline,
    clr=ghpython_script_7.a,
    htmltitle="Summary of BTA",
    scripttitle="Summary of BTA",
    scriptsubtitle="Summary of data generated by Blocktool",
    textcolor=white_text)  # -> out, html_path, a; inputs crv: list, clr: list
# ---------- ghpython_script_8: Python ----------
import Grasshopper as gh
import csv
import json
import os
import random
gh_path = str(os.path.dirname(gh.Instances.DocumentServer.Document[0].FilePath))+'\chart'
if not os.path.exists(gh_path):
    os.makedirs(gh_path)




#Geth the local directory
gh_path = os.path.dirname(gh.Instances.DocumentServer.Document[0].FilePath)
csvFilePath = str(gh_path) +'\\csv\\' + 'BTA_Summary.csv'


# Function to convert a CSV to JSON
# Takes the file paths as arguments
def make_json(csvFilePath):
    # create a dictionary
    data = {}
    row = ['parent','name','value']
    # Open a csv reader called DictReader
    with open(csvFilePath, 'r') as readFile:
        csvReader = csv.DictReader(readFile, fieldnames=row)
        m_dict = list(csvReader)
        return m_dict
header_list = []

data = make_json(csvFilePath)
colors = ['#001219ff',
'#005f73ff',
'#0a9396ff'
'#94d2bdff',
'#e9d8a6ff',
'#ee9b00ff',
'#ca6702ff',
'#bb3e03ff',
'#ae2012ff',
'#9b2226ff']
key = ['id','parent','name','color']
value = ["0","", " ", "#FFFFFF"]
mydict = dict(zip(key,value))

header_list.append(mydict)
num_curves = len(crv)
# Automate list creation
#block_list = ["B0","B1","B2"]
block_list = []
parent_list = []
name_list = []
color_list = []
for i in range(num_curves):
    block_list.append('B'+str(i+1))
    parent_list.append("0")
    name_list.append("Block "+str(i+1))
    color_list.append(clr[i])
#parent_list = ["0","0","0"]
#name_list = ["Block 1","Block 2","Block 3"]
#Automate color list creation
#color_list = ['#001219ff','#005f73ff','#0a9396ff']

for i in range(len(block_list)):
    val =[block_list[i], parent_list[i], name_list[i], color_list[i]]
    mydict = dict(zip(key,val))
    header_list.append(mydict)

for d_dict in data:
    if 'value' in d_dict.keys():
        v_str = d_dict['value']
        d_dict['value'] = int(v_str)
    if 'Block ' in d_dict['parent']:
        b_str = d_dict['parent']
        b_str = b_str.replace('Block ', 'B')
        d_dict['parent'] = b_str

header = json.dumps(header_list,indent = 4)
header = header.replace("\"color\"","color").replace("\"parent\"","parent").replace("\"id\"","id").replace("\"name\"","name").replace("]",",")
footer = json.dumps(data, indent = 4).replace("[","")

a = header+footer+';'

script_str = """
var data = CHANGEME


Highcharts.setOptions({
  colors: ["#ecb37c", "#ECE100"]
});
Highcharts.chart("container", {
  chart: {
    height: "100%"
  },

  title: {
    text: "SCRIPTTITLE"
  },
  subtitle: {
    text:
      'SCRIPTSUBTITLE'
  },
  series: [
    {
      type: "sunburst",
      data: data,
      allowDrillToNode: true,
      cursor: "pointer",
      borderWidth: 3,
      borderColor: "#000000",
      dataLabels: {
        format: "{point.name}",
        filter: {
          property: "innerArcLength",
          operator: ">",
          value: 16
        },
        style: {
          textOutline: false,
          color: "TEXTCOLOR"
        }
      },
      levels: [
        {
          level: 1,
          levelIsConstant: false,
          dataLabels: {
            filter: {
              property: "outerArcLength",
              operator: ">",
              value: 64
            }
          }
        },
        {
          level: 2,
          colorByPoint: true
        },
        {
          level: 3,
          colorVariation: {
            key: "brightness",
            to: -0.5
          }
        },
        {
          level: 4,
          colorVariation: {
            key: "brightness",
            to: 0.5
          }
        }
      ]
    }
  ],
  tooltip: {
    headerFormat: "",
    pointFormat: "The area of <b>{point.name}</b> is <b>{point.value}</b> kvm"
  }
});
"""


html = """
<!DOCTYPE html>
<html lang="en" >
<head>
  <meta charset="UTF-8">
  <title>HTMLTITLE</title>
  <link rel="stylesheet" href="./style.css">

</head>
<body>
<!-- partial:index.partial.html -->
<script src="https://code.highcharts.com/highcharts.js"></script>
<script src="https://code.highcharts.com/modules/sunburst.js"></script>
<script src="https://code.highcharts.com/modules/exporting.js"></script>
<script src="https://code.highcharts.com/modules/accessibility.js"></script>

<div id="container"></div>
<!-- partial -->
  <script  src="./script.js"></script>

</body>
</html>

"""

css = """
#container {
	min-width: 310px;
	max-width: 500px;
	margin: 0 auto
}
"""

if write_chart:
    scriptFilePath = str(gh_path) +'\\chart\\' + 'script.js'
    script_str = script_str.replace('CHANGEME', a).replace('SCRIPTSUBTITLE',scriptsubtitle).replace('SCRIPTTITLE',scripttitle).replace('TEXTCOLOR',textcolor)
    with open(scriptFilePath, 'w') as f:
        f.write(script_str)
    htmlFilePath = str(gh_path) +'\\chart\\' + 'index.html'
    cssFilePath = str(gh_path) +'\\chart\\' + 'style.css'
    with open(htmlFilePath, 'w') as f:
        f.write(html.replace('HTMLTITLE',htmltitle))
    with open(cssFilePath, 'w') as f:
        f.write(css)
html_path = str(gh_path) +'\\chart\\' + 'index.html'
# ---------- end ghpython_script_8 ----------
panel_11 = Panel(ghpython_script_7.a)
launch_application = LaunchApplication(LaunchToggle=open_chart_in_browser, ApplicationPath=ghpython_script_8.html_path)
panel_12 = Panel(ghpython_script_8.a)

# ---- group: Open Curve
negative_2 = Negative(Value=cull_index_3)
stream_filter_5 = StreamFilter(Gate=flip_open_curve, Stream0=cull_index_3, Stream1=negative_2)

# ----
reverse = Reverse(Vector=stream_filter_5)

# ---- group: Open Curve (continued)
stream_filter_6 = StreamFilter(Gate=flip_open_curve, Stream0=reverse, Stream1=stream_filter_5)
line_sdl_2 = LineSDL(Start=cull_index_2, Direction=stream_filter_6, Length=ghpython_script_3.input_bldg_depth)
end_points = EndPoints(Cutter=line_sdl_2)  # -> Start, End

open_buildings_curve = Data(stream_filter)
roof_vertical_height_2 = Data(ghpython_script_3.input_roof_vertical_ht)
roof_sloped_height_2 = Data(ghpython_script_3.input_roof_sloped_ht)
sloped_roof_offset = Data(ghpython_script_3.input_roof_offset)
building_depth_2 = Data(ghpython_script_3.input_bldg_depth)

# ---- group: Check minimum Angle
cluster = Cluster(C=[stream_gate_2.Target1, loft], second_number=ghpython_script_3.check_min_angle)  # -> simplify(L), larger_than_2
colour_swatch_2 = ColourSwatch(SwatchColor=RGB(204, 0, 0))
cull_pattern = CullPattern(List=cluster.L, CullPattern=cluster.larger_than_2)
panel_13 = Panel("3")

# ---- group: Issues Panel
stream_filter_7 = StreamFilter(Gate=ghpython_script_4.a, Stream0="Change Model Units to meters!", Stream1="Model units are fine!")

# ---- group: Open Curve (continued)
negative_3 = Negative(Value=building_depth_2)
negative_4 = Negative(Value=sloped_roof_offset)
stream_filter_8 = StreamFilter(Gate=flip_open_curve, Stream0=building_depth_2, Stream1=negative_3)
stream_filter_9 = StreamFilter(Gate=flip_open_curve, Stream0=sloped_roof_offset, Stream1=negative_4)
unit_z_3 = UnitZ(Factor=roof_vertical_height_2)
unit_z_4 = UnitZ(Factor=roof_sloped_height_2)

# ---- group: Open Curve / Remake roofs
offset_curve_2 = OffsetCurve(Curve=open_buildings_curve, Distance=stream_filter_9, Corners=1)
offset_curve_3 = OffsetCurve(Curve=open_buildings_curve, Distance=stream_filter_8, Corners=1)
curve_closest_point = CurveClosestPoint(Point=end_points.Start, Curve=reparameterize(open_buildings_curve))  # -> Point, Parameter, Distance
curve_closest_point_2 = CurveClosestPoint(Point=end_points.Start, Curve=reparameterize(offset_curve_2))  # -> Point, Parameter, Distance
curve_closest_point_3 = CurveClosestPoint(Point=end_points.Start, Curve=reparameterize(offset_curve_3))  # -> Point, Parameter, Distance
shatter = Shatter(Curve=reparameterize(open_buildings_curve), Parameters=curve_closest_point.Parameter)  # -> graft(Segments)
shatter_2 = Shatter(Curve=reparameterize(offset_curve_2), Parameters=curve_closest_point_2.Parameter)
shatter_3 = Shatter(Curve=reparameterize(offset_curve_3), Parameters=curve_closest_point_3.Parameter)  # -> graft(Segments)
loft_2 = Loft(
    Curves=[shatter, shatter_3],
    Options={Adjust=False, Closed=False, LoftEnds=0, LoftSimp=0, LoftType=0, Rebuild=10, Refit=0.01})  # -> flatten(Loft)

# ----
footprints = Geometry([surface_split, loft_2])
list_length_2 = ListLength(List=footprints)

area = Area(Geometry=footprints)  # -> Area, Centroid
round = Round(Number=area.Area)  # -> Nearest, Floor, Ceiling
concatenate_9 = Concatenate(FragmentA=round.Nearest, FragmentB=" m²")

series = Series(Start=0, Step=1, Count=list_length_2)
list_item_3 = ListItem(List=ghpython_script_3.list_floor_num, Index=series, Wrap=True)
list_item_4 = ListItem(List=ghpython_script_3.list_floor_ht, Index=series, Wrap=True)
list_item_5 = ListItem(List=ghpython_script_3.list_roof_type, Index=series, Wrap=True)

min_max = GhPythonScript(x=flatten([list_item_4, ghpython_script_3.default_flr_ht]))  # -> a, b; inputs x: list
# ---------- min_max: Python ----------
a = min(x)
b = max(x)
# ---------- end min_max ----------
min_max_2 = GhPythonScript(x=flatten([ghpython_script_3.default_flr_no, list_item_3]))  # -> a, b; inputs x: list; same code as min_max
multiplication = Multiplication(A=min_max.a, B=min_max_2.a)
addition = Addition(A=multiplication, B="10")

# ---- group: CHEAP CONTOUR
chp_ctr = GhPythonScript(
    footprint=footprints,
    default_height=ghpython_script_3.default_flr_ht,
    default_floors=ghpython_script_3.default_flr_no,
    ht=list_item_4,
    flr=list_item_3,
    global_ground=ghpython_script_3.global_ground,
    global_last=ghpython_script_3.global_last)  # -> out, list_height, list_floors, mass_add, building_height; inputs footprint: list of Brep, ht: list, flr: list
# ---------- chp_ctr: Python ----------
from ghpythonlib import treehelpers as th
len_zones = len(footprint)
list_height = []
list_floors = []

for x in ht:
    list_height.append(x)
for x in flr:
    list_floors.append(x)
for i in range(0,len_zones-len(ht)):
    list_height.append(default_height)
    list_floors.append(default_floors)
mass_add = []
extrude_height = []

for i in range(len_zones):
    extrude_height = []
    single_ht = list_height[i]
    single_flr = list_floors[i]
    counter = 1
    while single_flr>0:
        extrude_height.append(single_ht*counter)
        counter +=1
        single_flr-=1
    mass_add.append(extrude_height)

if global_ground:
    for building_floors in mass_add:
        floor_diff = global_ground - building_floors[0]
        for i in range(len(building_floors)):
            building_floors[i] += floor_diff

if global_last:
    i = 0
    for building_floors in mass_add:
        last_diff = global_last - list_height[i]
        building_floors[-1] += last_diff
        i+=1

building_height = []
for building_floors in mass_add:
    building_height.append(building_floors[-1])
mass_add = th.list_to_tree(mass_add)
# ---------- end chp_ctr ----------
unit_z_5 = UnitZ(Factor=chp_ctr.mass_add)
flip_matrix = FlipMatrix(Data=unit_z_5)
move_2 = Move(Geometry=footprints, Motion=flip_matrix)  # -> simplify(Geometry), Transform
explode_3 = Explode(Curve=footprints, Recursive=True)  # -> simplify(Segments), Vertices

# ---- group: MASS BUILDING
unit_z_6 = UnitZ(Factor=chp_ctr.building_height)
extrude = Extrude(Base=footprints, Direction=unit_z_6)

# ---- group: Open Curve (continued)
building_heights = Data(unit_z_6)

# ---- group: Floorplate Area
area_2 = Area(Geometry=footprints)  # -> Area, Centroid
min_max_3 = GhPythonScript(x=area_2.Area)  # -> a, b; inputs x: list; same code as min_max
gradient = Gradient(
    LowerLimit=min_max_3.a,
    UpperLimit=min_max_3.b,
    Parameter=area_2.Area,
    stops=[0: RGB(0, 128, 0), 0.5: RGB(255, 255, 0), 1: RGB(255, 0, 0)])

# ----
multiplication_2 = Multiplication(A=area.Area, B=chp_ctr.list_floors)
round_2 = Round(Number=multiplication_2)  # -> Nearest, Floor, Ceiling
concatenate_10 = Concatenate(FragmentA=round_2.Nearest, FragmentB=" m²")

list_length_3 = ListLength(List=explode_3.Vertices)  # -> flatten(Length)
min_max_4 = GhPythonScript(x=list_length_3)  # -> a, b; inputs x: list of Int32; same code as min_max
gradient_2 = Gradient(
    LowerLimit=min_max_4.a,
    UpperLimit=min_max_4.b,
    Parameter=list_length_3,
    stops=[0.15: RGB(255, 130, 160), 0.85: RGB(220, 0, 40)])

# ---- group: Block Area
min_max_5 = GhPythonScript(x=multiplication_2)  # -> a, b; inputs x: list; same code as min_max
gradient_3 = Gradient(
    LowerLimit=min_max_5.a,
    UpperLimit=min_max_5.b,
    Parameter=multiplication_2,
    stops=[0: RGB(0, 128, 0), 0.5: RGB(255, 255, 0), 1: RGB(255, 0, 0)])

min_max_6 = GhPythonScript(x=list_item_3)  # -> a, b; inputs x: list of Int32; same code as min_max
gradient_4 = Gradient(
    LowerLimit=min_max_6.a,
    UpperLimit=min_max_6.b,
    Parameter=flatten(list_item_3),
    stops=[0: RGB(0, 128, 0), 0.5: RGB(255, 255, 0), 1: RGB(255, 0, 0)])

# ----
surface = Surface(footprints)
move_3 = Move(Geometry=surface, Motion=unit_z_6)  # -> Geometry, Transform

# ---- group: MAKE ROOFS
deconstruct_brep = DeconstructBrep(Brep=extrude)  # -> Faces, Edges, Vertices
list_item_6 = ListItem(List=deconstruct_brep.Faces, Index=0, Wrap=True)  # -> flatten(Item1), Item
# wishlist - Force rotated ridge roof
rf_sloped = GableRoof2(
    roofverticalheight=ghpython_script_3.input_roof_vertical_ht,
    geometry=line_sdl,
    motion_2=unit_z_6,
    curve=flip_curve_2.Curve,
    distance=ghpython_script_3.input_roof_offset,
    motion=unit_z_6,
    buildingfootprint=footprints,
    factor=ghpython_script_3.input_roof_sloped_ht)  # -> flatten(brep)
rf_flat = RF_FLAT(surface=move_3.Geometry)
rf_green = RF_GREEN(curve=rf_flat, distance=ghpython_script_3.input_grn_roof_offset)

# ----
stream_filter_10 = StreamFilter(
    Gate=ghpython_script_3.color_bldg_by,
    Stream0=ghpython_script_3.color_buildings,
    Stream1=gradient,
    Stream2=gradient_3,
    Stream3=gradient_2,
    Stream4=gradient_4)

# ---- group: Open Curve (continued)
vector = Vector(building_heights)
move_4 = Move(Geometry=shatter_2, Motion=vector)  # -> Geometry, Transform
move_5 = Move(Geometry=move_4.Geometry, Motion=unit_z_3)  # -> Geometry, Transform

# ----
list_length_4 = ListLength(List=flatten(shatter))
list_length_5 = ListLength(List=flatten(shatter_2))
list_length_6 = ListLength(List=flatten(shatter_3))

# ---- group: Open Curve
move_6 = Move(Geometry=flatten(shatter_3), Motion=vector)  # -> Geometry, Transform
move_7 = Move(Geometry=flatten(move_6.Geometry), Motion=unit_z_3)  # -> Geometry, Transform
move_8 = Move(Geometry=flatten(shatter), Motion=vector)  # -> Geometry, Transform
move_9 = Move(Geometry=move_5.Geometry, Motion=unit_z_4)  # -> Geometry, Transform
move_10 = Move(Geometry=move_8.Geometry, Motion=unit_z_3)  # -> Geometry, Transform
loft_options = LoftOptions(Closed=invert(False), Adjust=False, Rebuild=0, Refit=Slider(0, range=0..1), Type=Slider(3, range=0..5))
entwine = Entwine(
    Branch00=move_6.Geometry,
    Branch01=move_7.Geometry,
    Branch02=move_9.Geometry,
    Branch03=move_10.Geometry,
    Branch04=move_8.Geometry,
    FlattenInputs=True)
flip_matrix_2 = FlipMatrix(Data=entwine)
loft_3 = Loft(Curves=flip_matrix_2, Options=loft_options)  # -> flatten(Loft)
cap_holes_ex = CapHolesEx(Brep=loft_3)  # -> Brep, Caps, Solid

# ----
sloped_roof = Brep([rf_sloped, cap_holes_ex.Brep])

# ---- group: COLOR ROOFS
stream_filter_11 = StreamFilter(Gate=ghpython_script_3.default_roof_type, Stream0=rf_flat, Stream1=rf_green, Stream2=sloped_roof)
stream_filter_12 = StreamFilter(
    Gate=ghpython_script_3.default_roof_type,
    Stream0=ghpython_script_3.color_flat_roof,
    Stream1=ghpython_script_3.color_courtyard,
    Stream2=ghpython_script_3.color_sloped_roof)
clr_roof = GhPythonScript(
    roof_type=list_item_5,
    default=stream_filter_11,
    default_colour=stream_filter_12,
    flat_colour=ghpython_script_3.color_flat_roof,
    green_colour=ghpython_script_3.color_courtyard,
    gable_colour=ghpython_script_3.color_sloped_roof,
    flat=rf_flat,
    green=rf_green,
    gable=sloped_roof)  # -> out, roof, colours; inputs roof_type: list, default: list of Brep, flat: list of Brep, green: list of Brep, gable: list of Brep
# ---------- clr_roof: Python ----------
roof=[]
colours = []
l = len(flat)
l_in = len(roof_type)
for i in range(len(roof_type)):
    if roof_type[i] == 'green':
        roof.append(green[i])
        colours.append(green_colour)
    elif roof_type[i] == 'gable':
        roof.append(gable[i])
        colours.append(gable_colour)
    else:
        roof.append(flat[i])
        colours.append(flat_colour)
for i in range(l_in,l):
    if i<len(default):
        roof.append(default[i])
        colours.append(default_colour)
# ---------- end clr_roof ----------

# ----
equality = Equality(FirstNumber=list_length_4, SecondNumber=[list_length_5, list_length_6])  # -> Equality, Inequality
list_item_7 = ListItem(List=equality.Equality, Index=0, Wrap=True)  # -> Item, Item1
gate_and = GateAnd(A=list_item_7.Item, B=list_item_7.Item1)
stream_filter_13 = StreamFilter(Gate=gate_and, Stream0=panel_7)

# ---- group: VIZ
brep_wireframe = BrepWireframe(Brep=[extrude, clr_roof.roof, move_2.Geometry], Density=-1)
curve = Curve(flatten(brep_wireframe))
custom_preview_2 = CustomPreview(Geometry=boundary_surfaces, Material=ghpython_script_3.color_courtyard)
custom_preview_3 = CustomPreview(Geometry=sidewalk_2, Material=ghpython_script_3.color_sidewalk)
custom_preview_4 = CustomPreview(Geometry=clr_roof.roof, Material=clr_roof.colours)
custom_preview_lineweights = CustomPreviewLineweights(Geometry=curve, Shader="black", Thickness="1", Absolute=False)
walls = CustomPreview(Geometry=extrude, Material=stream_filter_10)

# ---- group: Open Curve / OLD ROOF
move_11 = Move(Geometry=flatten(curve_closest_point.Point), Motion=vector)  # -> Geometry, Transform; disabled
move_12 = Move(Geometry=flatten(curve_closest_point_3.Point), Motion=vector)  # -> Geometry, Transform; disabled
move_13 = Move(Geometry=curve_closest_point_2.Point, Motion=vector)  # -> Geometry, Transform; disabled
move_14 = Move(Geometry=move_5.Geometry, Motion=unit_z_4)  # -> Geometry, Transform; disabled
move_15 = Move(Geometry=move_13.Geometry, Motion=unit_z_3)  # -> Geometry, Transform; disabled
move_16 = Move(Geometry=move_15.Geometry, Motion=unit_z_4)  # -> Geometry, Transform; disabled
move_17 = Move(Geometry=move_11.Geometry, Motion=unit_z_3)  # -> Geometry, Transform; disabled
move_18 = Move(Geometry=move_12.Geometry, Motion=unit_z_3)  # -> Geometry, Transform; disabled
point = Point(move_11.Geometry)  # disabled
point_2 = Point(move_17.Geometry)  # disabled
point_3 = Point(move_16.Geometry)  # disabled
point_4 = Point(move_18.Geometry)  # disabled
point_5 = Point(move_12.Geometry)  # disabled
entwine_2 = Entwine(Branch00=point, Branch01=point_2, Branch02=point_3, Branch03=point_4, Branch04=point_5, FlattenInputs=True)  # disabled
flip_matrix_3 = FlipMatrix(Data=entwine_2)  # disabled
number_slider = Slider(1, range=0..2)  # disabled
polyline_2 = PolyLine(Vertices=flip_matrix_3, Closed=invert(False))  # -> flatten(Polyline); disabled
sweep1 = Sweep1(Rail=graft(move_14.Geometry), Sections=graft(polyline_2), Miter=number_slider)  # -> flatten(Brep); disabled
cap_holes = CapHoles(Brep=sweep1)  # -> flatten(Brep); disabled
sloped_roofs_2 = Data(cap_holes)  # disabled

# ---- group: bake
create_modify_layers_3 = CreateModifyLayers(
    LayerName=[concatenate, concatenate_2, concatenate_3, concatenate_4, concatenate_5, concatenate_8, concatenate_7, concatenate_6],
    DeleteLayer=False,
    enableFullPath=False)  # -> LayerNames, LayerFullPath
create_modify_materials = CreateModifyMaterials(Name="Materal_Wall", Diffuse=stream_filter_10)
create_modify_materials_2 = CreateModifyMaterials(Name="Material_Courtyard", Diffuse=ghpython_script_3.color_courtyard)
create_modify_materials_3 = CreateModifyMaterials(Name="Material_Sidewalk", Diffuse=ghpython_script_3.color_sidewalk)
create_modify_materials_4 = CreateModifyMaterials(Name="Material_Roof_flat", Diffuse=ghpython_script_3.color_flat_roof)
create_modify_materials_5 = CreateModifyMaterials(Name="Material_Roof_green", Diffuse=ghpython_script_3.color_courtyard)
create_modify_materials_6 = CreateModifyMaterials(Name="Material_Roof_gable", Diffuse=ghpython_script_3.color_sloped_roof)

list_item_8 = ListItem(List=create_modify_layers_3.LayerNames, Index=0, Wrap=True)  # -> Item, Item1, Item2, Item3, Item4, Item5, Item6, Item7
concatenate_11 = Concatenate(FragmentA="Material_Roof_", FragmentB=list_item_5)
panel_14 = Panel("black")
createattributes = CreateAttributes(LayerName=list_item_8.Item, MaterialName=create_modify_materials, enableFullPath=False)
createattributes_2 = CreateAttributes(LayerName=list_item_8.Item1, MaterialName=create_modify_materials_2, enableFullPath=False)
createattributes_3 = CreateAttributes(LayerName=list_item_8.Item2, MaterialName=create_modify_materials_3, enableFullPath=False)
createattributes_4 = CreateAttributes(LayerName=list_item_8.Item3, MaterialName=concatenate_11, enableFullPath=False)
createattributes_5 = CreateAttributes(LayerName=list_item_8.Item4, Color=panel_14, enableFullPath=False)
bake_geometry = BakeGeometry(Bake=gate_or_3, Geometry=curve, Attributes=createattributes_5, DeleteOldBakes=False, PreserveTrees=False)
bake_geometry_2 = BakeGeometry(Bake=gate_or_5, Geometry=clr_roof.roof, Attributes=createattributes_4, DeleteOldBakes=False, PreserveTrees=False)
bake_geometry_3 = BakeGeometry(Bake=gate_or_4, Geometry=sidewalk_2, Attributes=createattributes_3, DeleteOldBakes=False, PreserveTrees=False)
bake_geometry_4 = BakeGeometry(Bake=gate_or_6, Geometry=boundary_surfaces, Attributes=createattributes_2, DeleteOldBakes=False, PreserveTrees=False)
bake_geometry_5 = BakeGeometry(Bake=gate_or_7, Geometry=extrude, Attributes=createattributes, DeleteOldBakes=False, PreserveTrees=False)

# ---- group: Random Roof Box
number_slider_2 = Slider(0.5, range=0..1)
point_6 = Point(Point(0, 0, 0))
center_box = CenterBox(Base=PlaneXY(0, 0, 0), X="0.3", Y=number_slider_2, Z=number_slider_2)
filter_by_type = FilterByType(Geometry=clr_roof.roof, ObjectType="Surface")
offset_curve_4 = OffsetCurve(Curve=filter_by_type, Distance=expr("-1", 1), Corners=1)
boundary_surfaces_4 = BoundarySurfaces(Edges=offset_curve_4)
populate_geometry = PopulateGeometry(Geometry=flatten(boundary_surfaces_4), Count=Slider(3, range=0..10), Seed=Slider(2, range=0..10))
move_to_point = MoveToPoint(Geometry=center_box, PointA=point_6, PointB=populate_geometry)  # -> Moved, Vector, Transform
colour_swatch_3 = ColourSwatch(SwatchColor=RGB(169, 186, 214))
list_item_9 = ListItem(List=flatten(populate_geometry), Index=0, Wrap=True)
null_item_2 = NullItem(Item=list_item_9)  # -> flatten(NullFlags), InvalidFlags, Description
stream_filter_14 = StreamFilter(Gate=null_item_2.NullFlags, Stream0=move_to_point.Moved)
custom_preview_5 = CustomPreview(Geometry=stream_filter_14, Material=colour_swatch_3)

# ----
create_modify_materials_7 = CreateModifyMaterials(Name="Material_Roof_objects", Diffuse=colour_swatch_3)
createattributes_6 = CreateAttributes(LayerName=list_item_8.Item5, MaterialName=create_modify_materials_7, enableFullPath=False)
bake_geometry_6 = BakeGeometry(Bake=gate_or_8, Geometry=move_to_point.Moved, Attributes=createattributes_6, DeleteOldBakes=False, PreserveTrees=False)
createattributes_7 = CreateAttributes(LayerName=list_item_8.Item7, Color=panel_14, enableFullPath=False)
createattributes_8 = CreateAttributes(LayerName=list_item_8.Item6, Color=panel_14, Visibility=Toggle(True), enableFullPath=False)

# ---- group: Excel Export
ghpython_script_9 = GhPythonScript(write_csv=gate_or_11, active_curve=stream_filter_4, units=extrude, bta=round_2.Nearest)  # -> out, a; inputs active_curve: Int32, units: list, bta: list
# ---------- ghpython_script_9: Python ----------
import Grasshopper as gh
import os
import csv
from os.path import exists
#Geth the local directory
gh_path = str(os.path.dirname(gh.Instances.DocumentServer.Document[0].FilePath))+'\csv'
if not os.path.exists(gh_path):
    os.makedirs(gh_path)
csv_key = []
for i in range(len(units)):
    csv_key.append('unit '+ str(i))
csv_value = []
csv_block = []
for i in bta:
    csv_block.append('Block ' + str(active_curve))
#csv_value.append(active_curve)
for i in bta:
    csv_value.append(i)
if write_csv:
    filepath = gh_path + "\\bta_"+str(active_curve)+'.csv'
    file = open(filepath, "wb")
    writer = csv.writer(file)
    for w in range(len(units)):
      writer.writerow([csv_block[w], csv_key[w], csv_value[w]])
    file.close()
# ---------- end ghpython_script_9 ----------
ghpython_script_10 = GhPythonScript(write_excel=save_to_excel)  # -> out, a
# ---------- ghpython_script_10: Python ----------
import Grasshopper as gh
import os
import csv
from os.path import exists
#Geth the local directory
gh_path = str(os.path.dirname(gh.Instances.DocumentServer.Document[0].FilePath))+'\\csv\\'
if not os.path.exists(gh_path):
    os.makedirs(gh_path)
csv_paths = []
for path in os.listdir(gh_path):
    full_path = os.path.join(gh_path, path)
    if os.path.isfile(full_path):
        csv_paths.append(full_path)
    dict_list = []
for csv_path in csv_paths:
    reader = csv.reader(open(csv_path, 'r'))
    d = {}
    for row in reader:
       k, u, v = row
       d[k] = u, v
       dict_list.append(d)
output_csv = gh_path + 'BTA_Summary.csv'
print output_csv
if write_excel:


    header_saved = False
    with open(output_csv,'wb') as fout:
        for filename in csv_paths:
            with open(filename) as fin:
                header = next(fin)
                if not header_saved:
                    fout.write(header)
                    header_saved = True
                for line in fin:
                    fout.write(line)
# ---------- end ghpython_script_10 ----------

# ----
area_3 = Area(Geometry=footprints)  # -> Area, Centroid
smaller_than = SmallerThan(FirstNumber=area_3.Area, SecondNumber=ghpython_script_3.check_min_flr_area)  # -> SmallerThan, OrEqualTo
cull_pattern_2 = CullPattern(List=area_3.Centroid, CullPattern=smaller_than.SmallerThan)

length = Length(Curve=explode_3.Segments)  # -> flatten(Length)
smaller_than_2 = SmallerThan(FirstNumber=length, SecondNumber=ghpython_script_3.check_min_edge_length)  # -> SmallerThan, OrEqualTo
cull_pattern_3 = CullPattern(List=flatten(explode_3.Segments), CullPattern=smaller_than_2.SmallerThan)
cull_pattern_4 = CullPattern(List=length, CullPattern=smaller_than_2.SmallerThan)
curve_middle = CurveMiddle(Curve=cull_pattern_3)

# ---- group: Check minimum Angle (continued)
unit_z_7 = UnitZ(Factor=addition)
move_19 = Move(Geometry=cull_pattern, Motion=unit_z_7)  # -> Geometry, Transform
move_20 = Move(Geometry=cull_pattern, Motion=unit_z_7)  # -> Geometry, Transform
line = Line(StartPoint=cull_pattern, EndPoint=move_20.Geometry)
stream_gate_5 = StreamGate(Stream=move_19.Geometry, Gate=hide_all_issues)  # -> Target0, Target1
stream_gate_6 = StreamGate(Stream=line, Gate=hide_all_issues)  # -> Target0, Target1

# ----
stream_filter_15 = StreamFilter(Gate=hide_all_annotations, Stream0=stream_gate_6.Target0)
stream_filter_16 = StreamFilter(Gate=hide_all_annotations, Stream0=stream_gate_5.Target0)

# ---- group: Check minimum Angle (continued)
custom_preview_lineweights_2 = CustomPreviewLineweights(Geometry=stream_filter_15, Shader=colour_swatch_2, Thickness=panel_13, Absolute=False)
text_tag = TextTag(Location=stream_filter_16, Text="ISSUE : Angle out of threshold", Colour=colour_swatch_2)

# ----
move_21 = Move(Geometry=cull_pattern_2, Motion=unit_z_7)  # -> Geometry, Transform
line_2 = Line(StartPoint=cull_pattern_2, EndPoint=move_21.Geometry)
stream_gate_7 = StreamGate(Stream=move_21.Geometry, Gate=hide_all_issues)  # -> Target0, Target1
stream_gate_8 = StreamGate(Stream=line_2, Gate=hide_all_issues)  # -> Target0, Target1

stream_filter_17 = StreamFilter(Gate=hide_all_annotations, Stream0=stream_gate_8.Target0)
stream_filter_18 = StreamFilter(Gate=hide_all_annotations, Stream0=stream_gate_7.Target0)

custom_preview_lineweights_3 = CustomPreviewLineweights(Geometry=stream_filter_17, Shader=colour_swatch_2, Thickness=panel_13, Absolute=False)
text_tag_2 = TextTag(Location=stream_filter_18, Text="ISSUE : Unit Smaller than Minimum Unit Area", Colour=colour_swatch_2)

move_22 = Move(Geometry=curve_middle, Motion=unit_z_7)  # -> Geometry, Transform
line_3 = Line(StartPoint=curve_middle, EndPoint=move_22.Geometry)
stream_gate_9 = StreamGate(Stream=move_22.Geometry, Gate=hide_all_issues)  # -> Target0, Target1
stream_gate_10 = StreamGate(Stream=line_3, Gate=hide_all_issues)  # -> Target0, Target1

stream_filter_19 = StreamFilter(Gate=hide_all_annotations, Stream0=stream_gate_10.Target0)
stream_filter_20 = StreamFilter(Gate=hide_all_annotations, Stream0=stream_gate_9.Target0)

custom_preview_lineweights_4 = CustomPreviewLineweights(Geometry=stream_filter_19, Shader=colour_swatch_2, Thickness=panel_13, Absolute=False)
text_tag_3 = TextTag(Location=stream_filter_20, Text="ISSUE : Wall shorter than Minimum Edge Length", Colour=colour_swatch_2)

# ---- group: Issues Panel (continued)
list_length_7 = ListLength(List=flatten([line_2, line_3, line]))

# ----
null_item_3 = NullItem(Item=list_length_7)  # -> NullFlags, InvalidFlags, Description
stream_filter_21 = StreamFilter(Gate=null_item_3.NullFlags, Stream0=list_length_7, Stream1="0")

# ---- group: Issues Panel (continued)
concatenate_12 = Concatenate(FragmentA=stream_filter_21, FragmentB=" Issues detected")
merge_5 = Merge(
    Data1="Ensure layer IN is set to default!",
    Data2=concatenate_12,
    Data3=stream_filter_7,
    Data4=ghpython_script_3.out,
    Data5=stream_filter_13)  # -> flatten(Result)

# ----
panel_15 = Panel(merge_5)

# ---- group: Show Block Numbers
addition_2 = Addition(A="5", B=ghpython_script_3.input_sidewalk_depth)
bld_inner_2 = OffsetCurve(Curve=[flip_curve_2.Curve, loft], Distance=addition_2, Corners=1)

# ---- group: CALCULATE AREA
mass_addition = MassAddition(Input=round_2.Nearest)  # -> Result, PartialResults
addition_3 = Addition(A=chp_ctr.building_height, B=ghpython_script_3.input_roof_sloped_ht, C="1")
unit_z_8 = UnitZ(Factor=addition_3)
area_4 = Area(Geometry=[boundary_surfaces, polyline])  # -> Area, Centroid
move_23 = Move(Geometry=area.Centroid, Motion=unit_z_8)  # -> Geometry, Transform
colour_swatch_4 = ColourSwatch(SwatchColor=RGB(0, 0, 0))

# ----
concatenate_13 = Concatenate(A="Total Area ", Fragment_A=mass_addition.Result, Fragment_B=" m²")

# ---- group: Show Block Numbers (continued)
curve_closest_point_4 = CurveClosestPoint(Point=move_23.Geometry, Curve=bld_inner_2)  # -> Point, Parameter, Distance

# ----
list_length_8 = ListLength(List=curve_closest_point_4.Point)
stream_filter_22 = StreamFilter(Gate=hide_all_annotations, Stream0=move_23.Geometry)

stream_filter_23 = StreamFilter(Gate=ghpython_script_3.label_bldg_by, Stream0=concatenate_9, Stream1=concatenate_10)
text_tag_4 = TextTag(Location=stream_filter_22, Text=stream_filter_23, Colour=colour_swatch_4)

series_2 = Series(Start="1", Step=1, Count=list_length_8)
stream_filter_24 = StreamFilter(Gate=hide_all_annotations, Stream0=area_4.Centroid)

# ---- group: CALCULATE AREA (continued)
text_tag_5 = TextTag(Location=stream_filter_24, Text=concatenate_13, Colour=colour_swatch_4)

# ----
stream_filter_25 = StreamFilter(Gate=hide_all_annotations, Stream0=curve_closest_point_4.Point)
text_tag_6 = TextTag(Location=stream_filter_25, Text=series_2, Colour="black")
define_text_dot = DefineTextDot(Text=series_2, Location=stream_filter_25, Font="Arial", Size=14)
define_text_dot_2 = DefineTextDot(Text=stream_filter_23, Location=stream_filter_22, Font="Arial", Size=14)
define_text_dot_3 = DefineTextDot(Text=concatenate_13, Location=area_4.Centroid, Font="Arial", Size=14)
bake_objects = BakeObjects(
    Geometry=flatten([define_text_dot_2, define_text_dot_3, define_text_dot]),
    Attributes=define_object_attributes,
    Bake=gate_or_9)
panel_16 = Panel(bake_objects)
text_curves = TextCurves(Plane=stream_filter_25, Text=series_2, Font=font)
text_curves_2 = TextCurves(Plane=area_4.Centroid, Text=concatenate_13, Font=font)
text_curves_3 = TextCurves(Plane=stream_filter_22, Text=stream_filter_23, Font=font)
bake_geometry_7 = BakeGeometry(
    Bake=gate_or_10,
    Geometry=[text_curves_3, text_curves_2, text_curves],
    Attributes=createattributes_8,
    DeleteOldBakes=False,
    PreserveTrees=False)

# ==== cluster RF_GREEN
curve = ClusterInput()
distance = ClusterInput()

# ---- group: Green Roof
offset_curve = OffsetCurve(Curve=curve, Distance=expr("-x", distance), Corners=1)
boundary_surfaces = BoundarySurfaces(Edges=offset_curve)
move = Move(Geometry=boundary_surfaces, Motion="0,0,0.05")  # -> flatten(Geometry), Transform

# ----
geometry = ClusterOutput(move.Geometry)

# ==== cluster RF_FLAT
surface = ClusterInput()

# ---- group: Flat Roof
surface_2 = Surface(flatten(surface))
move = Move(Geometry=surface_2, Motion="0,0,0.01")  # -> Geometry, Transform

# ----
geometry = ClusterOutput(move.Geometry)

# ==== cluster CleanCorners
divide_distance = ClusterInput()
gate = ClusterInput()
stream = ClusterInput()
count = ClusterInput()
stream_gate = StreamGate(Stream=stream, Gate=gate)  # -> Target0, Target1
plane = ClusterInput()
radius = ClusterInput()
divide_distance_2 = DivideDistance(Curve=stream_gate.Target1, Distance=divide_distance)  # -> Points, Tangents, Parameters

# ---- group: No corners
divide_curve = DivideCurve(Curve=stream_gate.Target0, Count=count, Kinks=False)  # -> Points, Tangents, Parameters
circle = Circle(Plane=plane, Radius=radius)
point_in_curves = PointInCurves(Point=[divide_curve.Points, divide_distance_2.Points], Curves=circle)  # -> Relationship, Index, Point
integer = Integer("2")
member_index = MemberIndex(Set=point_in_curves.Relationship, Member=integer)  # -> Index, Count

# ----
points = ClusterOutput([divide_curve.Points, divide_distance_2.Points])
tangents = ClusterOutput([divide_curve.Tangents, divide_distance_2.Tangents])
parameters = ClusterOutput([divide_curve.Parameters, divide_distance_2.Parameters])
index = ClusterOutput(member_index.Index)
circle_2 = ClusterOutput(circle)

# ==== cluster SideWalk
edges = ClusterInput()
curve = Curve(edges)
distance = ClusterInput()
polyline_offset = PolylineOffset(
    Polylines=curve,
    Distance=distance,
    Plane=Plane(origin=(0, 0, 0), x=(0, 0, 0), y=(0, 0, 0)),
    Tolerance=0.01,
    ClosedFillet=1,
    OpenFillet=1,
    Miter=2)  # -> Contour, Holes
length = Length(Curve=polyline_offset.Holes)
highest_lowest_numbers = HighestLowestNumbers(Numbers=length)  # -> Highest, Lowest
member_index = MemberIndex(Set=length, Member=highest_lowest_numbers.Highest)  # -> Index, Count
list_item = ListItem(List=polyline_offset.Holes, Index=member_index.Index, Wrap=True)
curve_2 = Curve(flatten([polyline_offset.Contour, list_item]))
factor = ClusterInput()

# ---- group: Sidewalk
unit_z = UnitZ(Factor=factor)
fillet = Fillet(Curve=curve_2, Radius="5")
boundary_surfaces = BoundarySurfaces(Edges=flatten([fillet, edges]))
extrude = Extrude(Base=boundary_surfaces, Direction=unit_z)

# ----
list_item_2 = ListItem(List=extrude, Index=0, Wrap=True)
i = ClusterOutput(list_item_2)

# ==== cluster GableRoof2
buildingfootprint = ClusterInput()
curve = ClusterInput()
distance = ClusterInput()
roofverticalheight = ClusterInput()
curve_2 = Curve(buildingfootprint)
offset_curve = OffsetCurve(Curve=curve, Distance=expr("-x", distance), Corners=1)
trim_with_region = TrimWithRegion(Curve=offset_curve, Region=curve_2)  # -> flatten(Inside), Outside
motion = ClusterInput()
factor = ClusterInput()
unit_z = UnitZ(Factor=roofverticalheight)
move = Move(Geometry=trim_with_region.Inside, Motion=motion)  # -> Geometry, Transform
unit_z_2 = UnitZ(Factor=factor)
geometry = ClusterInput()
motion_2 = ClusterInput()
move_2 = Move(Geometry=geometry, Motion=motion_2)  # -> Geometry, Transform
move_3 = Move(Geometry=move_2.Geometry, Motion=unit_z)  # -> Geometry, Transform
move_4 = Move(Geometry=move.Geometry, Motion=unit_z_2)  # -> Geometry, Transform
move_5 = Move(Geometry=move_4.Geometry, Motion=unit_z)  # -> Geometry, Transform
end_points = EndPoints(Curve=move_3.Geometry)  # -> Start, End
end_points_2 = EndPoints(Curve=move_2.Geometry)  # -> Start, End
end_points_3 = EndPoints(Curve=move_5.Geometry)  # -> Start, End
point = Point(end_points_2.Start)
point_2 = Point(end_points.Start)
point_3 = Point(end_points.End)
point_4 = Point(end_points_2.End)
point_5 = Point(end_points_3.Start)
entwine = Entwine(Branch00=point, Branch01=point_2, Branch02=point_5, Branch03=point_3, Branch04=point_4, FlattenInputs=True)
flip_matrix = FlipMatrix(Data=entwine)
polyline = PolyLine(Vertices=flip_matrix, Closed=invert(False))
sweep1 = Sweep1(Rail=graft(move_5.Geometry), Sections=polyline, Miter=Slider(1, range=0..2))
cap_holes = CapHoles(Brep=sweep1)
brep = ClusterOutput(cap_holes)

# ==== cluster Cluster
C = ClusterInput()
explode = Explode(Curve=C, Recursive=True)  # -> Segments, Vertices
shift = ShiftList(List=explode.Segments, Shift=1, Wrap=True)
entwine = Entwine(Branch00=explode.Segments, Branch01=shift, FlattenInputs=True)
shift_2 = ShiftList(List=explode.Vertices, Shift=1, Wrap=False)
flip = FlipMatrix(Data=entwine)
item = ListItem(List=flip, Index=0, Wrap=True)  # -> Item, Item1
L = ClusterOutput(shift_2)
angle = Angle(VectorA=item.Item, VectorB=item.Item1)  # -> flatten(Angle), Reflex
second_number = ClusterInput()
deg = Degrees(Radians=angle.Angle)
subtraction = Subtraction(A="180", B=deg)
subtraction_2 = Subtraction(A=subtraction, B="90")
absolute = Absolute(Value=subtraction_2)
larger_than = LargerThan(FirstNumber=absolute, SecondNumber=second_number)  # -> LargerThan, OrEqualTo
larger_than_2 = ClusterOutput(larger_than.LargerThan)
panel = Panel(subtraction)
