# Grasshopper definition 20210925_Closed Block_NoUI.gh (Grasshopper 1.0.7)
# Copyright: Liljewall Arkitekter
# Copyright: SS
# Copyright: ss

floor_height = Panel("""3
3
3
4
5""")

sidewalk_height = Slider(-2.3, range=-4..4)
building_depth = Slider(18, range=4..50)
sidewalk = Slider(5.2, range=0..10)
unit_division = Slider(30, range=0..100)
courtyard_offset = Slider(5, range=0..10)

# ---- group: Roof Config
green_roof_offset = Slider(2, range=0..10)
roof_height = Slider(3, range=1..10)
roof_offset = Slider(10, range=2..10)

# ----
floors = Panel("""3
4
8
5
4""")
roof_type = Panel("""green
flat
green
flat
green""")

buildings = ColourSwatch(SwatchColor=RGB(209, 207, 188))
roofs = ColourSwatch(SwatchColor=RGB(140, 133, 112))
flat_roof = ColourSwatch(SwatchColor=RGB(201, 141, 141))
courtyard = ColourSwatch(SwatchColor=RGB(149, 178, 89))
sidewalk_2 = ColourSwatch(SwatchColor=RGB(153, 153, 153))

# ---- group: INPUT CURVE
geometry_pipeline = GeometryPipeline(
    GroupByLayer=False,
    GroupByType=False,
    IncludeHidden=True,
    IncludeLocked=True,
    LayerFilter="IN",
    NameFilter="*",
    SublayerFiltering=True,
    TypeFilter=4)
rectangle = Rectangle(Plane=PlaneXY(0, 0, 0), XSize=Domain(-1, 1), YSize=Domain(-2, 2), Radius=0)  # -> Rectangle, Length
flip_curve = FlipCurve(Curve=geometry_pipeline, Guide=rectangle.Rectangle)  # -> Curve, Flag

# ---- group: SITE_PARTS / MAKE SIDEWALK
sidewalk_3 = SideWalk(curve=flip_curve.Curve, distance=sidewalk, edges=flip_curve.Curve, factor=sidewalk_height)

# ---- group: SITE_PARTS
bld_inner = OffsetCurve(Curve=flip_curve.Curve, Distance=expr("-x", building_depth), Corners=1)

# ---- group: SITE_PARTS / MAKE COURTYARD
courtyard_2 = OffsetCurve(Curve=bld_inner, Distance=expr("-x", courtyard_offset), Corners=1)
boundary_surfaces = BoundarySurfaces(Edges=courtyard_2)

# ---- group: CLEAN CORNERS
corner_unit_buffer = Slider(10, range=0..100)
explode = Explode(Curve=bld_inner, Recursive=True)  # -> Segments, Vertices
clean_corners = CleanCorners(plane=explode.Vertices, radius=corner_unit_buffer, curve=bld_inner, count=unit_division)  # -> index, points, tangents, parameters

# ---- group: MAKE FOOTPRINT
data = Data(clean_corners.index)
unit_z = UnitZ(Factor=1)
cull_index = CullIndex(List=clean_corners.points, Indices=data, Wrap=True)
cull_index_2 = CullIndex(List=clean_corners.tangents, Indices=data, Wrap=True)
cross_product = CrossProduct(VectorA=cull_index_2, VectorB=unit_z, Unitize=False)  # -> Vector, Length
boundary_surfaces_2 = BoundarySurfaces(Edges=flatten([bld_inner, flip_curve.Curve]))
line_sdl = LineSDL(Start=cull_index, Direction=cross_product.Vector, Length=building_depth)
surface_split = SurfaceSplit(Surface=boundary_surfaces_2, Curves=line_sdl)

# ---- group: CHEAP CONTOUR
chp_ctr = GhPythonScript(footprint=surface_split, ht=floor_height, flr=floors)  # -> out, list_height, list_floors, mass_add; inputs footprint: list of Brep, ht: list, flr: list
# ---------- chp_ctr: Python ----------
from ghpythonlib import treehelpers as th
len_zones = len(footprint)
list_height = []
list_floors = []
default_height = 3
default_floors = 4

for x in ht:
    list_height.append(x)
for x in flr:
    list_floors.append(x)
for i in range(0,len_zones-len(ht)):
    list_height.append(default_height)
    list_floors.append(default_floors)
mass_add = []
extrude_height = []

for i in range(len_zones):
    extrude_height = []
    single_ht = list_height[i]
    single_flr = list_floors[i]
    counter = 1
    while single_flr>0:
        extrude_height.append(single_ht*counter)
        counter +=1
        single_flr-=1
    mass_add.append(extrude_height)
mass_add = th.list_to_tree(mass_add)
# ---------- end chp_ctr ----------
unit_z_2 = UnitZ(Factor=chp_ctr.mass_add)
flip_matrix = FlipMatrix(Data=unit_z_2)
curve = Curve(surface_split)
move = Move(Geometry=curve, Motion=flip_matrix)  # -> simplify(Geometry), Transform

# ---- group: MASS BUILDING
multiplication = Multiplication(FloorHeight=chp_ctr.list_height, Floors=chp_ctr.list_floors)
unit_z_3 = UnitZ(Factor=multiplication)
extrude = Extrude(Base=surface_split, Direction=unit_z_3)

# ---- group: CALCULATE AREA
area = Area(Geometry=surface_split)  # -> Area, Centroid
addition = Addition(A=multiplication, B=roof_height, C="1")
multiplication_2 = Multiplication(A=area.Area, B=chp_ctr.list_floors)
unit_z_4 = UnitZ(Factor=addition)
round = Round(Number=multiplication_2)  # -> Nearest, Floor, Ceiling
move_2 = Move(Geometry=area.Centroid, Motion=unit_z_4)  # -> Geometry, Transform
area_2 = Area(Geometry=boundary_surfaces)  # -> Area, Centroid
colour_swatch = ColourSwatch(SwatchColor=RGB(0, 0, 0))
mass_addition = MassAddition(Input=round.Nearest)  # -> Result, PartialResults
text_tag = TextTag(Location=area_2.Centroid, Text=mass_addition.Result, Colour=colour_swatch)
text_tag_2 = TextTag(Location=move_2.Geometry, Text=round.Nearest, Colour=colour_swatch)

# ---- group: MAKE ROOFS
deconstruct_brep = DeconstructBrep(Brep=extrude)  # -> Faces, Edges, Vertices
list_item = ListItem(List=deconstruct_brep.Faces, Index=0, Wrap=True)  # -> flatten(Item1), Item
rf_green = RF_GREEN(curve=list_item.Item1, distance=green_roof_offset)
rf_sloped = GableRoof2(
    geometry=line_sdl,
    motion_2=unit_z_3,
    curve_2=flip_curve.Curve,
    distance=roof_offset,
    motion=unit_z_3,
    factor=roof_height,
    curve=surface_split)  # -> flatten(brep)
rf_flat = RF_FLAT(surface=list_item.Item1)

# ---- group: COLOR ROOFS
clr_roof = GhPythonScript(
    roof_type=roof_type,
    default=rf_sloped,
    default_colour=roofs,
    flat_colour=flat_roof,
    green_colour=courtyard,
    gable_colour=roofs,
    flat=rf_flat,
    green=rf_green,
    gable=rf_sloped)  # -> out, roof, colours; inputs roof_type: list, default: list of Brep, flat: list of Brep, green: list of Brep, gable: list of Brep
# ---------- clr_roof: Python ----------
roof=[]
colours = []
l = len(flat)
l_in = len(roof_type)
for i in range(len(roof_type)):
    if roof_type[i] == 'green':
        roof.append(green[i])
        colours.append(green_colour)
    elif roof_type[i] == 'gable':
        roof.append(gable[i])
        colours.append(gable_colour)
    else:
        roof.append(flat[i])
        colours.append(flat_colour)
for i in range(l_in,l):
    roof.append(default[i])
    colours.append(default_colour)
# ---------- end clr_roof ----------

# ---- group: COLOR BY AREA
area_3 = Area(Geometry=surface_split)  # -> Area, Centroid

# ----
min_max = GhPythonScript(x=area_3.Area)  # -> a, b; inputs x: list
# ---------- min_max: Python ----------
a = min(x)
b = max(x)
# ---------- end min_max ----------

# ---- group: COLOR BY AREA (continued)
gradient = Gradient(
    LowerLimit=min_max.a,
    UpperLimit=min_max.b,
    Parameter=area_3.Area,
    stops=[0: RGB(0, 128, 0), 0.5: RGB(255, 255, 0), 1: RGB(255, 0, 0)])

# ---- group: VIZ
brep_wireframe = BrepWireframe(Brep=[extrude, clr_roof.roof, move.Geometry], Density=-1)
curve_2 = Curve(flatten(brep_wireframe))
custom_preview = CustomPreview(Geometry=extrude, Material=gradient)
custom_preview_2 = CustomPreview(Geometry=boundary_surfaces, Material=courtyard)
custom_preview_3 = CustomPreview(Geometry=sidewalk_3, Material=sidewalk_2)
custom_preview_4 = CustomPreview(Geometry=extrude, Material=buildings)
custom_preview_5 = CustomPreview(Geometry=clr_roof.roof, Material=clr_roof.colours)
draw = PythonScript(Toggle=Toggle(True), Curves=curve_2, Shader="black", Thickness="1")  # inputs Toggle: Boolean, Curves: list of Curve, Shader: Color, Thickness: Int32
# ---------- draw: Python ----------
import Rhino as rc

# Create a custom display
if "display" not in globals():
    display = rc.Display.CustomDisplay(True)
    
# Clear the display each time the script is run
display.Clear()

# Dispose of custom display
if Toggle == False:
    display.Dispose
    del display
    
# Iterate the curves and add them to the custom display
if Toggle == True:
    for i,crv in enumerate(Curves):
        display.AddCurve(crv,Shader,Thickness)
# ---------- end draw ----------

# ==== cluster RF_GREEN
curve = ClusterInput()
distance = ClusterInput()

# ---- group: Green Roof
offset_curve = OffsetCurve(Curve=curve, Distance=expr("-x", distance), Corners=1)  # -> flatten(Curve)
boundary_surfaces = BoundarySurfaces(Edges=offset_curve)  # -> flatten(Surfaces)
move = Move(Geometry=boundary_surfaces, Motion="0,0,0.01")  # -> Geometry, Transform

# ----
geometry = ClusterOutput(move.Geometry)

# ==== cluster RF_FLAT
surface = ClusterInput()

# ---- group: Flat Roof
surface_2 = Surface(flatten(surface))
move = Move(Geometry=surface_2, Motion="0,0,0.01")  # -> Geometry, Transform

# ----
geometry = ClusterOutput(move.Geometry)

# ==== cluster CleanCorners
curve = ClusterInput()
count = ClusterInput()
plane = ClusterInput()
radius = ClusterInput()

# ---- group: No corners
divide_curve = DivideCurve(Curve=curve, Count=count, Kinks=False)  # -> Points, Tangents, Parameters
circle = Circle(Plane=plane, Radius=radius)
point_in_curves = PointInCurves(Point=divide_curve.Points, Curves=circle)  # -> Relationship, Index, Point
integer = Integer("2")
member_index = MemberIndex(Set=point_in_curves.Relationship, Member=integer)  # -> Index, Count

# ----
points = ClusterOutput(divide_curve.Points)
tangents = ClusterOutput(divide_curve.Tangents)
parameters = ClusterOutput(divide_curve.Parameters)
index = ClusterOutput(member_index.Index)

# ==== cluster SideWalk
curve = ClusterInput()
distance = ClusterInput()
factor = ClusterInput()
edges = ClusterInput()

# ---- group: Sidewalk
offset_curve = OffsetCurve(Curve=curve, Distance=distance, Corners=1)
unit_z = UnitZ(Factor=factor)
fillet = Fillet(Curve=offset_curve, Radius="5")
boundary_surfaces = BoundarySurfaces(Edges=flatten([fillet, edges]))
extrude = Extrude(Base=boundary_surfaces, Direction=unit_z)

# ----
extrusion = ClusterOutput(extrude)

# ==== cluster GableRoof2
curve = ClusterInput()
curve_2 = ClusterInput()
distance = ClusterInput()
curve_3 = Curve(curve)
offset_curve = OffsetCurve(Curve=curve_2, Distance=expr("-x", distance), Corners=1)
trim_with_region = TrimWithRegion(Curve=offset_curve, Region=curve_3)  # -> flatten(Inside), Outside
motion = ClusterInput()
factor = ClusterInput()
move = Move(Geometry=trim_with_region.Inside, Motion=motion)  # -> Geometry, Transform
unit_z = UnitZ(Factor=1)
unit_z_2 = UnitZ(Factor=factor)
geometry = ClusterInput()
motion_2 = ClusterInput()
move_2 = Move(Geometry=geometry, Motion=motion_2)  # -> Geometry, Transform
move_3 = Move(Geometry=move_2.Geometry, Motion=unit_z)  # -> Geometry, Transform
move_4 = Move(Geometry=move.Geometry, Motion=unit_z_2)  # -> Geometry, Transform
move_5 = Move(Geometry=move_4.Geometry, Motion=unit_z)  # -> Geometry, Transform
end_points = EndPoints(Curve=move_3.Geometry)  # -> Start, End
end_points_2 = EndPoints(Curve=move_2.Geometry)  # -> Start, End
end_points_3 = EndPoints(Curve=move_5.Geometry)  # -> Start, End
point = Point(end_points_2.Start)
point_2 = Point(end_points.Start)
point_3 = Point(end_points.End)
point_4 = Point(end_points_2.End)
point_5 = Point(end_points_3.Start)
entwine = Entwine(Branch00=point, Branch01=point_2, Branch02=point_5, Branch03=point_3, Branch04=point_4, FlattenInputs=True)
flip_matrix = FlipMatrix(Data=entwine)
polyline = PolyLine(Vertices=flip_matrix, Closed=invert(False))  # -> flatten(Polyline)
sweep1 = Sweep1(Rail=graft(move_5.Geometry), Sections=graft(polyline), Miter=1)
cap_holes = CapHoles(Brep=sweep1)
brep = ClusterOutput(cap_holes)
