# Grasshopper definition 20210925_Closed Block_UI.gh (Grasshopper 1.0.7)
# Copyright: Liljewall Arkitekter
# Copyright: SS
# Copyright: ss
# plug-ins: Human, Human UI, MetaHopper

document_info = DocumentInfo(AutoUpdate=False, Recursive=False)  # -> DocumentName, DocumentFilePath, Components, Params, _3rdPartyAssemblies

# ---- group: HUMAN UI / Roof Config
green_roof_offset = Slider(2, range=0..10)
roof_offset = Slider(10, range=2..10)
roof_height = Slider(3, range=1..10)

# ---- group: HUMAN UI
create_label = CreateLabel(LabelText="Landscape Colour", LabelSize=12, Justification=0)
create_label_2 = CreateLabel(LabelText="Side Walk Colour", LabelSize=12, Justification=0)
create_label_3 = CreateLabel(LabelText="Building Colour", LabelSize=12, Justification=0)
create_label_4 = CreateLabel(LabelText="Sloped Roof Colour", LabelSize=12, Justification=0)
create_label_5 = CreateLabel(LabelText="Flat Roof Colour", LabelSize=12, Justification=0)
colour_swatch = ColourSwatch(SwatchColor=RGB(84, 84, 84))
create_separator = CreateSeparator(Thickness=Slider(1, range=0..1), Horizontal=True, Color=colour_swatch)
create_separator_2 = CreateSeparator(Thickness=Slider(1, range=0..1), Horizontal=True, Color=colour_swatch)
building_depth = Slider(18, range=4..50)
sidewalk_height = Slider(-2.3, range=-4..4)
sidewalk = Slider(5.2, range=0..10)
unit_division = Slider(30, range=0..100)
courtyard_offset = Slider(5, range=0..10)
floor_height = Panel("""3
3
3
4
5""")
floors = Panel("""3
4
8
5
4""")
roof_type = Panel("""green
flat
green
flat
green""")
courtyard = ColourSwatch(SwatchColor=RGB(149, 178, 89))
sidewalk_2 = ColourSwatch(SwatchColor=RGB(153, 153, 153))
buildings = ColourSwatch(SwatchColor=RGB(209, 207, 188))
roofs = ColourSwatch(SwatchColor=RGB(140, 133, 112))
flat_roof = ColourSwatch(SwatchColor=RGB(201, 141, 141))
number_slider = Slider(500, range=0..1000)
create_text_box = CreateTextBox(Label="Floor Height", DefaultText=floor_height, UpdateButton=True, showLabel=True)
create_text_box_2 = CreateTextBox(Label="Layer Name", DefaultText="IN", UpdateButton=True, showLabel=True)
create_slider = CreateSlider(Slider=building_depth, ShowBounds=False, ShowTicks=False, ShowTooltip=False, ShowValLabel=True, showLabel=True)
create_slider_2 = CreateSlider(Slider=sidewalk_height, ShowBounds=False, ShowTicks=False, ShowTooltip=False, ShowValLabel=True, showLabel=True)
create_slider_3 = CreateSlider(Slider=sidewalk, ShowBounds=False, ShowTicks=False, ShowTooltip=False, ShowValLabel=True, showLabel=True)
create_slider_4 = CreateSlider(Slider=unit_division, ShowBounds=False, ShowTicks=False, ShowTooltip=False, ShowValLabel=True, showLabel=True)
create_slider_5 = CreateSlider(Slider=courtyard_offset, ShowBounds=False, ShowTicks=False, ShowTooltip=False, ShowValLabel=True, showLabel=True)
create_text_box_3 = CreateTextBox(Label="Number of Floors", DefaultText=floors, UpdateButton=True, showLabel=True)
create_text_box_4 = CreateTextBox(Label="Roof Type", DefaultText=roof_type, UpdateButton=True, showLabel=True)
create_color_picker = CreateColorPicker(DefaultColor=courtyard)
create_color_picker_2 = CreateColorPicker(DefaultColor=sidewalk_2)
create_color_picker_3 = CreateColorPicker(DefaultColor=buildings)
create_color_picker_4 = CreateColorPicker(DefaultColor=roofs)
create_color_picker_5 = CreateColorPicker(DefaultColor=flat_roof)
merge = Merge(
    Data1=create_text_box_2,
    Data2=create_slider,
    Data3=create_separator,
    Data4=create_slider_2,
    Data5=create_slider_3,
    Data6=create_separator_2,
    Data7=create_slider_4,
    Data8=create_slider_5)
merge_2 = Merge(
    Data1=create_label,
    Data2=create_color_picker,
    Data3=create_label_2,
    Data4=create_color_picker_2,
    Data5=create_label_3,
    Data6=create_color_picker_3,
    Data7=create_label_4,
    Data8=create_color_picker_4,
    Data9=create_label_5,
    Data10=create_color_picker_5)
create_slider_6 = CreateSlider(Slider=green_roof_offset, ShowBounds=False, ShowTicks=False, ShowTooltip=False, ShowValLabel=True, showLabel=True)
create_slider_7 = CreateSlider(Slider=roof_offset, ShowBounds=False, ShowTicks=False, ShowTooltip=False, ShowValLabel=True, showLabel=True)
create_slider_8 = CreateSlider(Slider=roof_height, ShowBounds=False, ShowTicks=False, ShowTooltip=False, ShowValLabel=True, showLabel=True)
merge_3 = Merge(Data1=create_slider_6, Data2=create_slider_7, Data3=create_slider_8)
panel = Panel("""PLOT
ROOF
BLOCK
APPEARANCE
HELP""")
accent_colors = ValueList({"Amber", "Blue", "Brown", "Cobalt", "Crimson", "Cyan", "Emerald", "Green", "Indigo", "Lime", "Magenta", "Mauve", "Olive", "Orange", "Pink", "Purple", "Red", "Sienna", "Steel", "Taupe", "Teal", "Violet", "Yellow"}, selected="Amber")
file_path = FilePath("C:\Users\ssanjay\Desktop\PhD\Other Projects\OG\logo.png")
launch_window = LaunchWindow(Show=Toggle(True), Name="BLOCK TOOL v 0.01", Width=370, Height=400, ChildStatus=0, EnableHorizScroll=False)
colour_swatch_2 = ColourSwatch(SwatchColor=RGB(255, 97, 97))
create_image = CreateImage(ImageSource=file_path, ImageWidth=320)
value_listener = ValueListener(Elements=create_text_box_3, SomeProperty=True)  # -> flatten(Values), Indices
value_listener_2 = ValueListener(Elements=create_slider, SomeProperty=True)  # -> flatten(Values), Indices
value_listener_3 = ValueListener(Elements=create_slider_2, SomeProperty=True)  # -> flatten(Values), Indices
value_listener_4 = ValueListener(Elements=create_slider_3, SomeProperty=True)  # -> flatten(Values), Indices
value_listener_5 = ValueListener(Elements=create_slider_4, SomeProperty=True)  # -> flatten(Values), Indices
value_listener_6 = ValueListener(Elements=create_slider_5, SomeProperty=True)  # -> flatten(Values), Indices
value_listener_7 = ValueListener(Elements=create_text_box, SomeProperty=True)  # -> flatten(Values), Indices
value_listener_8 = ValueListener(Elements=create_text_box_4, SomeProperty=True)  # -> flatten(Values), Indices
value_listener_9 = ValueListener(Elements=create_slider_6, SomeProperty=True)  # -> flatten(Values), Indices
value_listener_10 = ValueListener(Elements=create_slider_7, SomeProperty=True)  # -> flatten(Values), Indices
value_listener_11 = ValueListener(Elements=create_slider_8, SomeProperty=True)  # -> flatten(Values), Indices
value_listener_12 = ValueListener(Elements=create_color_picker, SomeProperty=True)  # -> flatten(Values), Indices
value_listener_13 = ValueListener(Elements=create_color_picker_2, SomeProperty=True)  # -> flatten(Values), Indices
value_listener_14 = ValueListener(Elements=create_color_picker_3, SomeProperty=True)  # -> flatten(Values), Indices
value_listener_15 = ValueListener(Elements=create_color_picker_4, SomeProperty=True)  # -> flatten(Values), Indices
value_listener_16 = ValueListener(Elements=create_color_picker_5, SomeProperty=True)  # -> flatten(Values), Indices
value_listener_17 = ValueListener(Elements=create_text_box_2, SomeProperty=True)  # -> flatten(Values), Indices
merge_4 = Merge(Data1=create_text_box, Data2=create_text_box_3, Data3=create_text_box_4)
tabbed_view = TabbedView(
    TabNames=panel,
    TabTextSize=Slider(17, range=0..100),
    Tab0=flatten(merge),
    Tab1=flatten(merge_3),
    Tab2=flatten(merge_4),
    Tab3=flatten(merge_2))
merge_5 = Merge(Data1=create_image, Data2=tabbed_view)
add_elements = AddElements(Window=launch_window, Elements=flatten(merge_5), DoVLChecking=True)  # -> AddedElements, ElementNames
set_window_properties = SetWindowProperties(
    Window=launch_window,
    Theme=Toggle(True),
    AccentColor=accent_colors,
    ShowTitleBar=Toggle(True),
    BackgroundColor=ColourSwatch(SwatchColor=RGB(47, 44, 56)),
    ScaleFactor=1)

# ----
panel_2 = Panel(document_info._3rdPartyAssemblies)

# ---- group: INPUT CURVE
panel_3 = Panel("curve")
dynamic_geometry_pipeline = DynamicGeometryPipeline(
    LayerFilter=value_listener_17.Values,
    TypeFilter=panel_3,
    NameFilter="*",
    GroupByLayer=False,
    GroupByType=False,
    IncludeHidden=True,
    IncludeLocked=True,
    enableFullPath=False,
    listenToAttributes=True)  # -> graft(GeometryOut)
rectangle = Rectangle(Plane=PlaneXY(0, 0, 0), XSize=Domain(-1, 1), YSize=Domain(-2, 2), Radius=0)  # -> Rectangle, Length
flip_curve = FlipCurve(Curve=dynamic_geometry_pipeline, Guide=rectangle.Rectangle)  # -> Curve, Flag
control_wire_display = ControlWireDisplay(WireDisplay="2", AllObjects_Object=[dynamic_geometry_pipeline, panel_3, flip_curve, rectangle])

# ---- group: SITE_PARTS / MAKE SIDEWALK
sidewalk_3 = SideWalk(curve=flip_curve.Curve, distance=value_listener_4.Values, edges=flip_curve.Curve, factor=value_listener_3.Values)

# ---- group: SITE_PARTS
bld_inner = OffsetCurve(Curve=flip_curve.Curve, Distance=expr("-x", value_listener_2.Values), Corners=1)
control_wire_display_2 = ControlWireDisplay(WireDisplay="2", AllObjects_Object=[bld_inner, sidewalk_3, boundary_surfaces, courtyard_2])

# ---- group: SITE_PARTS / MAKE COURTYARD
courtyard_2 = OffsetCurve(Curve=bld_inner, Distance=expr("-x", value_listener_6.Values), Corners=1)
boundary_surfaces = BoundarySurfaces(Edges=courtyard_2)

# ---- group: CLEAN CORNERS
corner_unit_buffer = Slider(10, range=0..100)
explode = Explode(Curve=bld_inner, Recursive=True)  # -> Segments, Vertices
clean_corners = CleanCorners(plane=explode.Vertices, radius=corner_unit_buffer, curve=bld_inner, count=value_listener_5.Values)  # -> index, points, tangents, parameters
control_wire_display_3 = ControlWireDisplay(WireDisplay="2", AllObjects_Object=[explode, corner_unit_buffer, clean_corners])

# ---- group: MAKE FOOTPRINT
data = Data(clean_corners.index)
unit_z = UnitZ(Factor=1)
cull_index = CullIndex(List=clean_corners.points, Indices=data, Wrap=True)
cull_index_2 = CullIndex(List=clean_corners.tangents, Indices=data, Wrap=True)
cross_product = CrossProduct(VectorA=cull_index_2, VectorB=unit_z, Unitize=False)  # -> Vector, Length
boundary_surfaces_2 = BoundarySurfaces(Edges=flatten([bld_inner, flip_curve.Curve]))
line_sdl = LineSDL(Start=cull_index, Direction=cross_product.Vector, Length=value_listener_2.Values)
surface_split = SurfaceSplit(Surface=boundary_surfaces_2, Curves=line_sdl)
control_wire_display_4 = ControlWireDisplay(
    WireDisplay="2",
    AllObjects_Object=[cull_index, boundary_surfaces_2, cull_index_2, cross_product, unit_z, data, line_sdl, surface_split])

# ---- group: CHEAP CONTOUR
chp_ctr = GhPythonScript(footprint=surface_split, ht=value_listener_7.Values, flr=value_listener.Values)  # -> out, list_height, list_floors, mass_add; inputs footprint: list of Brep, ht: list, flr: list
# ---------- chp_ctr: Python ----------
from ghpythonlib import treehelpers as th
len_zones = len(footprint)
list_height = []
list_floors = []
default_height = 3
default_floors = 4

for x in ht:
    list_height.append(x)
for x in flr:
    list_floors.append(x)
for i in range(0,len_zones-len(ht)):
    list_height.append(default_height)
    list_floors.append(default_floors)
mass_add = []
extrude_height = []

for i in range(len_zones):
    extrude_height = []
    single_ht = list_height[i]
    single_flr = list_floors[i]
    counter = 1
    while single_flr>0:
        extrude_height.append(single_ht*counter)
        counter +=1
        single_flr-=1
    mass_add.append(extrude_height)
mass_add = th.list_to_tree(mass_add)
# ---------- end chp_ctr ----------
unit_z_2 = UnitZ(Factor=chp_ctr.mass_add)
flip_matrix = FlipMatrix(Data=unit_z_2)
curve = Curve(surface_split)
move = Move(Geometry=curve, Motion=flip_matrix)  # -> simplify(Geometry), Transform

# ---- group: MASS BUILDING
multiplication = Multiplication(FloorHeight=chp_ctr.list_height, Floors=chp_ctr.list_floors)
unit_z_3 = UnitZ(Factor=multiplication)
extrude = Extrude(Base=surface_split, Direction=unit_z_3)
control_wire_display_5 = ControlWireDisplay(WireDisplay="2", AllObjects_Object=[extrude, multiplication, chp_ctr, curve, move])

# ---- group: CALCULATE AREA
area = Area(Geometry=surface_split)  # -> Area, Centroid
addition = Addition(A=multiplication, B=roof_height, C="1")
multiplication_2 = Multiplication(A=area.Area, B=chp_ctr.list_floors)
unit_z_4 = UnitZ(Factor=addition)
round = Round(Number=multiplication_2)  # -> Nearest, Floor, Ceiling
move_2 = Move(Geometry=area.Centroid, Motion=unit_z_4)  # -> Geometry, Transform
area_2 = Area(Geometry=boundary_surfaces)  # -> Area, Centroid
colour_swatch_3 = ColourSwatch(SwatchColor=RGB(0, 0, 0))
mass_addition = MassAddition(Input=round.Nearest)  # -> Result, PartialResults
text_tag = TextTag(Location=area_2.Centroid, Text=mass_addition.Result, Colour=colour_swatch_3)
text_tag_2 = TextTag(Location=move_2.Geometry, Text=round.Nearest, Colour=colour_swatch_3)

# ---- group: MAKE ROOFS
deconstruct_brep = DeconstructBrep(Brep=extrude)  # -> Faces, Edges, Vertices
control_wire_display_6 = ControlWireDisplay(WireDisplay="2", AllObjects_Object=[deconstruct_brep, list_item, rf_green, rf_flat, rf_sloped])
list_item = ListItem(List=deconstruct_brep.Faces, Index=0, Wrap=True)  # -> flatten(Item1), Item
rf_green = RF_GREEN(curve=list_item.Item1, distance=value_listener_9.Values)
rf_sloped = GableRoof2(
    geometry=line_sdl,
    motion_2=unit_z_3,
    curve_2=flip_curve.Curve,
    distance=value_listener_10.Values,
    motion=unit_z_3,
    factor=value_listener_11.Values,
    curve=surface_split)  # -> flatten(brep)
rf_flat = RF_FLAT(surface=list_item.Item1)

# ---- group: COLOR ROOFS
clr_roof = GhPythonScript(
    roof_type=value_listener_8.Values,
    default=rf_sloped,
    default_colour=value_listener_15.Values,
    flat_colour=value_listener_16.Values,
    green_colour=value_listener_12.Values,
    gable_colour=value_listener_15.Values,
    flat=rf_flat,
    green=rf_green,
    gable=rf_sloped)  # -> out, roof, colours; inputs roof_type: list, default: list of Brep, flat: list of Brep, green: list of Brep, gable: list of Brep
# ---------- clr_roof: Python ----------
roof=[]
colours = []
l = len(flat)
l_in = len(roof_type)
for i in range(len(roof_type)):
    if roof_type[i] == 'green':
        roof.append(green[i])
        colours.append(green_colour)
    elif roof_type[i] == 'gable':
        roof.append(gable[i])
        colours.append(gable_colour)
    else:
        roof.append(flat[i])
        colours.append(flat_colour)
for i in range(l_in,l):
    roof.append(default[i])
    colours.append(default_colour)
# ---------- end clr_roof ----------
control_wire_display_7 = ControlWireDisplay(WireDisplay="2", AllObjects_Object=clr_roof)

# ---- group: COLOR BY AREA
area_3 = Area(Geometry=surface_split)  # -> Area, Centroid
control_wire_display_8 = ControlWireDisplay(WireDisplay="2", AllObjects_Object=[area, addition, area_3])

# ----
min_max = GhPythonScript(x=area_3.Area)  # -> a, b; inputs x: list
# ---------- min_max: Python ----------
a = min(x)
b = max(x)
# ---------- end min_max ----------

# ---- group: COLOR BY AREA (continued)
gradient = Gradient(
    LowerLimit=min_max.a,
    UpperLimit=min_max.b,
    Parameter=area_3.Area,
    stops=[0: RGB(0, 128, 0), 0.5: RGB(255, 255, 0), 1: RGB(255, 0, 0)])

# ---- group: VIZ
brep_wireframe = BrepWireframe(Brep=[extrude, clr_roof.roof], Density=-1)
custom_preview = CustomPreview(Geometry=extrude, Material=gradient)
custom_preview_2 = CustomPreview(Geometry=boundary_surfaces, Material=value_listener_12.Values)
custom_preview_3 = CustomPreview(Geometry=sidewalk_3, Material=value_listener_13.Values)
custom_preview_4 = CustomPreview(Geometry=extrude, Material=value_listener_14.Values)
custom_preview_5 = CustomPreview(Geometry=clr_roof.roof, Material=clr_roof.colours)
panel_4 = Panel("black")
custom_preview_lineweights = CustomPreviewLineweights(Geometry=[brep_wireframe, move.Geometry], Shader=panel_4, Absolute=False)
control_wire_display_9 = ControlWireDisplay(
    WireDisplay="2",
    AllObjects_Object=[custom_preview_5, custom_preview_4, custom_preview_3, custom_preview_2, custom_preview_lineweights, panel_4, brep_wireframe, custom_preview])

# ==== cluster RF_GREEN
curve = ClusterInput()
distance = ClusterInput()

# ---- group: Green Roof
offset_curve = OffsetCurve(Curve=curve, Distance=expr("-x", distance), Corners=1)  # -> flatten(Curve)
boundary_surfaces = BoundarySurfaces(Edges=offset_curve)  # -> flatten(Surfaces)
move = Move(Geometry=boundary_surfaces, Motion="0,0,0.01")  # -> Geometry, Transform

# ----
geometry = ClusterOutput(move.Geometry)

# ==== cluster RF_FLAT
surface = ClusterInput()

# ---- group: Flat Roof
surface_2 = Surface(flatten(surface))
move = Move(Geometry=surface_2, Motion="0,0,0.01")  # -> Geometry, Transform

# ----
geometry = ClusterOutput(move.Geometry)

# ==== cluster CleanCorners
curve = ClusterInput()
count = ClusterInput()
plane = ClusterInput()
radius = ClusterInput()

# ---- group: No corners
divide_curve = DivideCurve(Curve=curve, Count=count, Kinks=False)  # -> Points, Tangents, Parameters
circle = Circle(Plane=plane, Radius=radius)
point_in_curves = PointInCurves(Point=divide_curve.Points, Curves=circle)  # -> Relationship, Index, Point
integer = Integer("2")
member_index = MemberIndex(Set=point_in_curves.Relationship, Member=integer)  # -> Index, Count

# ----
points = ClusterOutput(divide_curve.Points)
tangents = ClusterOutput(divide_curve.Tangents)
parameters = ClusterOutput(divide_curve.Parameters)
index = ClusterOutput(member_index.Index)

# ==== cluster SideWalk
curve = ClusterInput()
distance = ClusterInput()
factor = ClusterInput()
edges = ClusterInput()

# ---- group: Sidewalk
offset_curve = OffsetCurve(Curve=curve, Distance=distance, Corners=1)
unit_z = UnitZ(Factor=factor)
fillet = Fillet(Curve=offset_curve, Radius="5")
boundary_surfaces = BoundarySurfaces(Edges=flatten([fillet, edges]))
extrude = Extrude(Base=boundary_surfaces, Direction=unit_z)

# ----
extrusion = ClusterOutput(extrude)

# ==== cluster GableRoof2
curve = ClusterInput()
curve_2 = ClusterInput()
distance = ClusterInput()
curve_3 = Curve(curve)
offset_curve = OffsetCurve(Curve=curve_2, Distance=expr("-x", distance), Corners=1)
trim_with_region = TrimWithRegion(Curve=offset_curve, Region=curve_3)  # -> flatten(Inside), Outside
motion = ClusterInput()
factor = ClusterInput()
move = Move(Geometry=trim_with_region.Inside, Motion=motion)  # -> Geometry, Transform
unit_z = UnitZ(Factor=1)
unit_z_2 = UnitZ(Factor=factor)
geometry = ClusterInput()
motion_2 = ClusterInput()
move_2 = Move(Geometry=geometry, Motion=motion_2)  # -> Geometry, Transform
move_3 = Move(Geometry=move_2.Geometry, Motion=unit_z)  # -> Geometry, Transform
move_4 = Move(Geometry=move.Geometry, Motion=unit_z_2)  # -> Geometry, Transform
move_5 = Move(Geometry=move_4.Geometry, Motion=unit_z)  # -> Geometry, Transform
end_points = EndPoints(Curve=move_3.Geometry)  # -> Start, End
end_points_2 = EndPoints(Curve=move_2.Geometry)  # -> Start, End
end_points_3 = EndPoints(Curve=move_5.Geometry)  # -> Start, End
point = Point(end_points_2.Start)
point_2 = Point(end_points.Start)
point_3 = Point(end_points.End)
point_4 = Point(end_points_2.End)
point_5 = Point(end_points_3.Start)
entwine = Entwine(Branch00=point, Branch01=point_2, Branch02=point_5, Branch03=point_3, Branch04=point_4, FlattenInputs=True)
flip_matrix = FlipMatrix(Data=entwine)
polyline = PolyLine(Vertices=flip_matrix, Closed=invert(False))  # -> flatten(Polyline)
sweep1 = Sweep1(Rail=graft(move_5.Geometry), Sections=graft(polyline), Miter=1)
cap_holes = CapHoles(Brep=sweep1)
brep = ClusterOutput(cap_holes)
