# Grasshopper definition 20211001_Closed Block_UI.gh (Grasshopper 1.0.7)
# Copyright: Liljewall Arkitekter
# Copyright: SS
# Copyright: ss
# Copyright: 2017
# plug-ins: Human, Sasquatch, Human UI

colour_swatch = ColourSwatch(SwatchColor=RGB(84, 84, 84))
create_separator = CreateSeparator(Thickness=Slider(1, range=0..1), Horizontal=True, Color=colour_swatch)
create_separator_2 = CreateSeparator(Thickness=Slider(1, range=0..1), Horizontal=True, Color=colour_swatch)
number_slider = Slider(500, range=0..1000)
panel = Panel("""PLOT
ROOF
BLOCK
APPEARANCE
RULES""")
accent_colors = ValueList({"Amber", "Blue", "Brown", "Cobalt", "Crimson", "Cyan", "Emerald", "Green", "Indigo", "Lime", "Magenta", "Mauve", "Olive", "Orange", "Pink", "Purple", "Red", "Sienna", "Steel", "Taupe", "Teal", "Violet", "Yellow"}, selected="Amber")
file_path = FilePath("C:\Users\ssanjay\Desktop\PhD\Other Projects\OG\logo.png")
launch_window = LaunchWindow(Show=Toggle(True), Name="BLOCK TOOL v 0.01", Width=370, Height="1000", ChildStatus=0, EnableHorizScroll=False)
colour_swatch_2 = ColourSwatch(SwatchColor=RGB(255, 97, 97))
create_image = CreateImage(ImageSource=file_path, ImageWidth=320)
set_window_properties = SetWindowProperties(
    Window=launch_window,
    Theme=Toggle(True),
    AccentColor=accent_colors,
    ShowTitleBar=Toggle(True),
    BackgroundColor=ColourSwatch(SwatchColor=RGB(47, 44, 56)),
    ScaleFactor=1)

bool_hide_errors = BooleanToggle(False)
read_from_existing_file = BooleanToggle(True)
save_config_to_file = Button()
select_active_curve = Slider(0, range=0..10)

unit_division_type = ValueList({"Divide by Count": 0, "Divide by Distance": 1}, selected="Divide by Distance")
unit_divide_count = Slider(8, range=0..100)
unit_divide_distance = Slider(10, range=0..10)

default_floor_height = Slider(3.5, range=0..10)
default_floor_number = Slider(4, range=0..10)
building_depth = Slider(15.8, range=4..50)
sidewalk_height = Slider(-2.3, range=-4..4)
sidewalk_depth = Slider(6.3, range=0..10)
courtyard_offset = Slider(5, range=0..10)
corner_unit_buffer = Slider(10, range=1..100)

color_building_by = ValueList({"Default": 0, "Floorplate Area": 1, "Block Area": 2, "Shape": 3}, selected="Floorplate Area")
label_building_by = ValueList({"Floor Plate Area": 0, "Block Area": 1}, selected="Floor Plate Area")
courtyard = ColourSwatch(SwatchColor=RGB(149, 178, 89))
sidewalk = ColourSwatch(SwatchColor=RGB(153, 153, 153))
buildings = ColourSwatch(SwatchColor=RGB(209, 207, 188))
sloped_roofs = ColourSwatch(SwatchColor=RGB(140, 133, 112))
flat_roof = ColourSwatch(SwatchColor=RGB(201, 141, 141))

# ---- group: UI APPEARANCE
create_label = CreateLabel(LabelText="Visualise data", LabelSize=12, Justification=0)
create_pulldown_menu = CreatePulldownMenu(ListItems=color_building_by, showLabel=True)
create_pulldown_menu_2 = CreatePulldownMenu(ListItems=label_building_by, showLabel=True)
create_label_2 = CreateLabel(LabelText="Courtyard", LabelSize=12, Justification=0)
create_color_picker = CreateColorPicker(DefaultColor=courtyard)
create_label_3 = CreateLabel(LabelText="Sidewalk", LabelSize=12, Justification=0)
create_color_picker_2 = CreateColorPicker(DefaultColor=sidewalk)
create_label_4 = CreateLabel(LabelText="Buildings", LabelSize=12, Justification=0)
create_color_picker_3 = CreateColorPicker(DefaultColor=buildings)
create_label_5 = CreateLabel(LabelText="Sloped Roofs", LabelSize=12, Justification=0)
create_color_picker_4 = CreateColorPicker(DefaultColor=sloped_roofs)
create_label_6 = CreateLabel(LabelText="Flat Roofs", LabelSize=12, Justification=0)
create_color_picker_5 = CreateColorPicker(DefaultColor=flat_roof)
value_listener = ValueListener(Elements=create_pulldown_menu, SomeProperty=True)  # -> Values, Indices
value_listener_2 = ValueListener(Elements=create_pulldown_menu_2, SomeProperty=True)  # -> Values, Indices
value_listener_3 = ValueListener(Elements=create_color_picker, SomeProperty=True)  # -> Values, Indices
value_listener_4 = ValueListener(Elements=create_color_picker_2, SomeProperty=True)  # -> Values, Indices
value_listener_5 = ValueListener(Elements=create_color_picker_3, SomeProperty=True)  # -> Values, Indices
value_listener_6 = ValueListener(Elements=create_color_picker_4, SomeProperty=True)  # -> Values, Indices
value_listener_7 = ValueListener(Elements=create_color_picker_5, SomeProperty=True)  # -> Values, Indices
merge = Merge(
    Data1=create_label,
    Data2=create_pulldown_menu,
    Data3=create_pulldown_menu_2,
    Data4=create_label_2,
    Data5=create_color_picker,
    Data6=create_label_3,
    Data7=create_color_picker_2,
    Data8=create_label_4,
    Data9=create_color_picker_3,
    Data10=create_label_5,
    Data11=create_color_picker_4,
    Data12=create_label_6,
    Data13=create_color_picker_5)

# ----
panel_2 = Panel("Expose Block Numbers")

# ---- group: Roof Config
default_roof_type = ValueList({"Flat": 0, "Green": 1, "Sloped": 2}, selected="Sloped")
green_roof_offset = Slider(2, range=0..10)
roof_sloped_height = Slider(4, range=1..10)
roof_offset = Slider(6, range=2..10)
roof_vertical_height = Slider(2, range=0..10)

# ----
check_minimum_floor_area = Slider(100, range=0..500)
check_minimum_edge_length = Slider(9, range=0..100)
check_minimum_angle_threshold = Slider(17, range=0..100)

floor_height = Panel("""3
3
3
4
5""")
floor_num = Panel("""3
4
8
5
4""")
panel_3 = Panel(value_listener_3.Values)
panel_4 = Panel(value_listener_4.Values)
panel_5 = Panel(value_listener_5.Values)
panel_6 = Panel(value_listener_6.Values)
panel_7 = Panel(value_listener_7.Values)
roof_type = Panel("""green
flat
green
flat
green""")

value_list = ValueList({"One": 0, "Two": 1, "Three": 2, "Four": 3, "Five": 4, "Six": 5, "Seven": 6, "Eight": 7, "Nine": 8, "Ten": 9}, selected="One")
create_pulldown_menu_3 = CreatePulldownMenu(ListItems=unit_division_type, showLabel=True)
create_button = CreateButton(ButtonName="Save config to file", ButtonStyle=0)
create_slider = CreateSlider(Slider=default_floor_height, ShowBounds=False, ShowTicks=False, ShowTooltip=False, ShowValLabel=True, showLabel=True)
create_slider_2 = CreateSlider(Slider=default_floor_number, ShowBounds=False, ShowTicks=False, ShowTooltip=False, ShowValLabel=True, showLabel=True)
create_slider_3 = CreateSlider(Slider=building_depth, ShowBounds=False, ShowTicks=False, ShowTooltip=False, ShowValLabel=True, showLabel=True)
create_slider_4 = CreateSlider(Slider=sidewalk_height, ShowBounds=False, ShowTicks=False, ShowTooltip=False, ShowValLabel=True, showLabel=True)
create_slider_5 = CreateSlider(Slider=sidewalk_depth, ShowBounds=False, ShowTicks=False, ShowTooltip=False, ShowValLabel=True, showLabel=True)
create_slider_6 = CreateSlider(Slider=courtyard_offset, ShowBounds=False, ShowTicks=False, ShowTooltip=False, ShowValLabel=True, showLabel=True)
create_slider_7 = CreateSlider(Slider=corner_unit_buffer, ShowBounds=False, ShowTicks=False, ShowTooltip=False, ShowValLabel=True, showLabel=True)
create_slider_8 = CreateSlider(Slider=unit_divide_count, ShowBounds=False, ShowTicks=False, ShowTooltip=False, ShowValLabel=True, showLabel=True)
create_slider_9 = CreateSlider(Slider=unit_divide_distance, ShowBounds=False, ShowTicks=False, ShowTooltip=False, ShowValLabel=True, showLabel=True)
create_label_7 = CreateLabel(LabelText="Error Report", LabelSize=12, Justification=0)
create_toggle = CreateToggle(Default=bool_hide_errors)
create_toggle_2 = CreateToggle(Default=read_from_existing_file)
value_listener_8 = ValueListener(Elements=create_slider, SomeProperty=True)  # -> Values, Indices
value_listener_9 = ValueListener(Elements=create_slider_2, SomeProperty=True)  # -> Values, Indices
value_listener_10 = ValueListener(Elements=create_slider_3, SomeProperty=True)  # -> Values, Indices
value_listener_11 = ValueListener(Elements=create_slider_4, SomeProperty=True)  # -> Values, Indices
value_listener_12 = ValueListener(Elements=create_slider_5, SomeProperty=True)  # -> Values, Indices
value_listener_13 = ValueListener(Elements=create_slider_6, SomeProperty=True)  # -> Values, Indices
value_listener_14 = ValueListener(Elements=create_slider_7, SomeProperty=True)  # -> Values, Indices
value_listener_15 = ValueListener(Elements=create_toggle, SomeProperty=True)  # -> Values, Indices
value_listener_16 = ValueListener(Elements=create_toggle_2, SomeProperty=True)  # -> Values, Indices
value_listener_17 = ValueListener(Elements=create_button, SomeProperty=True)  # -> Values, Indices
value_listener_18 = ValueListener(Elements=create_pulldown_menu_3, SomeProperty=True)  # -> Values, Indices
value_listener_19 = ValueListener(Elements=create_slider_8, SomeProperty=True)  # -> Values, Indices
value_listener_20 = ValueListener(Elements=create_slider_9, SomeProperty=True)  # -> Values, Indices
merge_2 = Merge(
    Data1=create_slider,
    Data2=create_slider_2,
    Data3=create_slider_3,
    Data4=create_slider_4,
    Data5=create_slider_5,
    Data6=create_slider_6,
    Data7=create_slider_7)
merge_3 = Merge(Data1=create_pulldown_menu_3, Data2=create_slider_8, Data3=create_slider_9)

create_pulldown_menu_4 = CreatePulldownMenu(Label="Select Active Curve", ListItems=value_list, showLabel=True)
create_label_8 = CreateLabel(LabelText="Hide all issues", LabelSize=12, Justification=0)
create_label_9 = CreateLabel(LabelText="Read from existing file", LabelSize=12, Justification=0)
create_expander = CreateExpander(UIElements=merge_2, Header="Design Inputs", Open=True)
create_expander_2 = CreateExpander(UIElements=merge_3, Header="Division Control", Open=True)

value_listener_21 = ValueListener(Elements=create_pulldown_menu_4, SomeProperty=True)  # -> Values, Indices
merge_4 = Merge(
    Data1=create_label_8,
    Data2=create_toggle,
    Data3=create_label_9,
    Data4=create_toggle_2,
    Data5=create_pulldown_menu_4,
    Data6=create_button)

create_expander_3 = CreateExpander(UIElements=merge_4, Header="Configuration", Open=True)
ghpython_script = GhPythonScript(
    save=value_listener_17.Values,
    read_from_file=value_listener_16.Values,
    active_curve=value_listener_21.Indices,
    default_flr_ht=value_listener_8.Values,
    default_flr_no=value_listener_9.Values,
    check_min_flr_area=check_minimum_floor_area,
    check_min_edge_length=check_minimum_edge_length,
    check_min_angle=check_minimum_angle_threshold,
    div_unit_type=value_listener_18.Indices,
    color_bldg_by=value_listener.Indices,
    label_bldg_by=value_listener_2.Indices,
    input_bldg_depth=value_listener_10.Values,
    input_sidewalk_ht=value_listener_11.Values,
    input_sidewalk_depth=value_listener_12.Values,
    input_unit_divide_count=value_listener_19.Values,
    input_unit_divide_distance=value_listener_20.Values,
    input_courtyard_offset=value_listener_13.Values,
    input_corner_unit_buffer=value_listener_14.Values,
    default_roof_type=default_roof_type,
    input_grn_roof_offset=green_roof_offset,
    input_roof_offset=roof_offset,
    input_roof_sloped_ht=roof_sloped_height,
    input_roof_vertical_ht=roof_vertical_height,
    color_courtyard=panel_3,
    color_sidewalk=panel_4,
    color_buildings=panel_5,
    color_sloped_roof=panel_6,
    color_flat_roof=panel_7,
    list_floor_ht=floor_height,
    list_floor_num=floor_num,
    list_roof_type=roof_type)  # -> out, test, active_curve, default_flr_ht, default_flr_no, check_min_flr_area, check_min_edge_length, check_min_angle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; inputs save: Boolean, active_curve: Int32, default_flr_no: Int32, check_min_flr_area: Int32, div_unit_type: Int32, color_bldg_by: Int32, label_bldg_by: Int32, default_roof_type: Int32, list_floor_ht: list, list_floor_num: list, list_roof_type: list
# ---------- ghpython_script: Python ----------
import Grasshopper as gh
import os
import json
from os.path import exists
#Geth the local directory
gh_path = str(os.path.dirname(gh.Instances.DocumentServer.Document[0].FilePath))+'\config'
if not os.path.exists(gh_path):
    os.makedirs(gh_path)
config_key = [
'active_curve',
'default_flr_ht',
'default_flr_no',
'check_min_flr_area',
'check_min_edge_length',
'check_min_angle',
'div_unit_type',
'color_bldg_by',
'label_bldg_by',
'input_bldg_depth',
'input_sidewalk_ht',
'input_sidewalk_depth',
'input_unit_divide_count',
'input_unit_divide_distance',
'input_courtyard_offset',
'input_corner_unit_buffer',
'default_roof_type',
'input_grn_roof_offset',
'input_roof_offset',
'input_roof_sloped_ht',
'input_roof_vertical_ht',
'color_courtyard',
'color_sidewalk',
'color_buildings',
'color_sloped_roof',
'color_flat_roof',
'list_floor_ht',
'list_floor_num',
'list_roof_type'
]
config_in_val = [
_active_curve,
_default_flr_ht,
_default_flr_no,
_check_min_flr_area,
_check_min_edge_length,
_check_min_angle,
_div_unit_type,
_color_bldg_by,
_label_bldg_by,
_input_bldg_depth,
_input_sidewalk_ht,
_input_sidewalk_depth,
_input_unit_divide_count,
_input_unit_divide_distance,
_input_courtyard_offset,
_input_corner_unit_buffer,
_default_roof_type,
_input_grn_roof_offset,
_input_roof_offset,
_input_roof_sloped_ht,
_input_roof_vertical_ht,
_color_courtyard,
_color_sidewalk,
_color_buildings,
_color_sloped_roof,
_color_flat_roof,
_list_floor_ht,
_list_floor_num,
_list_roof_type
]
config_out_val = [
active_curve_,
default_flr_ht_,
default_flr_no_,
check_min_flr_area_,
check_min_edge_length_,
check_min_angle_,
div_unit_type_,
color_bldg_by_,
label_bldg_by_,
input_bldg_depth_,
input_sidewalk_ht_,
input_sidewalk_depth_,
input_unit_divide_count_,
input_unit_divide_distance_,
input_courtyard_offset_,
input_corner_unit_buffer_,
default_roof_type_,
input_grn_roof_offset_,
input_roof_offset_,
input_roof_sloped_ht_,
input_roof_vertical_ht_,
color_courtyard_,
color_sidewalk_,
color_buildings_,
color_sloped_roof_,
color_flat_roof_,
list_floor_ht_,
list_floor_num_,
list_roof_type_
]

active_curve_path = gh_path+'\config_curve_'+str(_active_curve)+'.json'
in_dict = dict(zip(config_key, config_in_val))
if _save:
    with open(active_curve_path, 'w') as fp:
        json.dump(in_dict, fp, indent = 2)
file_exists = exists(active_curve_path)
if file_exists and _read_from_file:
    with open(active_curve_path) as json_file:
        in_dict = json.load(json_file)
        print ('We found a saved configuration!')
        print ('Reading from file now...')
else:
    print('No Saved file found, reading from live inputs...')
active_curve_ = in_dict['active_curve']
default_flr_ht_ =in_dict['default_flr_ht']
default_flr_no_ =in_dict['default_flr_no']
check_min_flr_area_ =in_dict['check_min_flr_area']
check_min_edge_length_ =in_dict['check_min_edge_length']
check_min_angle_ =in_dict['check_min_angle']
div_unit_type_ =in_dict['div_unit_type']
color_bldg_by_ =in_dict['color_bldg_by']
label_bldg_by_ =in_dict['label_bldg_by']
input_bldg_depth_ =in_dict['input_bldg_depth']
input_sidewalk_ht_ =in_dict['input_sidewalk_ht']
input_sidewalk_depth_ =in_dict['input_sidewalk_depth']
input_unit_divide_count_ =in_dict['input_unit_divide_count']
input_unit_divide_distance_ =in_dict['input_unit_divide_distance']
input_courtyard_offset_ =in_dict['input_courtyard_offset']
input_corner_unit_buffer_ =in_dict['input_corner_unit_buffer']
default_roof_type_ =in_dict['default_roof_type']
input_grn_roof_offset_ =in_dict['input_grn_roof_offset']
input_roof_offset_ =in_dict['input_roof_offset']
input_roof_sloped_ht_ =in_dict['input_roof_sloped_ht']
input_roof_vertical_ht_ =in_dict['input_roof_vertical_ht']
color_courtyard_ =in_dict['color_courtyard']
color_sidewalk_ =in_dict['color_sidewalk']
color_buildings_ = in_dict['color_buildings']
color_sloped_roof_ =in_dict['color_sloped_roof']
color_flat_roof_ =in_dict['color_flat_roof']
list_floor_ht_ =in_dict['list_floor_ht']
list_floor_num_ =in_dict['list_floor_num']
list_roof_type_ =in_dict['list_roof_type']
# ---------- end ghpython_script ----------

# ---- group: Check Document Units
geometry_pipeline = GeometryPipeline(
    GroupByLayer=False,
    GroupByType=False,
    IncludeHidden=True,
    IncludeLocked=True,
    LayerFilter="IN",
    NameFilter="*",
    SublayerFiltering=True,
    TypeFilter=4)
document_units = DocumentUnits()
ghpython_script_2 = GhPythonScript(x=document_units)  # -> out, a
# ---------- ghpython_script_2: Python ----------
if x == 'm':
    a = True
else:
    a = False
# ---------- end ghpython_script_2 ----------
stream_gate = StreamGate(Stream=geometry_pipeline, Gate=ghpython_script_2.a)  # -> Target0, Target1
list_item = ListItem(List=stream_gate.Target1, Index=value_listener_21.Indices, Wrap=True)

# ---- group: Redirect open and closed curves
closed = Closed(Curve=list_item)  # -> Closed, Periodic
stream_gate_2 = StreamGate(Stream=list_item, Gate=closed.Closed)  # -> Target0, Target1

# ---- group: Open Curve / Make Building
flip_open_curve = BooleanToggle(False)
flip_curve = FlipCurve(Curve=stream_gate_2.Target0)  # -> Curve, Flag
stream_filter = StreamFilter(Gate=flip_open_curve, Stream0=stream_gate_2.Target0, Stream1=flip_curve.Curve)
explode = Explode(Curve=stream_filter, Recursive=True)  # -> Segments, Vertices
offset_curve = OffsetCurve(Curve=stream_filter, Distance=ghpython_script.input_bldg_depth, Corners=1)
stream_gate_3 = StreamGate(Stream=stream_filter, Gate=value_listener_18.Indices)  # -> Target0, Target1
loft = Loft(
    Curves=flatten([offset_curve, stream_filter]),
    Options={Adjust=False, Closed=False, LoftEnds=0, LoftSimp=0, LoftType=0, Rebuild=10, Refit=0.01})

# ---- group: INPUT CURVE
# CREATE LAYER FROM USER INPUT IF NOT ALREADY THERE
rectangle = Rectangle(Plane=PlaneXY(0, 0, 0), XSize=Domain(-1, 1), YSize=Domain(-2, 2), Radius=0)  # -> Rectangle, Length
flip_curve_2 = FlipCurve(Curve=stream_gate_2.Target1, Guide=rectangle.Rectangle)  # -> Curve, Flag

# ---- group: Open Curve / Divide floor
divide_distance = DivideDistance(Curve=stream_gate_3.Target1, Distance=ghpython_script.input_unit_divide_distance)  # -> Points, Tangents, Parameters
divide_curve = DivideCurve(Curve=stream_gate_3.Target0, Count=ghpython_script.input_unit_divide_count, Kinks=False)  # -> Points, Tangents, Parameters

# ---- group: SITE_PARTS / MAKE SIDEWALK
sidewalk_2 = SideWalk(
    curve=[flip_curve_2.Curve, loft],
    distance=ghpython_script.input_sidewalk_depth,
    edges=flip_curve_2.Curve,
    factor=ghpython_script.input_sidewalk_ht)

# ---- group: SITE_PARTS
bld_inner = OffsetCurve(Curve=flip_curve_2.Curve, Distance=expr("-x", ghpython_script.input_bldg_depth), Corners=1)

# ---- group: SITE_PARTS / MAKE COURTYARD
courtyard_2 = OffsetCurve(Curve=bld_inner, Distance=expr("-x", ghpython_script.input_courtyard_offset), Corners=1)
boundary_surfaces = BoundarySurfaces(Edges=courtyard_2)

# ---- group: Open Curve / Buffer Circle
circle_cnr = CircleCNR(Center=explode.Vertices, Normal=Vector(0, 0, 1), Radius=ghpython_script.input_corner_unit_buffer)
point_in_curves = PointInCurves(Point=[divide_curve.Points, divide_distance.Points], Curves=circle_cnr)  # -> Relationship, Index, Point
integer = Integer("2")
unit_z = UnitZ(Factor=1)
member_index = MemberIndex(Set=point_in_curves.Relationship, Member=integer)  # -> Index, Count
cross_product = CrossProduct(VectorA=[divide_curve.Tangents, divide_distance.Tangents], VectorB=unit_z, Unitize=invert(False))  # -> Vector, Length
cull_index = CullIndex(List=member_index.Index, Indices="0", Wrap=True)
cull_index_2 = CullIndex(List=[divide_curve.Points, divide_distance.Points], Indices=cull_index, Wrap=True)
cull_index_3 = CullIndex(List=cross_product.Vector, Indices=cull_index, Wrap=True)

# ---- group: CLEAN CORNERS
explode_2 = Explode(Curve=bld_inner, Recursive=True)  # -> Segments, Vertices
clean_corners = CleanCorners(
    plane=explode_2.Vertices,
    radius=ghpython_script.input_corner_unit_buffer,
    gate=ghpython_script.div_unit_type,
    stream=bld_inner,
    count=ghpython_script.input_unit_divide_count,
    divide_distance=ghpython_script.input_unit_divide_distance)  # -> index, points, tangents, parameters

# ----
min_max = GhPythonScript(x=flatten([ghpython_script.list_floor_ht, ghpython_script.default_flr_ht]))  # -> a, b; inputs x: list
# ---------- min_max: Python ----------
a = min(x)
b = max(x)
# ---------- end min_max ----------
min_max_2 = GhPythonScript(x=flatten([ghpython_script.default_flr_no, ghpython_script.list_floor_num]))  # -> a, b; inputs x: list; same code as min_max
multiplication = Multiplication(A=min_max.a, B=min_max_2.a)
addition = Addition(A=multiplication, B="10")

# ---- group: MAKE FOOTPRINT
data = Data(clean_corners.index)
unit_z_2 = UnitZ(Factor=1)
cull_index_4 = CullIndex(List=clean_corners.points, Indices=data, Wrap=True)
cull_index_5 = CullIndex(List=clean_corners.tangents, Indices=data, Wrap=True)
cross_product_2 = CrossProduct(VectorA=cull_index_5, VectorB=unit_z_2, Unitize=False)  # -> Vector, Length
boundary_surfaces_2 = BoundarySurfaces(Edges=flatten([bld_inner, flip_curve_2.Curve]))
line_sdl = LineSDL(Start=cull_index_4, Direction=cross_product_2.Vector, Length=ghpython_script.input_bldg_depth)
surface_split = SurfaceSplit(Surface=boundary_surfaces_2, Curves=line_sdl)

# ---- group: Open Curve
negative = Negative(Value=cull_index_3)
stream_filter_2 = StreamFilter(Gate=flip_open_curve, Stream0=cull_index_3, Stream1=negative)
line_sdl_2 = LineSDL(Start=cull_index_2, Direction=stream_filter_2, Length=ghpython_script.input_bldg_depth)
end_points = EndPoints(Cutter=line_sdl_2)  # -> Start, End

# ---- group: Check minimum Angle
cluster = Cluster(C=[stream_gate_2.Target1, loft], second_number=ghpython_script.check_min_angle)  # -> simplify(L), larger_than_2
colour_swatch_3 = ColourSwatch(SwatchColor=RGB(204, 0, 0))
cull_pattern = CullPattern(List=cluster.L, CullPattern=cluster.larger_than_2)
unit_z_3 = UnitZ(Factor=addition)
move = Move(Geometry=cull_pattern, Motion=unit_z_3)  # -> Geometry, Transform
move_2 = Move(Geometry=cull_pattern, Motion=unit_z_3)  # -> Geometry, Transform
line = Line(StartPoint=cull_pattern, EndPoint=move_2.Geometry)
stream_gate_4 = StreamGate(Stream=move.Geometry, Gate=value_listener_15.Values)  # -> Target0, Target1
stream_gate_5 = StreamGate(Stream=line, Gate=value_listener_15.Values)  # -> Target0, Target1
panel_8 = Panel("3")
custom_preview_lineweights = CustomPreviewLineweights(Geometry=stream_gate_5.Target0, Shader=colour_swatch_3, Thickness=panel_8, Absolute=False)
text_tag = TextTag(Location=stream_gate_4.Target0, Text="ISSUE : Angle out of threshold", Colour=colour_swatch_3)

# ---- group: Open Curve
open_buildings_curve = Data(stream_filter)
roof_vertical_height_2 = Data(ghpython_script.input_roof_vertical_ht)
roof_sloped_height_2 = Data(ghpython_script.input_roof_sloped_ht)
sloped_roof_offset = Data(ghpython_script.input_roof_offset)
building_depth_2 = Data(ghpython_script.input_bldg_depth)

# ---- group: Open Curve / Remake roofs
offset_curve_2 = OffsetCurve(Curve=open_buildings_curve, Distance=sloped_roof_offset, Corners=1)
offset_curve_3 = OffsetCurve(Curve=open_buildings_curve, Distance=building_depth_2, Corners=1)
curve_closest_point = CurveClosestPoint(Point=end_points.Start, Curve=open_buildings_curve)  # -> Point, Parameter, Distance
curve_closest_point_2 = CurveClosestPoint(Point=end_points.Start, Curve=offset_curve_2)  # -> Point, Parameter, Distance
curve_closest_point_3 = CurveClosestPoint(Point=end_points.Start, Curve=offset_curve_3)  # -> Point, Parameter, Distance
shatter = Shatter(Curve=open_buildings_curve, Parameters=curve_closest_point.Parameter)  # -> graft(Segments)
shatter_2 = Shatter(Curve=offset_curve_2, Parameters=curve_closest_point_2.Parameter)
shatter_3 = Shatter(Curve=offset_curve_3, Parameters=curve_closest_point_3.Parameter)  # -> graft(Segments)
loft_2 = Loft(
    Curves=[shatter, shatter_3],
    Options={Adjust=False, Closed=False, LoftEnds=0, LoftSimp=0, LoftType=0, Rebuild=10, Refit=0.01})  # -> flatten(Loft)

# ----
footprints = Geometry([surface_split, loft_2])

area = Area(Geometry=footprints)  # -> Area, Centroid
smaller_than = SmallerThan(FirstNumber=area.Area, SecondNumber=ghpython_script.check_min_flr_area)  # -> SmallerThan, OrEqualTo
cull_pattern_2 = CullPattern(List=area.Centroid, CullPattern=smaller_than.SmallerThan)
move_3 = Move(Geometry=cull_pattern_2, Motion=unit_z_3)  # -> Geometry, Transform
line_2 = Line(StartPoint=cull_pattern_2, EndPoint=move_3.Geometry)
stream_gate_6 = StreamGate(Stream=move_3.Geometry, Gate=value_listener_15.Values)  # -> Target0, Target1
stream_gate_7 = StreamGate(Stream=line_2, Gate=value_listener_15.Values)  # -> Target0, Target1
custom_preview_lineweights_2 = CustomPreviewLineweights(Geometry=stream_gate_7.Target0, Shader=colour_swatch_3, Thickness=panel_8, Absolute=False)
text_tag_2 = TextTag(Location=stream_gate_6.Target0, Text="ISSUE : Unit Smaller than Minimum Unit Area", Colour=colour_swatch_3)

# ---- group: CHEAP CONTOUR
chp_ctr = GhPythonScript(
    footprint=footprints,
    default_height=ghpython_script.default_flr_ht,
    default_floors=ghpython_script.default_flr_no,
    ht=ghpython_script.list_floor_ht,
    flr=ghpython_script.list_floor_num)  # -> out, list_height, list_floors, mass_add; inputs footprint: list of Brep, ht: list, flr: list
# ---------- chp_ctr: Python ----------
from ghpythonlib import treehelpers as th
len_zones = len(footprint)
list_height = []
list_floors = []

for x in ht:
    list_height.append(x)
for x in flr:
    list_floors.append(x)
for i in range(0,len_zones-len(ht)):
    list_height.append(default_height)
    list_floors.append(default_floors)
mass_add = []
extrude_height = []

for i in range(len_zones):
    extrude_height = []
    single_ht = list_height[i]
    single_flr = list_floors[i]
    counter = 1
    while single_flr>0:
        extrude_height.append(single_ht*counter)
        counter +=1
        single_flr-=1
    mass_add.append(extrude_height)
mass_add = th.list_to_tree(mass_add)
# ---------- end chp_ctr ----------
unit_z_4 = UnitZ(Factor=chp_ctr.mass_add)
flip_matrix = FlipMatrix(Data=unit_z_4)
move_4 = Move(Geometry=footprints, Motion=flip_matrix)  # -> simplify(Geometry), Transform
explode_3 = Explode(Curve=footprints, Recursive=True)  # -> simplify(Segments), Vertices

# ----
length = Length(Curve=explode_3.Segments)  # -> flatten(Length)
smaller_than_2 = SmallerThan(FirstNumber=length, SecondNumber=ghpython_script.check_min_edge_length)  # -> SmallerThan, OrEqualTo
cull_pattern_3 = CullPattern(List=flatten(explode_3.Segments), CullPattern=smaller_than_2.SmallerThan)
cull_pattern_4 = CullPattern(List=length, CullPattern=smaller_than_2.SmallerThan)
curve_middle = CurveMiddle(Curve=cull_pattern_3)
move_5 = Move(Geometry=curve_middle, Motion=unit_z_3)  # -> Geometry, Transform
line_3 = Line(StartPoint=curve_middle, EndPoint=move_5.Geometry)
stream_gate_8 = StreamGate(Stream=move_5.Geometry, Gate=value_listener_15.Values)  # -> Target0, Target1
stream_gate_9 = StreamGate(Stream=line_3, Gate=value_listener_15.Values)  # -> Target0, Target1
custom_preview_lineweights_3 = CustomPreviewLineweights(Geometry=stream_gate_9.Target0, Shader=colour_swatch_3, Thickness=panel_8, Absolute=False)
text_tag_3 = TextTag(Location=stream_gate_8.Target0, Text="ISSUE : Wall shorter than Minimum Edge Length", Colour=colour_swatch_3)

# ---- group: MASS BUILDING
multiplication_2 = Multiplication(FloorHeight=chp_ctr.list_height, Floors=chp_ctr.list_floors)
unit_z_5 = UnitZ(Factor=multiplication_2)
extrude = Extrude(Base=footprints, Direction=unit_z_5)

# ---- group: Open Curve (continued)
building_heights = Data(unit_z_5)

# ---- group: Issues Panel
list_length = ListLength(List=flatten([line_2, line_3, line]))
concatenate = Concatenate(FragmentA=list_length, FragmentB=" Issues detected")
stream_filter_3 = StreamFilter(Gate=ghpython_script_2.a, Stream0="Change Model Units to meters!", Stream1="Model units are fine!")
merge_5 = Merge(Data1=concatenate, Data2=stream_filter_3, Data3=ghpython_script.out)

# ----
panel_9 = Panel(merge_5)

create_text_block = CreateTextBlock(Text=flatten(panel_9), TextSize=12, Justification=0)
merge_6 = Merge(Data1=create_label_7, Data2=create_text_block, Data4=create_expander_3, Data5=create_expander, Data6=create_expander_2)

tabbed_view = TabbedView(TabNames=panel, TabTextSize=Slider(17, range=0..100), Tab0=flatten(merge_6), Tab3=flatten(merge))
merge_7 = Merge(Data1=create_image, Data2=tabbed_view)
add_elements = AddElements(Window=launch_window, Elements=flatten(merge_7), DoVLChecking=True)  # -> AddedElements, ElementNames

area_2 = Area(Geometry=footprints)  # -> Area, Centroid
round = Round(Number=area_2.Area)  # -> Nearest, Floor, Ceiling
concatenate_2 = Concatenate(FragmentA=round.Nearest, FragmentB=" m²")

# ---- group: Floorplate Area
area_3 = Area(Geometry=footprints)  # -> Area, Centroid
min_max_3 = GhPythonScript(x=area_3.Area)  # -> a, b; inputs x: list; same code as min_max
gradient = Gradient(
    LowerLimit=min_max_3.a,
    UpperLimit=min_max_3.b,
    Parameter=area_3.Area,
    stops=[0: RGB(0, 128, 0), 0.5: RGB(255, 255, 0), 1: RGB(255, 0, 0)])

# ----
multiplication_3 = Multiplication(A=area_2.Area, B=chp_ctr.list_floors)
round_2 = Round(Number=multiplication_3)  # -> Nearest, Floor, Ceiling
concatenate_3 = Concatenate(FragmentA=round_2.Nearest, FragmentB=" m²")

list_length_2 = ListLength(List=explode_3.Vertices)  # -> flatten(Length)
min_max_4 = GhPythonScript(x=list_length_2)  # -> a, b; inputs x: list; same code as min_max
gradient_2 = Gradient(
    LowerLimit=min_max_4.a,
    UpperLimit=min_max_4.b,
    Parameter=list_length_2,
    stops=[0.15: RGB(255, 130, 160), 0.85: RGB(220, 0, 40)])

# ---- group: Block Area
min_max_5 = GhPythonScript(x=multiplication_3)  # -> a, b; inputs x: list; same code as min_max
gradient_3 = Gradient(
    LowerLimit=min_max_5.a,
    UpperLimit=min_max_5.b,
    Parameter=multiplication_3,
    stops=[0: RGB(0, 128, 0), 0.5: RGB(255, 255, 0), 1: RGB(255, 0, 0)])

# ---- group: MAKE ROOFS
deconstruct_brep = DeconstructBrep(Brep=extrude)  # -> Faces, Edges, Vertices
list_item_2 = ListItem(List=deconstruct_brep.Faces, Index=0, Wrap=True)  # -> flatten(Item1), Item
# wishlist - Force rotated ridge roof
rf_sloped = GableRoof2(
    roofverticalheight=ghpython_script.input_roof_vertical_ht,
    geometry=line_sdl,
    motion_2=unit_z_5,
    curve=flip_curve_2.Curve,
    distance=ghpython_script.input_roof_offset,
    motion=unit_z_5,
    buildingfootprint=footprints,
    factor=ghpython_script.input_roof_sloped_ht)  # -> flatten(brep)
rf_green = RF_GREEN(curve=list_item_2.Item1, distance=ghpython_script.input_grn_roof_offset)
rf_flat = RF_FLAT(surface=list_item_2.Item1)

# ---- group: Open Curve / Actual Roof Script
unit_z_6 = UnitZ(Factor=roof_vertical_height_2)
unit_z_7 = UnitZ(Factor=roof_sloped_height_2)
vector = Vector(building_heights)
move_6 = Move(Geometry=flatten(curve_closest_point.Point), Motion=vector)  # -> Geometry, Transform
move_7 = Move(Geometry=flatten(curve_closest_point_3.Point), Motion=vector)  # -> Geometry, Transform
move_8 = Move(Geometry=curve_closest_point_2.Point, Motion=vector)  # -> Geometry, Transform
move_9 = Move(Geometry=shatter_2, Motion=vector)  # -> Geometry, Transform
move_10 = Move(Geometry=move_9.Geometry, Motion=unit_z_6)  # -> Geometry, Transform
move_11 = Move(Geometry=move_10.Geometry, Motion=unit_z_7)  # -> Geometry, Transform
move_12 = Move(Geometry=move_8.Geometry, Motion=unit_z_6)  # -> Geometry, Transform
move_13 = Move(Geometry=move_12.Geometry, Motion=unit_z_7)  # -> Geometry, Transform
move_14 = Move(Geometry=move_6.Geometry, Motion=unit_z_6)  # -> Geometry, Transform
move_15 = Move(Geometry=move_7.Geometry, Motion=unit_z_6)  # -> Geometry, Transform
point = Point(move_6.Geometry)
point_2 = Point(move_14.Geometry)
point_3 = Point(move_13.Geometry)
point_4 = Point(move_15.Geometry)
point_5 = Point(move_7.Geometry)
entwine = Entwine(Branch00=point, Branch01=point_2, Branch02=point_3, Branch03=point_4, Branch04=point_5, FlattenInputs=True)
flip_matrix_2 = FlipMatrix(Data=entwine)
polyline = PolyLine(Vertices=flip_matrix_2, Closed=invert(False))
sweep1 = Sweep1(Rail=graft(move_11.Geometry), Sections=polyline, Miter=Slider(1, range=0..2))  # -> flatten(Brep)
cap_holes = CapHoles(Brep=sweep1)  # -> flatten(Brep)
sloped_roofs_2 = Data(cap_holes)

# ----
stream_filter_4 = StreamFilter(
    Gate=ghpython_script.color_bldg_by,
    Stream0=ghpython_script.color_buildings,
    Stream1=gradient,
    Stream2=gradient_3,
    Stream3=gradient_2)
sloped_roof = Brep([rf_sloped, sloped_roofs_2])

# ---- group: COLOR ROOFS
stream_filter_5 = StreamFilter(Gate=ghpython_script.default_roof_type, Stream0=rf_flat, Stream1=rf_green, Stream2=sloped_roof)
stream_filter_6 = StreamFilter(
    Gate=ghpython_script.default_roof_type,
    Stream0=ghpython_script.color_flat_roof,
    Stream1=ghpython_script.color_courtyard,
    Stream2=ghpython_script.color_sloped_roof)
clr_roof = GhPythonScript(
    roof_type=ghpython_script.list_roof_type,
    default=stream_filter_5,
    default_colour=stream_filter_6,
    flat_colour=ghpython_script.color_flat_roof,
    green_colour=ghpython_script.color_courtyard,
    gable_colour=ghpython_script.color_sloped_roof,
    flat=rf_flat,
    green=rf_green,
    gable=sloped_roof)  # -> out, roof, colours; inputs roof_type: list, default: list of Brep, flat: list of Brep, green: list of Brep, gable: list of Brep
# ---------- clr_roof: Python ----------
roof=[]
colours = []
l = len(flat)
l_in = len(roof_type)
for i in range(len(roof_type)):
    if roof_type[i] == 'green':
        roof.append(green[i])
        colours.append(green_colour)
    elif roof_type[i] == 'gable':
        roof.append(gable[i])
        colours.append(gable_colour)
    else:
        roof.append(flat[i])
        colours.append(flat_colour)
for i in range(l_in,l):
    if i<len(default):
        roof.append(default[i])
        colours.append(default_colour)
# ---------- end clr_roof ----------

# ---- group: VIZ
brep_wireframe = BrepWireframe(Brep=[extrude, clr_roof.roof, move_4.Geometry], Density=-1)
curve = Curve(flatten(brep_wireframe))
custom_preview = CustomPreview(Geometry=extrude, Material=stream_filter_4)
custom_preview_2 = CustomPreview(Geometry=boundary_surfaces, Material=ghpython_script.color_courtyard)
custom_preview_3 = CustomPreview(Geometry=sidewalk_2, Material=ghpython_script.color_sidewalk)
custom_preview_4 = CustomPreview(Geometry=extrude, Material=ghpython_script.color_buildings)
custom_preview_5 = CustomPreview(Geometry=clr_roof.roof, Material=clr_roof.colours)
custom_preview_lineweights_4 = CustomPreviewLineweights(Geometry=curve, Shader="black", Thickness="1", Absolute=False)

# ---- group: Show Block Numbers
addition_2 = Addition(A="5", B=ghpython_script.input_sidewalk_depth)
bld_inner_2 = OffsetCurve(Curve=[flip_curve_2.Curve, loft], Distance=addition_2, Corners=1)

# ---- group: CALCULATE AREA
mass_addition = MassAddition(Input=round_2.Nearest)  # -> Result, PartialResults
addition_3 = Addition(A=multiplication_2, B=ghpython_script.input_roof_sloped_ht, C="1")
unit_z_8 = UnitZ(Factor=addition_3)
area_4 = Area(Geometry=boundary_surfaces)  # -> Area, Centroid
move_16 = Move(Geometry=area_2.Centroid, Motion=unit_z_8)  # -> Geometry, Transform
colour_swatch_4 = ColourSwatch(SwatchColor=RGB(0, 0, 0))

# ----
concatenate_4 = Concatenate(A="Courtyard Area ", Fragment_A=mass_addition.Result, Fragment_B=" m²")

stream_filter_7 = StreamFilter(Gate=ghpython_script.label_bldg_by, Stream0=concatenate_2, Stream1=concatenate_3)
text_tag_4 = TextTag(Location=move_16.Geometry, Text=stream_filter_7, Colour=colour_swatch_4)

# ---- group: Show Block Numbers (continued)
curve_closest_point_4 = CurveClosestPoint(Point=move_16.Geometry, Curve=bld_inner_2)  # -> Point, Parameter, Distance
point_list = PointList(Points=curve_closest_point_4.Point, Size=Slider(2, range=0..10))

# ---- group: CALCULATE AREA (continued)
text_tag_5 = TextTag(Location=area_4.Centroid, Text=concatenate_4, Colour=colour_swatch_4)

# ==== cluster RF_GREEN
curve = ClusterInput()
distance = ClusterInput()

# ---- group: Green Roof
offset_curve = OffsetCurve(Curve=curve, Distance=expr("-x", distance), Corners=1)  # -> flatten(Curve)
boundary_surfaces = BoundarySurfaces(Edges=offset_curve)  # -> flatten(Surfaces)
move = Move(Geometry=boundary_surfaces, Motion="0,0,0.05")  # -> Geometry, Transform

# ----
geometry = ClusterOutput(move.Geometry)

# ==== cluster RF_FLAT
surface = ClusterInput()

# ---- group: Flat Roof
surface_2 = Surface(flatten(surface))
move = Move(Geometry=surface_2, Motion="0,0,0.01")  # -> Geometry, Transform

# ----
geometry = ClusterOutput(move.Geometry)

# ==== cluster CleanCorners
divide_distance = ClusterInput()
gate = ClusterInput()
stream = ClusterInput()
count = ClusterInput()
stream_gate = StreamGate(Stream=stream, Gate=gate)  # -> Target0, Target1
plane = ClusterInput()
radius = ClusterInput()
divide_distance_2 = DivideDistance(Curve=stream_gate.Target1, Distance=divide_distance)  # -> Points, Tangents, Parameters

# ---- group: No corners
divide_curve = DivideCurve(Curve=stream_gate.Target0, Count=count, Kinks=False)  # -> Points, Tangents, Parameters
circle = Circle(Plane=plane, Radius=radius)
point_in_curves = PointInCurves(Point=[divide_curve.Points, divide_distance_2.Points], Curves=circle)  # -> Relationship, Index, Point
integer = Integer("2")
member_index = MemberIndex(Set=point_in_curves.Relationship, Member=integer)  # -> Index, Count

# ----
points = ClusterOutput([divide_curve.Points, divide_distance_2.Points])
tangents = ClusterOutput([divide_curve.Tangents, divide_distance_2.Tangents])
parameters = ClusterOutput([divide_curve.Parameters, divide_distance_2.Parameters])
index = ClusterOutput(member_index.Index)

# ==== cluster SideWalk
curve = ClusterInput()
distance = ClusterInput()
factor = ClusterInput()
edges = ClusterInput()

# ---- group: Sidewalk
offset_curve = OffsetCurve(Curve=curve, Distance=distance, Corners=1)
unit_z = UnitZ(Factor=factor)
fillet = Fillet(Curve=offset_curve, Radius="5")
boundary_surfaces = BoundarySurfaces(Edges=flatten([fillet, edges]))
extrude = Extrude(Base=boundary_surfaces, Direction=unit_z)

# ----
extrusion = ClusterOutput(extrude)

# ==== cluster GableRoof2
buildingfootprint = ClusterInput()
curve = ClusterInput()
distance = ClusterInput()
roofverticalheight = ClusterInput()
curve_2 = Curve(buildingfootprint)
offset_curve = OffsetCurve(Curve=curve, Distance=expr("-x", distance), Corners=1)
trim_with_region = TrimWithRegion(Curve=offset_curve, Region=curve_2)  # -> flatten(Inside), Outside
motion = ClusterInput()
factor = ClusterInput()
unit_z = UnitZ(Factor=roofverticalheight)
move = Move(Geometry=trim_with_region.Inside, Motion=motion)  # -> Geometry, Transform
unit_z_2 = UnitZ(Factor=factor)
geometry = ClusterInput()
motion_2 = ClusterInput()
move_2 = Move(Geometry=geometry, Motion=motion_2)  # -> Geometry, Transform
move_3 = Move(Geometry=move_2.Geometry, Motion=unit_z)  # -> Geometry, Transform
move_4 = Move(Geometry=move.Geometry, Motion=unit_z_2)  # -> Geometry, Transform
move_5 = Move(Geometry=move_4.Geometry, Motion=unit_z)  # -> Geometry, Transform
end_points = EndPoints(Curve=move_3.Geometry)  # -> Start, End
end_points_2 = EndPoints(Curve=move_2.Geometry)  # -> Start, End
end_points_3 = EndPoints(Curve=move_5.Geometry)  # -> Start, End
point = Point(end_points_2.Start)
point_2 = Point(end_points.Start)
point_3 = Point(end_points.End)
point_4 = Point(end_points_2.End)
point_5 = Point(end_points_3.Start)
entwine = Entwine(Branch00=point, Branch01=point_2, Branch02=point_5, Branch03=point_3, Branch04=point_4, FlattenInputs=True)
flip_matrix = FlipMatrix(Data=entwine)
polyline = PolyLine(Vertices=flip_matrix, Closed=invert(False))
sweep1 = Sweep1(Rail=graft(move_5.Geometry), Sections=polyline, Miter=Slider(1, range=0..2))
cap_holes = CapHoles(Brep=sweep1)
brep = ClusterOutput(cap_holes)

# ==== cluster Cluster
C = ClusterInput()
explode = Explode(Curve=C, Recursive=True)  # -> Segments, Vertices
shift = ShiftList(List=explode.Segments, Shift=1, Wrap=True)
entwine = Entwine(Branch00=explode.Segments, Branch01=shift, FlattenInputs=True)
shift_2 = ShiftList(List=explode.Vertices, Shift=1, Wrap=False)
flip = FlipMatrix(Data=entwine)
item = ListItem(List=flip, Index=0, Wrap=True)  # -> Item, Item1
L = ClusterOutput(shift_2)
angle = Angle(VectorA=item.Item, VectorB=item.Item1)  # -> flatten(Angle), Reflex
second_number = ClusterInput()
deg = Degrees(Radians=angle.Angle)
subtraction = Subtraction(A="180", B=deg)
subtraction_2 = Subtraction(A=subtraction, B="90")
absolute = Absolute(Value=subtraction_2)
larger_than = LargerThan(FirstNumber=absolute, SecondNumber=second_number)  # -> LargerThan, OrEqualTo
larger_than_2 = ClusterOutput(larger_than.LargerThan)
panel = Panel(subtraction)
