# Grasshopper definition 20211127_CurveTest.gh (Grasshopper 1.0.7)
# Copyright: SS
# plug-ins: Human, Pufferfish

curve = Curve(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)
curve_2 = Curve(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)
curve_3 = Curve(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)
custom_preview_lineweights = CustomPreviewLineweights(Geometry=[curve, curve_2, curve_3], Shader=ColourSwatch(SwatchColor=RGB(0, 0, 0)), Thickness="5", Absolute=False)
number_slider = Slider(110, range=0..1000)
number_slider_2 = Slider(50, range=0..100)
is_curve_kinky = IsCurveKinky()  # -> Kinked, Amount, Lengths
curvature_graph = CurvatureGraph(Curve=curve, Density=Slider(50, range=0..100), Scale=number_slider)
curvature_graph_2 = CurvatureGraph(Curve=curve_3, Density=number_slider_2, Scale=Slider(115, range=0..1000))
curvature_graph_3 = CurvatureGraph(Curve=curve_2, Density=number_slider_2, Scale=number_slider)
curve_statistics = CurveStatistics(Curve=curve_3)  # -> ControlPointCount, EditPointCount, KinkPointCount, SegmentCount, SpanCount, KnotVectorCount
curve_statistics_2 = CurveStatistics(Curve=curve)  # -> ControlPointCount, EditPointCount, KinkPointCount, SegmentCount, SpanCount, KnotVectorCount
curve_statistics_3 = CurveStatistics(Curve=curve_2)  # -> ControlPointCount, EditPointCount, KinkPointCount, SegmentCount, SpanCount, KnotVectorCount
curve_degree = CurveDegree(Curve=curve)
curve_degree_2 = CurveDegree(Curve=curve_2)
curve_degree_3 = CurveDegree(Curve=curve_3)
