# Grasshopper definition 20211130_Parking.gh (Grasshopper 1.0.7)
# Copyright: SS
# plug-ins: EdiTree, Pufferfish, Human

galapagos = Galapagos(fitness=number, gene=[walkway_depth, road_width, parking_width, parking_depth, select_direction, innerparking_angle])
walkway_depth = Slider(2, range=1..3)
innerparking_angle = Slider(31, range=-45..45)
parking_depth = Slider(5, range=4..6)
parking_width = Slider(2.5, range=2.4..3.5)
road_width = Slider(4, range=3.5..8)
select_direction = Slider(3, range=0..10)
pavement_height = Slider(0.3, range=0..1)
streetlamp_distance = Slider(10, range=4..10)
streetlap_height = Slider(4, range=4..12)
geometry_pipeline = GeometryPipeline(
    GroupByLayer=False,
    GroupByType=False,
    IncludeHidden=True,
    IncludeLocked=True,
    LayerFilter="PARKING",
    NameFilter="*",
    SublayerFiltering=True,
    TypeFilter=4)
rectangle = Rectangle(Plane=PlaneXY(0, 0, 0), XSize=Domain(-1, 1), YSize=Domain(-2, 2), Radius=0)  # -> Rectangle, Length
flip_curve = FlipCurve(Curve=geometry_pipeline, Guide=rectangle.Rectangle)  # -> Curve, Flag
offset_curve = OffsetCurve(Curve=flip_curve.Curve, Distance=expr("-x", parking_depth), Corners=1)
explode = Explode(Curve=flip_curve.Curve, Recursive=True)  # -> Segments, Vertices
explode_2 = Explode(Curve=offset_curve, Recursive=True)  # -> Segments, Vertices
offset_curve_2 = OffsetCurve(Curve=offset_curve, Distance=expr("-x/2", road_width), Corners=1)
offset_curve_3 = OffsetCurve(Curve=offset_curve, Distance=expr("-x", road_width), Corners=1)
unit_z = UnitZ(Factor=1)

divide_distance = DivideDistance(Curve=explode_2.Segments, Distance=parking_width)  # -> Points, Tangents, Parameters
curve_closest_point = CurveClosestPoint(Point=divide_distance.Points, Curve=graft(explode.Segments))  # -> Point, Parameter, Distance
cross_product = CrossProduct(VectorA=divide_distance.Tangents, VectorB=unit_z, Unitize=invert(False))  # -> Vector, Length
line = Line(StartPoint=curve_closest_point.Point, EndPoint=divide_distance.Points)  # -> simplify(Line)
line_sdl = LineSDL(Start=divide_distance.Points, Direction=cross_product.Vector, Length=expr("X+0.5", parking_depth))  # -> simplify(Line)

fillet = Fillet(Curve=offset_curve_2, Radius=Slider(3, range=0..10))

list_item = ListItem(List=line, Index=0, Wrap=True)
list_item_2 = ListItem(List=line, Index="-1", Wrap=True)
loft = Loft(
    Curves=[list_item, list_item_2],
    Options={Adjust=False, Closed=False, LoftEnds=0, LoftSimp=0, LoftType=0, Rebuild=10, Refit=0.01})  # -> flatten(Loft)
region_difference = RegionDifference(CurvesA=flip_curve.Curve, CurvesB=offset_curve)
boundary_surfaces = BoundarySurfaces(Edges=region_difference)
surface_split = SurfaceSplit(Surface=boundary_surfaces, Curves=loft)
area = Area(Geometry=surface_split)  # -> Area, Centroid
area_2 = Area(Geometry=loft)  # -> Area, Centroid
member_index = MemberIndex(Set=area.Area, Member=area_2.Area)  # -> flatten(Index), Count
cull_index = CullIndex(List=surface_split, Indices=member_index.Index, Wrap=True)

unit_z_2 = UnitZ(Factor=1)
unit_z_3 = UnitZ(Factor=streetlap_height)

radians = Radians(Degrees=innerparking_angle)

absolute = Absolute(Value=radians)

triangle_trigonometry = TriangleTrigonometry(Alpha=absolute, Beta="pi/2", BLength=parking_depth)  # -> Alpha, Beta, Gamma, ALength, BLength, CLength
null_item = NullItem(Item=triangle_trigonometry.CLength)  # -> NullFlags, InvalidFlags, Description
stream_filter = StreamFilter(Gate=null_item.NullFlags, Stream0=triangle_trigonometry.CLength, Stream1=parking_depth)

explode_3 = Explode(Curve=offset_curve_3, Recursive=True)  # -> Segments, Vertices
list_item_3 = ListItem(List=explode_3.Segments, Index=select_direction, Wrap=True)
evaluate_curve = EvaluateCurve(Curve=reparameterize(list_item_3), Parameter="0.5")  # -> Point, Tangent, Angle
unit_z_4 = UnitZ(Factor=1)
end_points = EndPoints(Curve=list_item_3)  # -> Start, End
expression = Expression(pD=stream_filter, rW=road_width, wW=walkway_depth, Expression="(2*pD)+rW+wW")
construct_plane = ConstructPlane(Origin=end_points.Start, XAxis=unit_z_4, YAxis=evaluate_curve.Tangent)
division = Division(A=road_width, B="2")
division_2 = Division(A=walkway_depth, B="2")
merge = Merge(Data1="0", Data2=stream_filter, Data3=division_2, Data4=division_2, Data5=stream_filter, Data6=division, Data7=division)
duplicate_data = DuplicateData(Data=merge, Number="100", Order=True)
mass_addition = MassAddition(Input=duplicate_data)  # -> Result, PartialResults
contour_ex = ContourEx(Shape=offset_curve_3, Plane=construct_plane, Offsets=mass_addition.PartialResults, Distances=expression)  # -> flatten(Contours)

partition_list_adv = PartitionListAdv(List=contour_ex, Size="7")  # -> Chunk, Remainder
list_item_4 = ListItem(List=partition_list_adv.Remainder, Index=0, Wrap=invert(True))  # -> Item, Item1, Item2, Item3, Item4, Item5, Item6
list_item_5 = ListItem(List=partition_list_adv.Chunk, Index=0, Wrap=True)  # -> Item, Item1, Item2, Item3, Item4, Item5, Item6
curve = Curve([list_item_5.Item, list_item_4.Item])
curve_2 = Curve([list_item_5.Item1, list_item_4.Item1])
curve_3 = Curve([list_item_5.Item3, list_item_4.Item3])
curve_4 = Curve([list_item_5.Item4, list_item_4.Item4])
curve_5 = Curve([list_item_5.Item6, list_item_4.Item6])
curve_6 = Curve([list_item_5.Item2, list_item_4.Item2])
curve_7 = Curve([list_item_5.Item5, list_item_4.Item5])

divide_distance_2 = DivideDistance(Curve=curve_3, Distance=parking_width)  # -> Points, Tangents, Parameters
divide_distance_3 = DivideDistance(Curve=curve_2, Distance=parking_width)  # -> Points, Tangents, Parameters
negative = Negative(Value=innerparking_angle)
radians_2 = Radians(Degrees=negative)
cross_product_2 = CrossProduct(VectorA=unit_z, VectorB=divide_distance_2.Tangents, Unitize=invert(False))  # -> Vector, Length
cross_product_3 = CrossProduct(VectorA=divide_distance_3.Tangents, VectorB=unit_z, Unitize=invert(False))  # -> Vector, Length
rotate = Rotate(Vector=cross_product_2.Vector, Axis=unit_z_2, Angle=radians_2)
rotate_2 = Rotate(Vector=cross_product_3.Vector, Axis=unit_z_2, Angle=radians)
line_sdl_2 = LineSDL(Start=divide_distance_3.Points, Direction=rotate_2, Length=parking_depth)
line_sdl_3 = LineSDL(Start=divide_distance_2.Points, Direction=rotate, Length=parking_depth)
end_points_2 = EndPoints(Curve=line_sdl_2)  # -> Start, End
end_points_3 = EndPoints(Curve=line_sdl_3)  # -> Start, End
point_in_curve = PointInCurve(Point=end_points_2.End, Curve=offset_curve_3)  # -> Relationship, Point
point_in_curve_2 = PointInCurve(Point=end_points_3.End, Curve=offset_curve_3)  # -> Relationship, Point
integer = Integer(0)
member_index_2 = MemberIndex(Set=point_in_curve.Relationship, Member=integer)  # -> Index, Count
member_index_3 = MemberIndex(Set=point_in_curve_2.Relationship, Member=integer)  # -> Index, Count
cull_index_2 = CullIndex(List=line_sdl_2, Indices=member_index_2.Index, Wrap=True)  # -> simplify(List)
cull_index_3 = CullIndex(List=line_sdl_3, Indices=member_index_3.Index, Wrap=True)  # -> simplify(List)

# ---- group: LampPost
divide_distance_4 = DivideDistance(Curve=curve_6, Distance=streetlamp_distance)  # -> Points, Tangents, Parameters
unit_z_footpath = UnitZ(Factor=pavement_height)
line_sdl_4 = LineSDL(Start=divide_distance_4.Points, Direction=unit_z_footpath, Length=streetlap_height)
move = Move(Geometry=divide_distance_4.Points, Motion=unit_z_3)  # -> Geometry, Transform
sphere = Sphere(Base="0,0,0", Radius=Slider(0.2, range=0..1))
move_to_point = MoveToPoint(Geometry=sphere, PointA="0,0,0", PointB=move.Geometry)  # -> Moved, Vector, Transform

# ----
curve_8 = Curve(curve_7)
dash_pattern = DashPattern(Curve=flatten([fillet, curve_8]), Pattern="2")  # -> Dashes, Gaps

end_points_4 = EndPoints(Curve=cull_index_2)  # -> Start, End
end_points_5 = EndPoints(Curve=cull_index_3)  # -> Start, End
end_points_6 = EndPoints(Curve=line)  # -> Start, End
shift_list = ShiftList(List=end_points_4.End, Shift=1, Wrap=True)
shift_list_2 = ShiftList(List=end_points_5.End, Shift=1, Wrap=True)
shift_list_3 = ShiftList(List=end_points_6.End, Shift=1, Wrap=True)
line_2 = Line(StartPoint=end_points_4.Start, EndPoint=shift_list)
line_3 = Line(StartPoint=end_points_5.Start, EndPoint=shift_list_2)
line_4 = Line(StartPoint=end_points_6.Start, EndPoint=shift_list_3)
cull_index_4 = CullIndex(List=line_2, Indices="-1", Wrap=True)
cull_index_5 = CullIndex(List=line_3, Indices="-1", Wrap=True)
cull_index_6 = CullIndex(List=line_4, Indices="-1", Wrap=True)
curve_middle = CurveMiddle(Curve=flatten([cull_index_4, cull_index_5, cull_index_6]))
list_length = ListLength(List=curve_middle)
number = Number(list_length)
series = Series(Start="1", Step="1", Count=list_length)

total_parking_spaces = Panel(list_length)

list_item_6 = ListItem(List=cull_index_2, Index=0, Wrap=True)  # -> Item1, Item
list_item_7 = ListItem(List=cull_index_3, Index=0, Wrap=True)  # -> Item1, Item
end_points_7 = EndPoints(Curve=list_item_7.Item1)  # -> Start, End
end_points_8 = EndPoints(Curve=list_item_7.Item)  # -> Start, End
end_points_9 = EndPoints(Curve=curve_2)  # -> Start, End
end_points_10 = EndPoints(Curve=curve_3)  # -> Start, End
end_points_11 = EndPoints(Curve=curve)  # -> Start, End
end_points_12 = EndPoints(Curve=curve_4)  # -> Start, End
end_points_13 = EndPoints(Curve=list_item_6.Item1)  # -> Start, End
end_points_14 = EndPoints(Curve=list_item_6.Item)  # -> Start, End
point = Point(end_points_12.End)
point_2 = Point(end_points_7.Start)
point_3 = Point(end_points_7.End)
point_4 = Point(end_points_10.Start)
point_5 = Point(end_points_8.Start)
point_6 = Point(end_points_8.End)
point_7 = Point(end_points_11.End)
point_8 = Point(end_points_13.End)
point_9 = Point(end_points_9.Start)
point_10 = Point(end_points_14.Start)
point_11 = Point(end_points_14.End)
point_12 = Point(end_points_10.End)
point_13 = Point(end_points_12.Start)
point_14 = Point(end_points_9.End)
point_15 = Point(end_points_13.Start)
point_16 = Point(end_points_11.Start)
merge_2 = Merge(Data1=simplify(point), Data2=simplify(point_12), Data3=simplify(point_2), Data4=simplify(point_3))
merge_3 = Merge(Data1=simplify(point_13), Data2=simplify(point_4), Data3=simplify(point_5), Data4=simplify(point_6))
merge_4 = Merge(Data1=simplify(point_16), Data2=simplify(point_9), Data3=simplify(point_10), Data4=simplify(point_11))
merge_5 = Merge(Data1=simplify(point_7), Data2=simplify(point_14), Data3=simplify(point_15), Data4=simplify(point_8))
merge_6 = Merge(Data1=end_points_9.Start, Data2=end_points_10.Start, Data3=end_points_10.End, Data4=end_points_9.End)
polyline = PolyLine(Vertices=merge_2, Closed=invert(False))
polyline_2 = PolyLine(Vertices=merge_3, Closed=invert(False))
polyline_3 = PolyLine(Vertices=merge_4, Closed=invert(False))
polyline_4 = PolyLine(Vertices=merge_5, Closed=invert(False))
polyline_5 = PolyLine(Vertices=merge_6, Closed=invert(False))
extrude = Extrude(Base=[polyline, polyline_2, polyline_4, polyline_3, cull_index], Direction=unit_z_footpath)
extrude_2 = Extrude(Base=polyline_5, Direction=unit_z_footpath)
cap_holes = CapHoles(Brep=extrude)
cap_holes_2 = CapHoles(Brep=extrude_2)

number_slider = Slider(1, range=0..10)
colour_swatch = ColourSwatch(SwatchColor=RGB(255, 255, 255))
boundary_surfaces_2 = BoundarySurfaces(Edges=flip_curve.Curve)
custom_preview = CustomPreview(Geometry=boundary_surfaces_2, Material=ColourSwatch(SwatchColor=RGB(117, 117, 117)))
custom_preview_lineweights = CustomPreviewLineweights(Geometry=line_sdl_4, Shader=ColourSwatch(SwatchColor=RGB(0, 0, 0)), Thickness=Slider(3, range=0..10), Absolute=False)
custom_preview_2 = CustomPreview(Geometry=move_to_point.Moved, Material=ColourSwatch(SwatchColor=RGB(255, 221, 0)))
custom_preview_lineweights_2 = CustomPreviewLineweights(Geometry=dash_pattern.Dashes, Shader=colour_swatch, Thickness=number_slider, Absolute=False)
custom_preview_lineweights_3 = CustomPreviewLineweights(Geometry=[cull_index_2, cull_index_3, line], Shader=colour_swatch, Thickness=number_slider, Absolute=False)
custom_preview_3 = CustomPreview(Geometry=cap_holes, Material=ColourSwatch(SwatchColor=RGB(158, 158, 158)))
custom_preview_4 = CustomPreview(Geometry=cap_holes_2, Material=ColourSwatch(SwatchColor=RGB(176, 214, 133)))
text_tag = TextTag(Location=curve_middle, Text=series, Colour=ColourSwatch(SwatchColor=RGB(255, 255, 255)))
