# Grasshopper definition 20211201_Parking.gh (Grasshopper 1.0.7)
# Copyright: SS
# plug-ins: EdiTree, Pufferfish, Human, Sasquatch, TT Toolbox, MetaHopper

galapagos = Galapagos(fitness=number, gene=[walkway_depth, road_width, parking_width, parking_depth, select_direction, innerparking_angle])
walkway_depth = Slider(1, range=1..3)
innerparking_angle = Slider(0, range=-45..45)
parking_depth = Slider(5, range=4..6)
parking_width = Slider(2.5, range=2.4..3.5)
road_width = Slider(6, range=3.5..8)
pavement_height = Slider(0.3, range=0..1)
select_direction = Slider(6, range=0..10)
streetlamp_distance = Slider(10, range=4..10)
streetlap_height = Slider(4, range=4..12)
geometry_pipeline = GeometryPipeline(
    GroupByLayer=False,
    GroupByType=False,
    IncludeHidden=True,
    IncludeLocked=True,
    LayerFilter="PARKING",
    NameFilter="*",
    SublayerFiltering=True,
    TypeFilter=4)
flipdirection = BooleanToggle(False)

radians = Radians(Degrees=innerparking_angle)
absolute = Absolute(Value=radians)
triangle_trigonometry = TriangleTrigonometry(Alpha=absolute, Beta="pi/2", BLength=parking_depth)  # -> Alpha, Beta, Gamma, ALength, BLength, CLength
null_item = NullItem(Item=triangle_trigonometry.CLength)  # -> NullFlags, InvalidFlags, Description
stream_filter = StreamFilter(Gate=null_item.NullFlags, Stream0=triangle_trigonometry.CLength, Stream1=parking_depth)

rectangle = Rectangle(Plane=PlaneXY(0, 0, 0), XSize=Domain(-1, 1), YSize=Domain(-2, 2), Radius=0)  # -> Rectangle, Length
flip_curve = FlipCurve(Curve=geometry_pipeline, Guide=rectangle.Rectangle)  # -> Curve, Flag
offset_curve = OffsetCurve(Curve=flip_curve.Curve, Distance=expr("-x", parking_depth), Corners=1)
offset_curve_2 = OffsetCurve(Curve=offset_curve, Distance=expr("-x", road_width), Corners=1)
explode = Explode(Curve=flip_curve.Curve, Recursive=True)  # -> Segments, Vertices
explode_2 = Explode(Curve=offset_curve, Recursive=True)  # -> Segments, Vertices
offset_curve_3 = OffsetCurve(Curve=offset_curve, Distance=expr("-x/2", road_width), Corners=1)
unit_z = UnitZ(Factor=1)
fillet = Fillet(Curve=offset_curve_3, Radius=Slider(3, range=0..10))

explode_3 = Explode(Curve=offset_curve_2, Recursive=True)  # -> Segments, Vertices
list_item = ListItem(List=explode_3.Segments, Index=select_direction, Wrap=True)
evaluate_curve = EvaluateCurve(Curve=reparameterize(list_item), Parameter="0.5")  # -> Point, Tangent, Angle
unit_z_2 = UnitZ(Factor=1)
end_points = EndPoints(Curve=list_item)  # -> Start, End
expression = Expression(pD=stream_filter, rW=road_width, wW=walkway_depth, Expression="(2*pD)+rW+wW")
construct_plane = ConstructPlane(Origin=evaluate_curve.Point, XAxis=unit_z_2, YAxis=evaluate_curve.Tangent)
construct_plane_2 = ConstructPlane(Origin=evaluate_curve.Point, XAxis=evaluate_curve.Tangent, YAxis=unit_z_2)
stream_filter_2 = StreamFilter(Gate=flipdirection, Stream0=construct_plane, Stream1=construct_plane_2)
division = Division(A=road_width, B="2")
division_2 = Division(A=walkway_depth, B="2")
merge = Merge(Data1="0", Data2=stream_filter, Data3=division_2, Data4=division_2, Data5=stream_filter, Data6=division, Data7=division)
duplicate_data = DuplicateData(Data=merge, Number="50", Order=True)
mass_addition = MassAddition(Input=duplicate_data)  # -> Result, PartialResults
contour_ex = ContourEx(Shape=offset_curve_2, Plane=stream_filter_2, Offsets=mass_addition.PartialResults)  # -> flatten(Contours)

divide_distance = DivideDistance(Curve=explode_2.Segments, Distance=parking_width)  # -> Points, Tangents, Parameters
curve_closest_point = CurveClosestPoint(Point=divide_distance.Points, Curve=graft(explode.Segments))  # -> Point, Parameter, Distance
cross_product = CrossProduct(VectorA=divide_distance.Tangents, VectorB=unit_z, Unitize=invert(False))  # -> Vector, Length
line = Line(StartPoint=curve_closest_point.Point, EndPoint=divide_distance.Points)  # -> simplify(Line)
line_sdl = LineSDL(Start=divide_distance.Points, Direction=cross_product.Vector, Length=expr("X+0.5", parking_depth))  # -> simplify(Line)

# ---- group: Test for intersecting lines
collision_many_many = CollisionManyMany(Colliders=flatten(line))  # -> Collision, Indices
boolean = Boolean(True)
member_index = MemberIndex(Set=collision_many_many.Collision, Member=boolean)  # -> Index, Count
null_placeholder = NullPlaceholder()
replace_items = ReplaceItems(List=flatten(line), Item=null_placeholder, Indices=member_index.Index, Wrap=False)
unflatten_tree = UnflattenTree(Tree=replace_items, Guide=line)
null_item_2 = NullItem(Item=unflatten_tree)  # -> NullFlags, InvalidFlags, Description
cull_pattern = CullPattern(List=unflatten_tree, CullPattern=invert(null_item_2.NullFlags))

# ----
partition_list_adv = PartitionListAdv(List=contour_ex, Size="7")  # -> Chunk, Remainder
list_item_2 = ListItem(List=partition_list_adv.Remainder, Index=0, Wrap=invert(True))  # -> Item, Item1, Item2, Item3, Item4, Item5, Item6
list_item_3 = ListItem(List=partition_list_adv.Chunk, Index=0, Wrap=True)  # -> Item, Item1, Item2, Item3, Item4, Item5, Item6
curve = Curve([list_item_3.Item, list_item_2.Item])
curve_2 = Curve([list_item_3.Item1, list_item_2.Item1])
curve_3 = Curve([list_item_3.Item3, list_item_2.Item3])
curve_4 = Curve([list_item_3.Item4, list_item_2.Item4])
curve_5 = Curve([list_item_3.Item6, list_item_2.Item6])
curve_6 = Curve([list_item_3.Item2, list_item_2.Item2])
curve_7 = Curve([list_item_3.Item5, list_item_2.Item5])

unit_z_3 = UnitZ(Factor=1)

divide_distance_2 = DivideDistance(Curve=curve_3, Distance=parking_width)  # -> Points, Tangents, Parameters
divide_distance_3 = DivideDistance(Curve=curve_2, Distance=parking_width)  # -> Points, Tangents, Parameters
negative = Negative(Value=innerparking_angle)
radians_2 = Radians(Degrees=negative)
cross_product_2 = CrossProduct(VectorA=unit_z, VectorB=divide_distance_2.Tangents, Unitize=invert(False))  # -> Vector, Length
cross_product_3 = CrossProduct(VectorA=divide_distance_3.Tangents, VectorB=unit_z, Unitize=invert(False))  # -> Vector, Length
rotate = Rotate(Vector=cross_product_2.Vector, Axis=unit_z_3, Angle=radians_2)
rotate_2 = Rotate(Vector=cross_product_3.Vector, Axis=unit_z_3, Angle=radians)
line_sdl_2 = LineSDL(Start=divide_distance_3.Points, Direction=rotate_2, Length=parking_depth)
line_sdl_3 = LineSDL(Start=divide_distance_2.Points, Direction=rotate, Length=parking_depth)
end_points_2 = EndPoints(Curve=line_sdl_2)  # -> Start, End
end_points_3 = EndPoints(Curve=line_sdl_3)  # -> Start, End
point_in_curve = PointInCurve(Point=end_points_2.End, Curve=offset_curve_2)  # -> Relationship, Point
point_in_curve_2 = PointInCurve(Point=end_points_3.End, Curve=offset_curve_2)  # -> Relationship, Point
integer = Integer(0)
member_index_2 = MemberIndex(Set=point_in_curve.Relationship, Member=integer)  # -> Index, Count
member_index_3 = MemberIndex(Set=point_in_curve_2.Relationship, Member=integer)  # -> Index, Count
cull_index = CullIndex(List=line_sdl_2, Indices=member_index_2.Index, Wrap=True)  # -> simplify(List)
cull_index_2 = CullIndex(List=line_sdl_3, Indices=member_index_3.Index, Wrap=True)  # -> simplify(List)

list_item_4 = ListItem(List=cull_pattern, Index=0, Wrap=True)
list_item_5 = ListItem(List=cull_pattern, Index="-1", Wrap=True)
loft = Loft(
    Curves=[list_item_4, list_item_5],
    Options={Adjust=False, Closed=False, LoftEnds=0, LoftSimp=0, LoftType=0, Rebuild=10, Refit=0.01})  # -> flatten(Loft)
region_difference = RegionDifference(CurvesA=flip_curve.Curve, CurvesB=offset_curve)
boundary_surfaces = BoundarySurfaces(Edges=region_difference)
surface_split = SurfaceSplit(Surface=boundary_surfaces, Curves=loft)
area = Area(Geometry=surface_split)  # -> Area, Centroid
area_2 = Area(Geometry=loft)  # -> Area, Centroid
member_index_4 = MemberIndex(Set=area.Area, Member=area_2.Area)  # -> flatten(Index), Count
cull_index_3 = CullIndex(List=surface_split, Indices=member_index_4.Index, Wrap=True)

unit_z_4 = UnitZ(Factor=streetlap_height)

# ---- group: LampPost
divide_distance_4 = DivideDistance(Curve=curve_6, Distance=streetlamp_distance)  # -> Points, Tangents, Parameters
unit_z_footpath = UnitZ(Factor=pavement_height)
line_sdl_4 = LineSDL(Start=divide_distance_4.Points, Direction=unit_z_footpath, Length=streetlap_height)
move = Move(Geometry=divide_distance_4.Points, Motion=unit_z_4)  # -> Geometry, Transform
sphere = Sphere(Base="0,0,0", Radius=Slider(0.2, range=0..1))
move_to_point = MoveToPoint(Geometry=sphere, PointA="0,0,0", PointB=move.Geometry)  # -> Moved, Vector, Transform

# ----
curve_8 = Curve(curve_7)
dash_pattern = DashPattern(Curve=flatten([fillet, curve_8]), Pattern="2")  # -> Dashes, Gaps

list_item_6 = ListItem(List=cull_index, Index=0, Wrap=True)  # -> Item1, Item
list_item_7 = ListItem(List=cull_index_2, Index=0, Wrap=True)  # -> Item1, Item
end_points_4 = EndPoints(Curve=list_item_7.Item1)  # -> Start, End
end_points_5 = EndPoints(Curve=list_item_7.Item)  # -> Start, End
end_points_6 = EndPoints(Curve=curve_2)  # -> Start, End
end_points_7 = EndPoints(Curve=curve_3)  # -> Start, End
end_points_8 = EndPoints(Curve=curve)  # -> Start, End
end_points_9 = EndPoints(Curve=curve_4)  # -> Start, End
end_points_10 = EndPoints(Curve=list_item_6.Item1)  # -> Start, End
end_points_11 = EndPoints(Curve=list_item_6.Item)  # -> Start, End
point = Point(end_points_9.End)
point_2 = Point(end_points_7.End)
point_3 = Point(end_points_4.Start)
point_4 = Point(end_points_4.End)
point_5 = Point(end_points_9.Start)
point_6 = Point(end_points_7.Start)
point_7 = Point(end_points_5.Start)
point_8 = Point(end_points_5.End)
point_9 = Point(end_points_8.End)
point_10 = Point(end_points_6.End)
point_11 = Point(end_points_10.Start)
point_12 = Point(end_points_10.End)
point_13 = Point(end_points_8.Start)
point_14 = Point(end_points_6.Start)
point_15 = Point(end_points_11.Start)
point_16 = Point(end_points_11.End)
merge_2 = Merge(Data1=simplify(point), Data2=simplify(point_2), Data3=simplify(point_3), Data4=simplify(point_4))
merge_3 = Merge(Data1=simplify(point_5), Data2=simplify(point_6), Data3=simplify(point_7), Data4=simplify(point_8))
merge_4 = Merge(Data1=simplify(point_13), Data2=simplify(point_14), Data3=simplify(point_15), Data4=simplify(point_16))
merge_5 = Merge(Data1=simplify(point_9), Data2=simplify(point_10), Data3=simplify(point_11), Data4=simplify(point_12))
merge_6 = Merge(Data1=end_points_6.Start, Data2=end_points_7.Start, Data3=end_points_7.End, Data4=end_points_6.End)
polyline = PolyLine(Vertices=merge_2, Closed=invert(False))
polyline_2 = PolyLine(Vertices=merge_3, Closed=invert(False))
polyline_3 = PolyLine(Vertices=merge_4, Closed=invert(False))
polyline_4 = PolyLine(Vertices=merge_5, Closed=invert(False))
polyline_5 = PolyLine(Vertices=merge_6, Closed=invert(False))
extrude = Extrude(Base=[polyline, polyline_2, polyline_4, polyline_3, cull_index_3], Direction=unit_z_footpath)
extrude_2 = Extrude(Base=polyline_5, Direction=unit_z_footpath)
cap_holes = CapHoles(Brep=extrude)
cap_holes_2 = CapHoles(Brep=extrude_2)

end_points_12 = EndPoints(Curve=cull_index)  # -> Start, End
end_points_13 = EndPoints(Curve=cull_index_2)  # -> Start, End
end_points_14 = EndPoints(Curve=cull_pattern)  # -> Start, End
shift_list = ShiftList(List=end_points_12.End, Shift=1, Wrap=True)
shift_list_2 = ShiftList(List=end_points_13.End, Shift=1, Wrap=True)
shift_list_3 = ShiftList(List=end_points_14.End, Shift=1, Wrap=True)
line_2 = Line(StartPoint=end_points_12.Start, EndPoint=shift_list)
line_3 = Line(StartPoint=end_points_13.Start, EndPoint=shift_list_2)
line_4 = Line(StartPoint=end_points_14.Start, EndPoint=shift_list_3)
cull_index_4 = CullIndex(List=line_2, Indices="-1", Wrap=True)
cull_index_5 = CullIndex(List=line_3, Indices="-1", Wrap=True)
cull_index_6 = CullIndex(List=line_4, Indices="-1", Wrap=True)
curve_middle = CurveMiddle(Curve=flatten([cull_index_4, cull_index_5, cull_index_6]))
list_length = ListLength(List=curve_middle)
number = Number(list_length)
series = Series(Start="1", Step="1", Count=list_length)

total_parking_spaces = Panel(list_length)
enable_disable_object = EnableDisableObject(
    Enabled=Toggle(True),
    AllObjects_Object=[custom_preview_5, colour_swatch_15, custom_preview_4, colour_swatch_14, custom_preview_lineweights, colour_swatch_11, number_slider_5, custom_preview_3, colour_swatch_12, colour_swatch_13, boundary_surfaces_3, custom_preview_2, colour_swatch_10, custom_preview_lineweights_2, number_slider_4, custom_preview_lineweights_3, text_tag, colour_swatch_9])
number_slider = Slider(1, range=0..10)  # disabled
number_slider_2 = Slider(3, range=0..10)  # disabled
colour_swatch = ColourSwatch(SwatchColor=RGB(255, 255, 255))  # disabled
colour_swatch_2 = ColourSwatch(SwatchColor=RGB(117, 117, 117))  # disabled
colour_swatch_3 = ColourSwatch(SwatchColor=RGB(0, 0, 0))  # disabled
colour_swatch_4 = ColourSwatch(SwatchColor=RGB(255, 221, 0))  # disabled
colour_swatch_5 = ColourSwatch(SwatchColor=RGB(255, 255, 255))  # disabled
colour_swatch_6 = ColourSwatch(SwatchColor=RGB(158, 158, 158))  # disabled
colour_swatch_7 = ColourSwatch(SwatchColor=RGB(176, 214, 133))  # disabled
boundary_surfaces_2 = BoundarySurfaces(Edges=flip_curve.Curve)  # disabled
custom_preview = CustomPreview(Geometry=boundary_surfaces_2, Material=colour_swatch_2)  # disabled
enable_disable_object_2 = EnableDisableObject(
    Enabled=Toggle(False),
    AllObjects_Object=[custom_preview_8, colour_swatch_7, custom_preview_7, colour_swatch_6, custom_preview_lineweights_6, colour_swatch_3, number_slider_2, custom_preview_6, colour_swatch_4, colour_swatch_5, boundary_surfaces_2, custom_preview, colour_swatch_2, custom_preview_lineweights_7, number_slider, custom_preview_lineweights_5, text_tag_2, colour_swatch])

bounding_rectangle = BoundingRectangle(Geometry=offset_curve_2, Plane=PlaneXY(0, 0, 0), Axis=0, Slide=0, Union=True)  # -> Bounding, DimensionX, DimensionY
cross_product_4 = CrossProduct(VectorA=unit_z_2, VectorB=evaluate_curve.Tangent, Unitize=invert(False))  # -> Vector, Length
cross_product_5 = CrossProduct(VectorA=evaluate_curve.Tangent, VectorB=unit_z_2, Unitize=invert(False))  # -> Vector, Length
area_3 = Area(Geometry=bounding_rectangle.Bounding)  # -> Area, Centroid
stream_filter_3 = StreamFilter(Gate=flipdirection, Stream0=cross_product_4.Vector, Stream1=cross_product_5.Vector)
scale = Scale(Geometry=bounding_rectangle.Bounding, Center=area_3.Centroid, Factor=Slider(2, range=0..10))  # -> Geometry, Transform

number_slider_3 = Slider(5, range=0..10)
number_slider_4 = Slider(1, range=0..10)
number_slider_5 = Slider(3, range=0..10)
colour_swatch_8 = ColourSwatch(SwatchColor=RGB(255, 0, 0))
colour_swatch_9 = ColourSwatch(SwatchColor=RGB(255, 255, 255))
colour_swatch_10 = ColourSwatch(SwatchColor=RGB(117, 117, 117))
colour_swatch_11 = ColourSwatch(SwatchColor=RGB(0, 0, 0))
colour_swatch_12 = ColourSwatch(SwatchColor=RGB(255, 221, 0))
colour_swatch_13 = ColourSwatch(SwatchColor=RGB(255, 255, 255))
colour_swatch_14 = ColourSwatch(SwatchColor=RGB(158, 158, 158))
colour_swatch_15 = ColourSwatch(SwatchColor=RGB(176, 214, 133))
boundary_surfaces_3 = BoundarySurfaces(Edges=flip_curve.Curve)
custom_preview_2 = CustomPreview(Geometry=boundary_surfaces_3, Material=colour_swatch_10)
custom_preview_lineweights = CustomPreviewLineweights(Geometry=line_sdl_4, Shader=colour_swatch_11, Thickness=number_slider_5, Absolute=False)
custom_preview_3 = CustomPreview(Geometry=move_to_point.Moved, Material=colour_swatch_12)
custom_preview_lineweights_2 = CustomPreviewLineweights(Geometry=dash_pattern.Dashes, Shader=colour_swatch_13, Thickness=number_slider_4, Absolute=False)
custom_preview_lineweights_3 = CustomPreviewLineweights(Geometry=[cull_index, cull_index_2, cull_pattern], Shader=colour_swatch_13, Thickness=number_slider_4, Absolute=False)
custom_preview_4 = CustomPreview(Geometry=cap_holes, Material=colour_swatch_14)
custom_preview_5 = CustomPreview(Geometry=cap_holes_2, Material=colour_swatch_15)
custom_preview_lineweights_4 = CustomPreviewLineweights(Geometry=list_item, Shader=colour_swatch_8, Thickness=number_slider_3, Absolute=False)
vector_display_ex = VectorDisplayEx(Point=evaluate_curve.Point, Vector=expr("x*10", stream_filter_3), Colour=colour_swatch_8, Width=number_slider_3)
text_tag = TextTag(Location=curve_middle, Text=series, Colour=colour_swatch_9)

merge_7 = Merge(Data1=division_2, Data2=stream_filter, Data3=division)
mass_addition_2 = MassAddition(Input=merge_7)  # -> Result, PartialResults
subtraction = Subtraction(A=mass_addition_2.Result, B=division_2)
negative_2 = Negative(Value=subtraction)
unit_x = UnitX(Factor=1)
point_17 = Point(Point(0, 0, 0))
line_sdl_5 = LineSDL(Start=point_17, Direction=unit_x, Length=1)
multiplication = Multiplication(A=division_2, B=stream_filter_3)
negative_3 = Negative(Value=multiplication)

contour = Contour(Shape=scale.Geometry, Point=evaluate_curve.Point, Direction=stream_filter_3, Distance=expr("x*2", subtraction))  # -> flatten(Contours)

trim_with_region = TrimWithRegion(Curve=contour, Region=offset_curve_2)  # -> Inside, Outside
dash_pattern_2 = DashPattern(Curve=trim_with_region.Inside, Pattern="2")  # -> Dashes, Gaps

custom_preview_lineweights_5 = CustomPreviewLineweights(Geometry=dash_pattern_2.Dashes, Shader=colour_swatch_5, Thickness=number_slider, Absolute=False)  # disabled

offset_curve_4 = OffsetCurve(Curve=graft(contour), Distance=flatten([subtraction, negative_2]), Corners=1)
flip_curve_2 = FlipCurve(Curve=offset_curve_4, Guide=line_sdl_5)  # -> Curve, Flag
trim_with_region_2 = TrimWithRegion(Curve=flip_curve_2.Curve, Region=offset_curve_2)  # -> simplify(Inside), Outside
trim_with_region_3 = TrimWithRegion(Curve=flatten(flip_curve_2.Curve), Region=offset_curve_2)  # -> Inside, Outside
unflatten_tree_2 = UnflattenTree(Tree=flatten(trim_with_region_3.Inside), Guide=trim_with_region_2.Inside)
trim_tree = TrimTree(Tree=unflatten_tree_2, Depth=1)  # -> flatten(Tree)

remove_duplicate_lines = RemoveDuplicateLines(InputLines=flatten(trim_tree), Tolerance=0.001)  # -> OutputLines, FirstLineIndexes
null_item_3 = NullItem(Item=remove_duplicate_lines.OutputLines)  # -> NullFlags, InvalidFlags, Description
cull_pattern_2 = CullPattern(List=remove_duplicate_lines.OutputLines, CullPattern=invert(null_item_3.NullFlags))

move_2 = Move(Geometry=cull_pattern_2, Motion=negative_3)  # -> Geometry, Transform
move_3 = Move(Geometry=cull_pattern_2, Motion=multiplication)  # -> Geometry, Transform
null_item_4 = NullItem(Item=flatten(move_3.Geometry))  # -> NullFlags, InvalidFlags, Description
cull_pattern_3 = CullPattern(List=flatten(move_3.Geometry), CullPattern=invert(null_item_4.NullFlags))

divide_length = DivideLength(Curve=move_3.Geometry, Length=parking_width)  # -> Points, Tangents, Parameters
divide_length_2 = DivideLength(Curve=move_2.Geometry, Length=parking_width)  # -> Points, Tangents, Parameters
negative_4 = Negative(Value=innerparking_angle)
cross_product_6 = CrossProduct(VectorA=divide_length.Tangents, VectorB=unit_z, Unitize=invert(False))  # -> Vector, Length
cross_product_7 = CrossProduct(VectorA=unit_z, VectorB=divide_length.Tangents, Unitize=invert(False))  # -> Vector, Length
unit_z_5 = UnitZ(Factor=1)
unit_z_6 = UnitZ(Factor=1)
radians_3 = Radians(Degrees=innerparking_angle)
radians_4 = Radians(Degrees=negative_4)
rotate_3 = Rotate(Vector=cross_product_7.Vector, Axis=unit_z_6, Angle=radians_4)
rotate_4 = Rotate(Vector=cross_product_6.Vector, Axis=unit_z_5, Angle=radians_3)
line_sdl_6 = LineSDL(Start=divide_length_2.Points, Direction=rotate_3, Length=stream_filter)
line_sdl_7 = LineSDL(Start=divide_length.Points, Direction=rotate_4, Length=stream_filter)
end_points_15 = EndPoints(Curve=line_sdl_6)  # -> Start, End
end_points_16 = EndPoints(Curve=line_sdl_7)  # -> Start, End
point_in_curve_3 = PointInCurve(Point=end_points_15.End, Curve=offset_curve_2)  # -> Relationship, Point
point_in_curve_4 = PointInCurve(Point=end_points_16.End, Curve=offset_curve_2)  # -> Relationship, Point
integer_2 = Integer(2)
member_index_5 = MemberIndex(Set=point_in_curve_4.Relationship, Member=integer_2)  # -> Index, Count
member_index_6 = MemberIndex(Set=point_in_curve_3.Relationship, Member=integer_2)  # -> Index, Count
list_item_8 = ListItem(List=line_sdl_7, Index=member_index_5.Index, Wrap=True)
list_item_9 = ListItem(List=line_sdl_6, Index=member_index_6.Index, Wrap=True)
list_item_10 = ListItem(List=list_item_8, Index=0, Wrap=True)  # -> Item1, Item
list_item_11 = ListItem(List=list_item_9, Index=0, Wrap=True)  # -> Item1, Item
null_item_5 = NullItem(Item=flatten(list_item_10.Item1))  # -> NullFlags, InvalidFlags, Description
cull_pattern_4 = CullPattern(List=flatten(list_item_10.Item1), CullPattern=invert(null_item_5.NullFlags))
end_points_17 = EndPoints(Curve=list_item_10.Item1)  # -> Start, End
end_points_18 = EndPoints(Curve=list_item_11.Item1)  # -> Start, End

extrude_3 = Extrude(Base=flatten(cull_pattern_3), Direction=expr("x*2", negative_3))
unit_z_7 = UnitZ(Factor=pavement_height)
extrude_4 = Extrude(Base=extrude_3, Direction=unit_z_7)
cap_holes_3 = CapHoles(Brep=extrude_4)

divide_distance_5 = DivideDistance(Curve=cull_pattern_2, Distance=streetlamp_distance)  # -> Points, Tangents, Parameters
unit_z_footpath_2 = UnitZ(Factor=pavement_height)
unit_z_8 = UnitZ(Factor=streetlap_height)
line_sdl_8 = LineSDL(Start=divide_distance_5.Points, Direction=unit_z_footpath_2, Length=streetlap_height)
sphere_2 = Sphere(Base="0,0,0", Radius=Slider(0.2, range=0..1))
move_4 = Move(Geometry=divide_distance_5.Points, Motion=unit_z_8)  # -> Geometry, Transform
move_to_point_2 = MoveToPoint(Geometry=sphere_2, PointA="0,0,0", PointB=move_4.Geometry)  # -> Moved, Vector, Transform

curve_9 = Curve(flatten([list_item_10.Item1, list_item_10.Item, list_item_11.Item1, list_item_11.Item]))
null_item_6 = NullItem(Item=curve_9)  # -> NullFlags, InvalidFlags, Description
cull_pattern_5 = CullPattern(List=curve_9, CullPattern=invert(null_item_6.NullFlags))
curve_middle_2 = CurveMiddle(Curve=cull_pattern_5)
sort_along_curve = SortAlongCurve(Points=curve_middle_2, Curve=offset_curve_2)  # -> Points, Indices
cull_duplicates = CullDuplicates(Points=sort_along_curve.Points, Tolerance=0.1, CullMode=3)  # -> Points, Indices, Valence
member_index_7 = MemberIndex(Set=curve_middle_2, Member=cull_duplicates.Points)  # -> Index, Count
list_item_12 = ListItem(List=member_index_7.Index, Index=0, Wrap=True)  # -> flatten(Item)

line_sdl_9 = LineSDL(Start=end_points_17.Start, Direction=evaluate_curve.Tangent, Length=1)
line_sdl_10 = LineSDL(Start=end_points_17.End, Direction=evaluate_curve.Tangent, Length=1)
line_sdl_11 = LineSDL(Start=end_points_18.Start, Direction=evaluate_curve.Tangent, Length=1)
line_sdl_12 = LineSDL(Start=end_points_18.End, Direction=evaluate_curve.Tangent, Length=1)
curve_line = CurveLine(Curve=offset_curve_2, Line=line_sdl_9)  # -> Points, Params, Count
curve_line_2 = CurveLine(Curve=offset_curve_2, Line=line_sdl_10)  # -> Points, Params, Count
curve_line_3 = CurveLine(Curve=offset_curve_2, Line=line_sdl_11)  # -> Points, Params, Count
curve_line_4 = CurveLine(Curve=offset_curve_2, Line=line_sdl_12)  # -> Points, Params, Count

shatter = Shatter(
    Curve=offset_curve_2,
    Parameters=flatten([curve_line.Params, curve_line_2.Params, curve_line_3.Params, curve_line_4.Params]))
last_index = LastIndex(List=shatter)
series_2 = Series(Start=0, Step=1, Count=last_index)
odd_even_numbers = OddEvenNumbers(Numbers=series_2, Placeholders=False)  # -> Odd, Even
list_item_13 = ListItem(List=cull_pattern_5, Index=list_item_12, Wrap=True)  # -> simplify(flatten(Item))
list_item_14 = ListItem(List=shatter, Index=odd_even_numbers.Even, Wrap=True)  # -> simplify(flatten(Item))

end_points_19 = EndPoints(Curve=list_item_8)  # -> Start, End
end_points_20 = EndPoints(Curve=list_item_9)  # -> Start, End
end_points_21 = EndPoints(Curve=cull_pattern)  # -> Start, End
shift_list_4 = ShiftList(List=end_points_19.End, Shift=1, Wrap=True)
shift_list_5 = ShiftList(List=end_points_20.End, Shift=1, Wrap=True)
shift_list_6 = ShiftList(List=end_points_21.End, Shift=1, Wrap=True)
line_5 = Line(StartPoint=end_points_19.Start, EndPoint=shift_list_4)
line_6 = Line(StartPoint=end_points_20.Start, EndPoint=shift_list_5)
line_7 = Line(StartPoint=end_points_21.Start, EndPoint=shift_list_6)
cull_index_7 = CullIndex(List=line_5, Indices="-1", Wrap=True)
cull_index_8 = CullIndex(List=line_6, Indices="-1", Wrap=True)
cull_index_9 = CullIndex(List=line_7, Indices="-1", Wrap=True)
curve_middle_3 = CurveMiddle(Curve=flatten([cull_index_7, cull_index_8, cull_index_9]))
list_length_2 = ListLength(List=curve_middle_3)
series_3 = Series(Start="1", Step="1", Count=list_length_2)
number_2 = Number(list_length_2)

flip_curve_3 = FlipCurve(Curve=list_item_14, Guide=list_item_13)  # -> Curve, Flag
connect_curve_ends = ConnectCurveEnds(Curve1=flip_curve_3.Curve, Curve2=list_item_13, FlipEnds=False)
extrude_5 = Extrude(Base=flatten([connect_curve_ends, cull_index_3]), Direction=unit_z_7)
cap_holes_4 = CapHoles(Brep=extrude_5)

custom_preview_lineweights_6 = CustomPreviewLineweights(Geometry=line_sdl_8, Shader=colour_swatch_3, Thickness=number_slider_2, Absolute=False)  # disabled
custom_preview_6 = CustomPreview(Geometry=move_to_point_2.Moved, Material=colour_swatch_4)  # disabled
custom_preview_lineweights_7 = CustomPreviewLineweights(Geometry=[cull_pattern, list_item_8, list_item_9], Shader=colour_swatch_5, Thickness=number_slider, Absolute=False)  # disabled
custom_preview_7 = CustomPreview(Geometry=cap_holes_4, Material=colour_swatch_6)  # disabled
custom_preview_8 = CustomPreview(Geometry=cap_holes_3, Material=colour_swatch_7)  # disabled
text_tag_2 = TextTag(Location=curve_middle_3, Text=series_3, Colour=colour_swatch)  # disabled
