# Grasshopper definition 20211208_TownPlan_Optimised.gh (Grasshopper 1.0.7)
# Copyright: SS
# plug-ins: Human

geometry_pipeline = GeometryPipeline(
    GroupByLayer=False,
    GroupByType=False,
    IncludeHidden=True,
    IncludeLocked=True,
    LayerFilter="IN",
    NameFilter="*",
    SublayerFiltering=True,
    TypeFilter=4)
xy_plane = XYPlane(Origin=Point(0, 0, 0))

# ---- group: Customize House
house_x = Slider(10, range=0..10)
house_z = Slider(6, range=0..10)
house_y1 = Slider(10, range=0..100)
roof_z = Slider(3, range=0..10)
house_y2 = Slider(10, range=0..10)
house_x_2 = Slider(7, range=0..10)
house_z_2 = Slider(5, range=0..10)
house_y1_2 = Slider(10, range=0..100)
house_y2_2 = Slider(10, range=0..10)
roof_z_2 = Slider(3, range=0..10)
L = BooleanToggle(True)
L_2 = BooleanToggle(True)
make_house = MakeHouse(
    baseplane=xy_plane,
    house_x=house_x,
    house_z=house_z,
    roof_z=roof_z,
    house_y1=house_y1,
    house_y2=house_y2,
    l_shaped_house=L,
    rotate_building=Slider(0, range=0..100))  # -> geometry, point_2
make_house_2 = MakeHouse(
    baseplane=xy_plane,
    house_x=house_x_2,
    house_z=house_z_2,
    roof_z=roof_z_2,
    house_y1=house_y1_2,
    house_y2=house_y2_2,
    l_shaped_house=L_2,
    rotate_building=Slider(90, range=0..100))  # -> geometry, point_2
brep = Brep(make_house.geometry)
brep_2 = Brep(make_house_2.geometry)

# ----
recess = Slider(13, range=0..100)
parceldepth = Slider(40, range=0..100)
courtyard = ColourSwatch(SwatchColor=RGB(149, 178, 89))
buildings = ColourSwatch(SwatchColor=RGB(209, 207, 188))
sidewalk = ColourSwatch(SwatchColor=RGB(153, 153, 153))
street = ColourSwatch(SwatchColor=RGB(76, 76, 76))

# ---- group: Make Parcel Boundary
value_list = ValueList({"Left": 0, "Right": 1, "Both": 2}, selected="Left")
recess_2 = Slider(13, range=0..100)
parcelwidth = Slider(39, range=0..100)
parceldepth_2 = Slider(32, range=0..100)

# ----
entwine = Entwine(Branch00=make_house_2.point_2, Branch01=make_house.point_2, FlattenInputs=True)
stream_filter = StreamFilter(Gate=value_list, Stream0=make_house_2.point_2, Stream1=make_house.point_2, Stream2=entwine)

entwine_2 = Entwine(Branch00=brep_2, Branch01=brep, FlattenInputs=True)
stream_filter_2 = StreamFilter(Gate=value_list, Stream0=brep_2, Stream1=brep, Stream2=entwine_2)

# ---- group: Make Streets
lanewidth = Slider(3, range=0..10)
lanes = Slider(2, range=1..10)
sidewalkwidth = Slider(8, range=0..10)
repeat_data = RepeatData(Data=lanewidth, Length=lanes)
merge = Merge(Data1="0.5", Data2=flatten(repeat_data), Data3=flatten(sidewalkwidth))
mass_addition = MassAddition(Input=merge)  # -> Result, PartialResults
negative = Negative(Value=mass_addition.PartialResults)

# ---- group: Make Parcel Boundary (continued)
addition = Addition(A=mass_addition.Result, B=parceldepth_2)
addition_2 = Addition(A=mass_addition.Result, B=parceldepth)
negative_2 = Negative(Value=addition_2)
stream_filter_3 = StreamFilter(Gate=value_list, Stream0=addition, Stream1=negative_2, Stream2=[addition, negative_2])
offset_curve = OffsetCurve(Curve=geometry_pipeline, Distance=stream_filter_3, Corners=1)  # -> flatten(Curve)

# ---- group: Make Recess Line
addition_3 = Addition(A=mass_addition.Result, B=recess)
addition_4 = Addition(A=mass_addition.Result, B=recess_2)
negative_3 = Negative(Value=addition_4)
stream_filter_4 = StreamFilter(Gate=value_list, Stream0=addition_3, Stream1=negative_3, Stream2=[addition_3, negative_3])
offset_curve_2 = OffsetCurve(Curve=geometry_pipeline, Distance=stream_filter_4, Corners=1)  # -> flatten(Curve)

# ----
data = Data([mass_addition.PartialResults, negative])

# ---- group: Make Streets (continued)
offset_curve_3 = OffsetCurve(Curve=geometry_pipeline, Distance=data, Corners=1)  # -> flatten(Curve)

# ----
absolute = Absolute(Value=data)
list_item = ListItem(List=mass_addition.PartialResults, Index="-1", Wrap=True)
member_index = MemberIndex(Set=absolute, Member=list_item)  # -> Index, Count
list_item_2 = ListItem(List=offset_curve_3, Index=member_index.Index, Wrap=True)
list_item_3 = ListItem(List=list_item_2, Index=0, Wrap=True)  # -> Item, Item1
stream_filter_5 = StreamFilter(Gate=value_list, Stream0=list_item_3.Item, Stream1=list_item_3.Item1, Stream2=[list_item_3.Item, list_item_3.Item1])

# ---- group: SideWalk
panel = Panel("""-2
-1""")
end_points = EndPoints(Curve=offset_curve_3)  # -> Start, End
absolute_2 = Absolute(Value=data)
list_item_4 = ListItem(List=mass_addition.PartialResults, Index=panel, Wrap=True)
member_index_2 = MemberIndex(Set=absolute_2, Member=list_item_4)  # -> Index, Count
list_item_5 = ListItem(List=end_points.Start, Index=member_index_2.Index, Wrap=True)
list_item_6 = ListItem(List=flatten(list_item_5), Index=0, Wrap=True)  # -> Item, Item1, Item2, Item3
line = Line(StartPoint=[list_item_6.Item, list_item_6.Item1], EndPoint=[list_item_6.Item2, list_item_6.Item3])
sweep1 = Sweep1(Rail=geometry_pipeline, Sections=graft(line), Miter=1)

# ---- group: Middle
end_points_2 = EndPoints(Curve=offset_curve_3)  # -> Start, End
absolute_3 = Absolute(Value=data)
list_item_7 = ListItem(List=mass_addition.PartialResults, Index="0", Wrap=True)
member_index_3 = MemberIndex(Set=absolute_3, Member=list_item_7)  # -> Index, Count
list_item_8 = ListItem(List=end_points_2.Start, Index=member_index_3.Index, Wrap=True)
list_item_9 = ListItem(List=list_item_8, Index=0, Wrap=True)  # -> Item, Item1
line_2 = Line(StartPoint=list_item_9.Item, EndPoint=list_item_9.Item1)
sweep1_2 = Sweep1(Rail=geometry_pipeline, Sections=line_2, Miter=1)

# ----
list_item_10 = ListItem(List=offset_curve_2, Index=0, Wrap=True)  # -> Item, Item1
stream_filter_6 = StreamFilter(Gate=value_list, Stream0=list_item_10.Item, Stream1=list_item_10.Item1, Stream2=[list_item_10.Item, list_item_10.Item1])

divide_length = DivideLength(Curve=offset_curve, Length=parcelwidth)  # -> Points, Tangents, Parameters

end_points_3 = EndPoints(Curve=stream_filter_5)  # -> Start, End
end_points_4 = EndPoints(Curve=offset_curve)  # -> Start, End
line_3 = Line(StartPoint=end_points_3.Start, EndPoint=end_points_4.Start)
sweep1_3 = Sweep1(Rail=geometry_pipeline, Sections=graft(line_3), Miter=1)

panel_2 = Panel("""4
8""")
cull_index = CullIndex(List=offset_curve_3, Indices=flatten([member_index_2.Index, member_index_3.Index]), Wrap=True)
dash_pattern = DashPattern(Curve=cull_index, Pattern=panel_2)  # -> Dashes, Gaps

# ---- group: Road
line_4 = Line(StartPoint=[list_item_6.Item, list_item_9.Item1], EndPoint=[list_item_9.Item, list_item_6.Item1])
sweep1_4 = Sweep1(Rail=geometry_pipeline, Sections=graft(line_4), Miter=1)

# ----
unit_z = UnitZ(Factor="0.3")
extrude = Extrude(Base=[sweep1_2, sweep1], Direction=unit_z)
cap_holes = CapHoles(Brep=extrude)

curve_closest_point = CurveClosestPoint(Point=divide_length.Points, Curve=graft(stream_filter_5))  # -> Point, Parameter, Distance
line_5 = Line(StartPoint=curve_closest_point.Point, EndPoint=divide_length.Points)

curve_closest_point_2 = CurveClosestPoint(Point=simplify(divide_length.Points), Curve=simplify(graft(stream_filter_6)))  # -> Point, Parameter, Distance
shatter = Shatter(Curve=graft(stream_filter_6), Parameters=curve_closest_point_2.Parameter)

unit_x = UnitX(Factor=1)
horizontal_frame = HorizontalFrame(Curve=reparameterize(shatter), Parameter="0.5")
deconstruct_plane = DeconstructPlane(Plane=horizontal_frame)  # -> Origin, XAxis, YAxis, ZAxis
angle = Angle(VectorA=deconstruct_plane.YAxis, VectorB=unit_x)  # -> Angle, Reflex
pi = Pi(Factor=1)
vector_2pt = Vector2Pt(PointA=stream_filter, PointB=horizontal_frame, Unitize=False)  # -> Vector, Length
explode_tree = ExplodeTree(Data=angle.Angle)  # -> flatten(Branch0), flatten(Branch1)
addition_5 = Addition(A=explode_tree.Branch0, B=pi)
addition_6 = Addition(A=explode_tree.Branch1, B=pi)
entwine_3 = Entwine(Branch00=explode_tree.Branch0, Branch01=addition_6, FlattenInputs=True)
stream_filter_7 = StreamFilter(Gate=value_list, Stream0=explode_tree.Branch0, Stream1=addition_5, Stream2=entwine_3)

length = Length(Curve=shatter)
stream_filter_8 = StreamFilter(Gate=value_list, Stream0=parceldepth_2, Stream1=parceldepth, Stream2=[parceldepth_2, parceldepth])
multiplication = Multiplication(A=parcelwidth, B="0.7")
multiplication_2 = Multiplication(A=parcelwidth, B="0.7")
unit_z_2 = UnitZ(Factor=Slider(13, range=0..20))
curve_middle = CurveMiddle(Curve=shatter)
multiplication_3 = Multiplication(A=length, B=stream_filter_8)
round = Round(Number=multiplication_3)  # -> Nearest, Floor, Ceiling
entwine_4 = Entwine(Branch00=multiplication, Branch01=multiplication_2, FlattenInputs=True)
move = Move(Geometry=curve_middle, Motion=unit_z_2)  # -> Geometry, Transform
concatenate = Concatenate(Fragment_A="Plot Area ", Fragment_B=round.Nearest, A=" kvm")
stream_filter_9 = StreamFilter(Gate=value_list, Stream0=multiplication, Stream1=multiplication_2, Stream2=entwine_4)
smaller_than = SmallerThan(FirstNumber=length, SecondNumber=stream_filter_9)  # -> SmallerThan, OrEqualTo

cull_pattern = CullPattern(List=vector_2pt.Vector, CullPattern=invert(smaller_than.SmallerThan))
cull_pattern_2 = CullPattern(List=stream_filter_7, CullPattern=invert(smaller_than.SmallerThan))
cull_pattern_3 = CullPattern(List=horizontal_frame, CullPattern=invert(smaller_than.SmallerThan))
move_2 = Move(Geometry=stream_filter_2, Motion=cull_pattern)  # -> Geometry, Transform
rotate = Rotate(Geometry=move_2.Geometry, Angle=cull_pattern_2, Plane=cull_pattern_3)  # -> Geometry, Transform

custom_preview = CustomPreview(Geometry=cap_holes, Material=sidewalk)
custom_preview_2 = CustomPreview(Geometry=sweep1_4, Material=street)
custom_preview_3 = CustomPreview(Geometry=sweep1_3, Material=courtyard)
custom_preview_4 = CustomPreview(Geometry=rotate.Geometry, Material=buildings)
custom_preview_lineweights = CustomPreviewLineweights(Geometry=line_5, Shader="black", Thickness="1", Absolute=False)
custom_preview_lineweights_2 = CustomPreviewLineweights(Geometry=dash_pattern.Dashes, Shader="white", Thickness="3", Absolute=False)
text_tag = TextTag(Location=move.Geometry, Text=concatenate, Colour="black")

# ==== cluster MakeHouse
rotate_building = ClusterInput()
l_shaped_house = ClusterInput()
baseplane = ClusterInput()
house_x = ClusterInput()
house_z = ClusterInput()
roof_z = ClusterInput()
house_y1 = ClusterInput()
baseplane_2 = Plane(baseplane)
house_y2 = ClusterInput()
l_shaped_house_2 = Boolean(l_shaped_house)
house_x_2 = Number(house_x)
house_z_2 = Number(house_z)
roof_z_2 = Number(roof_z)
house_y1_2 = Number(house_y1)
house_y2_2 = Number(house_y2)
deconstruct_plane = DeconstructPlane(Plane=baseplane_2)  # -> Origin, XAxis, YAxis, ZAxis
rotate_building_2 = Number(rotate_building)
multiplication = Multiplication(A=deconstruct_plane.XAxis, B=house_x_2)
multiplication_2 = Multiplication(A=deconstruct_plane.ZAxis, B=house_z_2)
point = Point(Point(0, 0, 0))
addition = Addition(A=house_z_2, B=roof_z_2)
multiplication_3 = Multiplication(A=deconstruct_plane.ZAxis, B=addition)
multiplication_4 = Multiplication(A=deconstruct_plane.YAxis, B=house_y1_2)
multiplication_5 = Multiplication(A=deconstruct_plane.XAxis, B=house_y2_2)
null_item = NullItem(Item=rotate_building_2)  # -> NullFlags, InvalidFlags, Description
move = Move(Geometry=point, Motion=multiplication)  # -> Geometry, Transform
move_2 = Move(Geometry=point, Motion=expr("x/2", multiplication))  # -> Geometry, Transform
move_3 = Move(Geometry=move.Geometry, Motion=multiplication_2)  # -> Geometry, Transform
move_4 = Move(Geometry=point, Motion=multiplication_2)  # -> Geometry, Transform
move_5 = Move(Geometry=move_2.Geometry, Motion=multiplication_4)  # -> Geometry, Transform
move_6 = Move(Geometry=move_5.Geometry, Motion=multiplication_5)  # -> Geometry, Transform
move_7 = Move(Geometry=move_2.Geometry, Motion=multiplication_3)  # -> Geometry, Transform
stream_filter = StreamFilter(Gate=null_item.InvalidFlags, Stream0=rotate_building_2, Stream1=Slider(0, range=0..100))
stream_filter_2 = StreamFilter(Gate=l_shaped_house_2, Stream1=move_6.Geometry)
radians = Radians(Degrees=stream_filter)
merge = Merge(Data1=point, Data2=move.Geometry, Data3=move_3.Geometry, Data4=move_7.Geometry, Data5=move_4.Geometry)
merge_2 = Merge(Data1=move_2.Geometry, Data2=move_5.Geometry, Data3=stream_filter_2)
polyline = PolyLine(Vertices=merge, Closed=invert(False))
polyline_2 = PolyLine(Vertices=merge_2, Closed=False)
sweep1 = Sweep1(Rail=polyline_2, Sections=polyline, Miter=1)
cap_holes = CapHoles(Brep=sweep1)
rotate = Rotate(Geometry=cap_holes, Angle=radians, Plane=baseplane_2)  # -> Geometry, Transform
volume = Volume(Geometry=rotate.Geometry)  # -> Volume, Centroid
deconstruct = Deconstruct(Point=volume.Centroid)  # -> XComponent, YComponent, ZComponent
construct_point = ConstructPoint(XCoordinate=deconstruct.XComponent, YCoordinate=deconstruct.YComponent, ZCoordinate=0)
geometry = ClusterOutput(rotate.Geometry)
point_2 = ClusterOutput(construct_point)
