# Grasshopper definition 20220111_Closed Block_PartialUI_Parking.gh (Grasshopper 1.0.7)
# Copyright: Liljewall Arkitekter
# Copyright: SS
# Copyright: ss
# Copyright: 2017
# plug-ins: Human, Sasquatch, MetaHopper, EleFront, Pufferfish, LunchBox, Squid (ShapeDiver Edition), GHUI

building_1_floor_height = Slider(3, range=3..8)
building_2_floor_height = Slider(3, range=3..8)
building_3_floor_height = Slider(3, range=3..8)
building_4_floor_height = Slider(3, range=3..8)
building_5_floor_height = Slider(3, range=3..8)
building_6_floor_height = Slider(3, range=3..8)
building_7_floor_height = Slider(3, range=3..8)
building_8_floor_height = Slider(3, range=3..8)
building_9_floor_height = Slider(3, range=3..8)
building_10_floor_height = Slider(3, range=3..8)
building_11_floor_height = Slider(3, range=3..8)
building_12_floor_height = Slider(3, range=3..8)
building_13_floor_height = Slider(3, range=3..8)
building_14_floor_height = Slider(3, range=3..8)
building_15_floor_height = Slider(3, range=3..8)
building_16_floor_height = Slider(3, range=3..8)
building_17_floor_height = Slider(3, range=3..8)
building_18_floor_height = Slider(3, range=3..8)
building_19_floor_height = Slider(3, range=3..8)
building_20_floor_height = Slider(3, range=3..8)
select_active_curve = Slider(1, range=1..20)

# ---- group: Save and Export
save_at_the_end = BooleanToggle(False)
create_materials = Button()
save_to_rhino = Button()
override_config_and_save_to_rhino = Button()
delete_from_rhino = Button()
export_to_sketchup = Button()
save_to_excel = Button()
save_chart = Button()
open_chart_in_browser = Button()

# ----
button = Button()
merge = Merge(
    Data1=building_1_floor_height,
    Data2=building_2_floor_height,
    Data3=building_3_floor_height,
    Data4=building_4_floor_height,
    Data5=building_5_floor_height,
    Data6=building_6_floor_height,
    Data7=building_7_floor_height,
    Data8=building_8_floor_height,
    Data9=building_9_floor_height,
    Data10=building_10_floor_height,
    Data11=building_11_floor_height,
    Data12=building_12_floor_height,
    Data13=building_13_floor_height,
    Data14=building_14_floor_height,
    Data15=building_15_floor_height,
    Data16=building_16_floor_height,
    Data17=building_17_floor_height,
    Data18=building_18_floor_height,
    Data19=building_19_floor_height,
    Data20=building_20_floor_height)
building_1_number_of_floors = Slider(8, range=1..30)
building_2_number_of_floors = Slider(12, range=1..30)
building_3_number_of_floors = Slider(7, range=1..30)
building_4_number_of_floors = Slider(16, range=1..30)
building_5_number_of_floors = Slider(12, range=1..30)
building_6_number_of_floors = Slider(5, range=1..30)
building_7_number_of_floors = Slider(4, range=1..30)
building_8_number_of_floors = Slider(4, range=1..30)
building_9_number_of_floors = Slider(3, range=1..30)
building_10_number_of_floors = Slider(13, range=1..30)
building_11_number_of_floors = Slider(12, range=1..30)
building_12_number_of_floors = Slider(20, range=1..31)
building_13_number_of_floors = Slider(6, range=1..30)
building_14_number_of_floors = Slider(11, range=1..30)
building_15_number_of_floors = Slider(6, range=1..30)
building_16_number_of_floors = Slider(19, range=1..30)
building_17_number_of_floors = Slider(6, range=1..30)
building_18_number_of_floors = Slider(12, range=1..30)
building_19_number_of_floors = Slider(8, range=1..30)
building_20_number_of_floors = Slider(6, range=1..30)

global_ground_floor = Slider(4.5, range=0..10)
global_last_floor = Slider(4.5, range=0..10)

divide_by_distance_true_count_false = BooleanToggle(True)
label_by_building_by_0_1 = BooleanToggle(True)
color_building_by_0_1_2_3_4 = Slider(0, range=0..4)
label_by_building_by_0_1_2 = Slider(0, range=0..1)

check_minimum_floor_area = Slider(100, range=80..300)
check_minimum_angle_tolerence = Slider(10, range=0..100)
default_floor_number = Slider(4, range=0..10)
default_floor_height = Slider(3, range=0..10)
check_minimum_edge_length = Slider(2, range=0..100)

# ---- group: Roof Config
default_roof_0_flat_1_green_2_sloped = Slider(0, range=0..2)
green_roof_offset = Slider(1, range=0..10)
roof_offset = Slider(6, range=2..10)
roof_sloped_height = Slider(4.5, range=1..10)
roof_vertical_height = Slider(1.5, range=0..10)

# ----
show_corner_unit_circle = BooleanToggle(False)
building_depth = Slider(12, range=6..20)
sidewalk_height = Slider(-0.5, range=-4..4)
sidewalk_depth = Slider(3, range=0..10)
unit_divide_count = Slider(13, range=0..30)
unit_divide_distance = Slider(24, range=10..60)
courtyard_offset = Slider(2, range=0..10)
corner_unit_tolerance = Slider(2, range=0..20)

courtyard = ColourSwatch(SwatchColor=RGB(102, 112, 71))
sidewalk = ColourSwatch(SwatchColor=RGB(175, 170, 181))
buildings = ColourSwatch(SwatchColor=RGB(230, 232, 247))
sloped_roofs = ColourSwatch(SwatchColor=RGB(219, 129, 146))
flat_roof = ColourSwatch(SwatchColor=RGB(98, 106, 133))

flip_open_curve = BooleanToggle(True)
hide_all_annotations = BooleanToggle(False)

# ---- group: HTML UI
file_path = FilePath("C:\Users\ssanjay\Documents\GitHub\BlockTool\Web_UI\in.html")

# ----
grasshopperui = GrasshopperUI()  # -> InputValues, InputIds
panel = Panel(courtyard)
panel_2 = Panel(sidewalk)
panel_3 = Panel(flat_roof)
panel_4 = Panel(buildings)
panel_5 = Panel(sloped_roofs)
merge_2 = Merge(
    Data1=building_1_number_of_floors,
    Data2=building_2_number_of_floors,
    Data3=building_3_number_of_floors,
    Data4=building_4_number_of_floors,
    Data5=building_5_number_of_floors,
    Data6=building_6_number_of_floors,
    Data7=building_7_number_of_floors,
    Data8=building_8_number_of_floors,
    Data9=building_9_number_of_floors,
    Data10=building_10_number_of_floors,
    Data11=building_11_number_of_floors,
    Data12=building_12_number_of_floors,
    Data13=building_13_number_of_floors,
    Data14=building_14_number_of_floors,
    Data15=building_15_number_of_floors,
    Data16=building_16_number_of_floors,
    Data17=building_17_number_of_floors,
    Data18=building_18_number_of_floors,
    Data19=building_19_number_of_floors,
    Data20=building_20_number_of_floors)
building_1_roof_type = Slider(2, range=0..2)
building_2_roof_type = Slider(1, range=0..2)
building_3_roof_type = Slider(2, range=0..2)
building_5_roof_type = Slider(0, range=0..2)
building_6_roof_type = Slider(2, range=0..2)
building_7_roof_type = Slider(1, range=0..2)
building_8_roof_type = Slider(0, range=0..2)
building_9_roof_type = Slider(2, range=0..2)
building_10_roof_type = Slider(0, range=0..2)
building_11_roof_type = Slider(1, range=0..2)
building_12_roof_type = Slider(2, range=0..2)
building_13_roof_type = Slider(0, range=0..2)
building_14_roof_type = Slider(1, range=0..2)
building_15_roof_type = Slider(2, range=0..2)
building_16_roof_type = Slider(1, range=0..2)
building_17_roof_type = Slider(0, range=0..2)
building_18_roof_type = Slider(1, range=0..2)
building_19_roof_type = Slider(2, range=0..2)
building_4_roof_type = Slider(1, range=0..2)
building_20_roof_type = Slider(0, range=0..2)
x_minus_one = XMinusOne(NumberX=select_active_curve)
merge_3 = Merge(
    Data1=building_1_roof_type,
    Data2=building_2_roof_type,
    Data3=building_3_roof_type,
    Data4=building_4_roof_type,
    Data5=building_5_roof_type,
    Data6=building_6_roof_type,
    Data7=building_7_roof_type,
    Data8=building_8_roof_type,
    Data9=building_9_roof_type,
    Data10=building_10_roof_type,
    Data11=building_11_roof_type,
    Data12=building_12_roof_type,
    Data13=building_13_roof_type,
    Data14=building_14_roof_type,
    Data15=building_15_roof_type,
    Data16=building_16_roof_type,
    Data17=building_17_roof_type,
    Data18=building_18_roof_type,
    Data19=building_19_roof_type,
    Data20=building_20_roof_type)
panel_6 = Panel(grasshopperui.InputValues)
ghpython_script = GhPythonScript(x=merge_3)  # -> out, a; inputs x: list
# ---------- ghpython_script: Python ----------
a = []
for roof in x:
    if roof == 0:
        a.append('flat')
    elif roof == 1:
        a.append('green')
    elif roof == 2:
        a.append('gable')
# ---------- end ghpython_script ----------

# ---- group: Check Document Units
geometry_pipeline = GeometryPipeline(
    GroupByLayer=False,
    GroupByType=False,
    IncludeHidden=True,
    IncludeLocked=True,
    LayerFilter="IN",
    NameFilter="*",
    SublayerFiltering=True,
    TypeFilter=4)
document_units = DocumentUnits()
ghpython_script_2 = GhPythonScript(x=document_units)  # -> out, a
# ---------- ghpython_script_2: Python ----------
if x == 'm':
    a = True
else:
    a = False
# ---------- end ghpython_script_2 ----------
stream_gate = StreamGate(Stream=geometry_pipeline, Gate=ghpython_script_2.a)  # -> Target0, Target1
list_item = ListItem(List=stream_gate.Target1, Index=x_minus_one, Wrap=invert(True))

# ----
list_length = ListLength(List=geometry_pipeline)
null_item = NullItem(Item=list_length)  # -> NullFlags, InvalidFlags, Description
stream_filter = StreamFilter(Gate=null_item.NullFlags, Stream0=list_length, Stream1="1")
writing_on_layer = Panel(stream_filter)

parking_width = Slider(3, range=2.4..3.5)
road_width = Slider(6, range=3.5..8)
walkway_depth = Slider(3, range=1..3)
pavement_height = Slider(0.3, range=0..1)
innerparking_angle = Slider(3, range=-45..45)
parking_depth = Slider(5, range=4..6)
select_direction = Slider(2, range=0..10)
streetlamp_distance = Slider(10, range=4..10)
streetlap_height = Slider(4, range=4..12)
geometry_pipeline_2 = GeometryPipeline(
    GroupByLayer=False,
    GroupByType=False,
    IncludeHidden=True,
    IncludeLocked=True,
    LayerFilter="PARKING",
    NameFilter="*",
    SublayerFiltering=True,
    TypeFilter=4)

# ---- group: Redirect open and closed curves
closed = Closed(Curve=list_item)  # -> Closed, Periodic
stream_gate_2 = StreamGate(Stream=list_item, Gate=closed.Closed)  # -> Target0, Target1

# ---- group: OPEN BLOCK
curve = Curve(stream_gate_2.Target0)

# ---- group: CLOSED BLOCK / INPUT CURVE
rectangle = Rectangle(Plane=PlaneXY(0, 0, 0), XSize=Domain(-1, 1), YSize=Domain(-2, 2), Radius=0)  # -> Rectangle, Length
flip_curve = FlipCurve(Curve=stream_gate_2.Target1, Guide=rectangle.Rectangle)  # -> Curve, Flag

# ----
simpleclosedparking = SimpleClosedParking(
    parking_curve=geometry_pipeline_2,
    parking_depth=parking_depth,
    parking_width=parking_width,
    road_width=road_width,
    walkway_depth=walkway_depth,
    select_direction=select_direction,
    pavement_height=pavement_height,
    inner_parking_angle=innerparking_angle,
    streetlamp_distance=streetlamp_distance,
    streetlamp_height=streetlap_height)  # -> parkingsurfaces, lamppole_2, lamp_bulb_2, road_marking_2, parking_lines_2, parking_location_2, parking_text_2, total_parking_2, islands, walkway
number = Number(simpleclosedparking.total_parking_2)
galapagos = Galapagos(fitness=number, gene=[parking_depth, parking_width, road_width, walkway_depth, select_direction, innerparking_angle])

number_slider = Slider(1, range=0..10)
colour_swatch = ColourSwatch(SwatchColor=RGB(255, 255, 255))
total_parking_spaces = Panel(number)
text_tag = TextTag(
    ParkingLocation=simpleclosedparking.parking_location_2,
    ParkingText=simpleclosedparking.parking_text_2,
    Colour=ColourSwatch(SwatchColor=RGB(255, 255, 255)))  # disabled
custom_preview = CustomPreview(Geometry=simpleclosedparking.parkingsurfaces, Material=ColourSwatch(SwatchColor=RGB(117, 117, 117)))
custom_preview_lineweights = CustomPreviewLineweights(
    Geometry=simpleclosedparking.lamppole_2,
    Shader=ColourSwatch(SwatchColor=RGB(0, 0, 0)),
    Thickness=Slider(3, range=0..10),
    Absolute=False)
custom_preview_2 = CustomPreview(Geometry=simpleclosedparking.lamp_bulb_2, Material=ColourSwatch(SwatchColor=RGB(255, 221, 0)))
custom_preview_lineweights_2 = CustomPreviewLineweights(Geometry=simpleclosedparking.road_marking_2, Shader=colour_swatch, Thickness=number_slider, Absolute=False)
custom_preview_lineweights_3 = CustomPreviewLineweights(Geometry=simpleclosedparking.parking_lines_2, Shader=colour_swatch, Thickness=number_slider, Absolute=False)
custom_preview_3 = CustomPreview(Geometry=simpleclosedparking.islands, Material=ColourSwatch(SwatchColor=RGB(158, 158, 158)))
custom_preview_4 = CustomPreview(Geometry=simpleclosedparking.walkway, Material=ColourSwatch(SwatchColor=RGB(176, 214, 133)))

optimisation = Panel("Replace this component")

# ---- group: bake
panel_7 = Panel("Block_")
concatenate = Concatenate(Fragment_A=panel_7, Fragment_B=stream_filter, A="::Wall")
concatenate_2 = Concatenate(Fragment_A=panel_7, Fragment_B=stream_filter, A="::Courtyard")
concatenate_3 = Concatenate(Fragment_A=panel_7, Fragment_B=stream_filter, A="::Sidewalk")
concatenate_4 = Concatenate(Fragment_A=panel_7, Fragment_B=stream_filter, A="::Roof")
concatenate_5 = Concatenate(Fragment_A=panel_7, Fragment_B=stream_filter, A="::Outline")

# ----
concatenate_6 = Concatenate(Fragment_A=panel_7, Fragment_B=stream_filter, A="::TextTags")
concatenate_7 = Concatenate(Fragment_A=panel_7, Fragment_B=stream_filter, A="::TextCurve")
concatenate_8 = Concatenate(Fragment_A=panel_7, Fragment_B=stream_filter, A="::RoofObjects")

# ---- group: bake / Del
layer_table = LayerTable(Update=True, AutoUpdate=invert(False))  # -> Layers, FullLayerPaths, LayerColors, Linetypes, MaterialNames, Visible, PrintWidth, PrintColor
ghpython_script_3 = GhPythonScript(x=layer_table.FullLayerPaths)  # -> out, a; inputs x: list
# ---------- ghpython_script_3: Python ----------
a = []
for i in x:
    if i!= None and 'Block_' in i:
        a.append(x.index(i))
# ---------- end ghpython_script_3 ----------
list_item_2 = ListItem(List=layer_table.FullLayerPaths, Index=ghpython_script_3.a, Wrap=True)
panel_8 = Panel("_SelDot Delete _EnterEnd")  # disabled
deleteonlayer = DeleteOnLayer(Run=delete_from_rhino, Layer=list_item_2, enableFullPath=True)
rhino_command = RhinoCommand(SendCommandToggle=delete_from_rhino, CommandString=panel_8)  # disabled

# ----
gate_nor = GateNor(A=Button(), B=create_materials)

# ---- group: bake
create_modify_layers = CreateModifyLayers(LayerName=["IN", "PARKING"], DeleteLayer=False, enableFullPath=False)  # -> LayerNames, LayerFullPath
enable_disable_object = EnableDisableObject(
    Enabled=gate_nor,
    AllObjects_Object=[concatenate_2, create_modify_materials_2, create_modify_materials_3, create_modify_materials_4, create_modify_materials_5, create_modify_materials_6, create_modify_materials_7])

# ---- group: EXPORT / charts
colour_wheel = ColourWheel(
    list_length,
    ColourGrips_Style=40,
    ColourGrips_Grip=[5.880267371, 2.738674717, 1.16787839, 4.309471044],
    ColourGrips_Lum=[0.4739487922, 0.8752416378],
    ColourGrips_Range=[0.4049729867, 0.4049729867, 0.4049729867, 0.4049729867],
    ColourGrips_Sat=[0.2177341734, 0.7451950675])
optional_color_palette = Panel("""#005F73
#0A9396
#467A56
#A7C165
#E9D8A6
#DD8340
#BB3E03
#A00D0D
#C40A56
#FF4DA6
#9580FF
#612170
#231C68
#80BFFF""")
panel_9 = Panel(colour_wheel)
white_text = Panel("#FFFFFF")
colour = Colour(panel_9)
color_palette = Panel("""#fec5bbff
#fcd5ceff
#fae1ddff
#f8edebff
#e8e8e4ff
#d8e2dcff
#ece4dbff
#ffe5d9ff
#ffd7baff
#fec89aff""")
black_text = Panel("#000000")
panel_10 = Panel(colour)
ghpython_script_4 = GhPythonScript(x=panel_10)  # -> out, a; inputs x: list
# ---------- ghpython_script_4: Python ----------
def rgb_to_hex(rgb):
    return '#'+'%02x%02x%02x' % rgb
a = []
for c in x:
    print c
    r,g,b = c.split(',')
    a.append(rgb_to_hex((int(r),int(g),int(b))))
# ---------- end ghpython_script_4 ----------
ghpython_script_5 = GhPythonScript(
    write_chart=save_chart,
    crv=geometry_pipeline,
    clr=optional_color_palette,
    htmltitle="Summary of BTA",
    scripttitle="Summary of BTA",
    scriptsubtitle="Summary of data generated by Blocktool",
    textcolor=white_text)  # -> out, html_path, a; inputs crv: list, clr: list
# ---------- ghpython_script_5: Python ----------
import Grasshopper as gh
import csv
import json
import os
import random
gh_path = str(os.path.dirname(gh.Instances.DocumentServer.Document[0].FilePath))+'\chart'
if not os.path.exists(gh_path):
    os.makedirs(gh_path)




#Geth the local directory
gh_path = os.path.dirname(gh.Instances.DocumentServer.Document[0].FilePath)
csvFilePath = str(gh_path) +'\\csv\\' + 'BTA_Summary.csv'


# Function to convert a CSV to JSON
# Takes the file paths as arguments
def make_json(csvFilePath):
    # create a dictionary
    data = {}
    row = ['parent','name','value']
    # Open a csv reader called DictReader
    with open(csvFilePath, 'r') as readFile:
        csvReader = csv.DictReader(readFile, fieldnames=row)
        m_dict = list(csvReader)
        return m_dict
header_list = []

data = make_json(csvFilePath)
colors = ['#001219ff',
'#005f73ff',
'#0a9396ff'
'#94d2bdff',
'#e9d8a6ff',
'#ee9b00ff',
'#ca6702ff',
'#bb3e03ff',
'#ae2012ff',
'#9b2226ff']
key = ['id','parent','name','color']
value = ["0","", " ", "#FFFFFF"]
mydict = dict(zip(key,value))

header_list.append(mydict)
num_curves = len(crv)
# Automate list creation
#block_list = ["B0","B1","B2"]
block_list = []
parent_list = []
name_list = []
color_list = []
for i in range(num_curves):
    block_list.append('B'+str(i+1))
    parent_list.append("0")
    name_list.append("Block "+str(i+1))
    color_list.append(clr[i])
#parent_list = ["0","0","0"]
#name_list = ["Block 1","Block 2","Block 3"]
#Automate color list creation
#color_list = ['#001219ff','#005f73ff','#0a9396ff']

for i in range(len(block_list)):
    val =[block_list[i], parent_list[i], name_list[i], color_list[i]]
    mydict = dict(zip(key,val))
    header_list.append(mydict)

for d_dict in data:
    if 'value' in d_dict.keys():
        v_str = d_dict['value']
        d_dict['value'] = int(v_str)
    if 'Block ' in d_dict['parent']:
        b_str = d_dict['parent']
        b_str = b_str.replace('Block ', 'B')
        d_dict['parent'] = b_str

header = json.dumps(header_list,indent = 4)
header = header.replace("\"color\"","color").replace("\"parent\"","parent").replace("\"id\"","id").replace("\"name\"","name").replace("]",",")
footer = json.dumps(data, indent = 4).replace("[","")

a = header+footer+';'

script_str = """
var data = CHANGEME


Highcharts.setOptions({
  colors: ["#ecb37c", "#ECE100"]
});
Highcharts.chart("container", {
  chart: {
    height: "100%"
  },

  title: {
    text: "SCRIPTTITLE"
  },
  subtitle: {
    text:
      'SCRIPTSUBTITLE'
  },
  series: [
    {
      type: "sunburst",
      data: data,
      allowDrillToNode: true,
      cursor: "pointer",
      borderWidth: 0.5,
      borderColor: "#000000",
      dataLabels: {
        format: "{point.name}",
        filter: {
          property: "innerArcLength",
          operator: ">",
          value: 16
        },
        style: {
          textOutline: false,
          color: "TEXTCOLOR"
        }
      },
      levels: [
        {
          level: 1,
          levelIsConstant: false,
          dataLabels: {
            filter: {
              property: "outerArcLength",
              operator: ">",
              value: 64
            }
          }
        },
        {
          level: 2,
          colorByPoint: true
        },
        {
          level: 3,
          colorVariation: {
            key: "brightness",
            to: -0.5
          }
        },
        {
          level: 4,
          colorVariation: {
            key: "brightness",
            to: 0.5
          }
        }
      ]
    }
  ],
  tooltip: {
    headerFormat: "",
    pointFormat: "The area of <b>{point.name}</b> is <b>{point.value}</b> kvm"
  }
});
"""


html = """
<!DOCTYPE html>
<html lang="en" >
<head>
  <meta charset="UTF-8">
  <title>HTMLTITLE</title>
  <link rel="stylesheet" href="./style.css">

</head>
<body>
<!-- partial:index.partial.html -->
<script src="https://code.highcharts.com/highcharts.js"></script>
<script src="https://code.highcharts.com/modules/sunburst.js"></script>
<script src="https://code.highcharts.com/modules/exporting.js"></script>
<script src="https://code.highcharts.com/modules/accessibility.js"></script>

<div id="container"></div>
<!-- partial -->
  <script  src="./script.js"></script>

</body>
</html>

"""

css = """
#container {
	min-width: 310px;
	max-width: 500px;
	margin: 0 auto
}
"""

if write_chart:
    scriptFilePath = str(gh_path) +'\\chart\\' + 'script.js'
    script_str = script_str.replace('CHANGEME', a).replace('SCRIPTSUBTITLE',scriptsubtitle).replace('SCRIPTTITLE',scripttitle).replace('TEXTCOLOR',textcolor)
    with open(scriptFilePath, 'w') as f:
        f.write(script_str)
    htmlFilePath = str(gh_path) +'\\chart\\' + 'index.html'
    cssFilePath = str(gh_path) +'\\chart\\' + 'style.css'
    with open(htmlFilePath, 'w') as f:
        f.write(html.replace('HTMLTITLE',htmltitle))
    with open(cssFilePath, 'w') as f:
        f.write(css)
html_path = str(gh_path) +'\\chart\\' + 'index.html'
# ---------- end ghpython_script_5 ----------
panel_11 = Panel(ghpython_script_4.a)
launch_application = LaunchApplication(LaunchToggle=open_chart_in_browser, ApplicationPath=ghpython_script_5.html_path)
panel_12 = Panel(ghpython_script_5.a)

# ----
optional_color_palette_2 = Panel("""#5c2751
#6457a6
#9dacff
#76e5fc
#4bc0d9
#f06543
#e0dfd5
#f09d51
#97d8b2
#faf8d4""")
cooler_csv = Panel("fec5bb,fcd5ce,fae1dd,f8edeb,e8e8e4,d8e2dc,ece4db,ffe5d9,ffd7ba,fec89a")
cooler_csv_2 = Panel("eae4e9,fff1e6,fde2e4,fad2e1,e2ece9,bee1e6,f0efeb,dfe7fd,cddafd")
ghpython_script_6 = GhPythonScript(x=cooler_csv)  # -> out, clr
# ---------- ghpython_script_6: Python ----------
b = x.split(',')
clr = []
for c in b:
    clr.append('#'+c)
# ---------- end ghpython_script_6 ----------

# ---- group: EXPORT / Sketchup Export
ghpython_script_7 = GhPythonScript(save_skp=export_to_sketchup)  # -> out, skp_command
# ---------- ghpython_script_7: Python ----------
import Grasshopper as gh
import os
import json
from os.path import exists
#Geth the local directory

gh_path = str(os.path.dirname(gh.Instances.DocumentServer.Document[0].FilePath))+'\sketchup'
if not os.path.exists(gh_path):
    os.makedirs(gh_path)
print gh_path
skp_path = gh_path + "\\Massing.skp"
skp_command = "_SelAll _-Export " + '"'+skp_path+'"' + " _S SketchUp2015  _EnterEnd"
# ---------- end ghpython_script_7 ----------
rhino_command_2 = RhinoCommand(SendCommandToggle=export_to_sketchup, CommandString=ghpython_script_7.skp_command)  # disabled
ghpython_script_8 = GhPythonScript(x=export_to_sketchup, y=ghpython_script_7.skp_command)  # -> out, a
# ---------- ghpython_script_8: Python ----------
import rhinoscriptsyntax as rs

if x:
    rs.Command(y)
# ---------- end ghpython_script_8 ----------

# ---- group: NEW ROOF
number_slider_2 = Slider(0, range=0..1)  # disabled
number_slider_3 = Slider(3, range=0..5)  # disabled
loft_options = LoftOptions(Closed=invert(False), Adjust=False, Rebuild=0, Refit=number_slider_2, Type=number_slider_3)  # disabled

# ---- group: OLD ROOF
number_slider_4 = Slider(1, range=0..2)  # disabled

# ----
read_from_existing_file = BooleanToggle(False)
save_config_to_file = Button()
hide_all_issues = BooleanToggle(False)

gate_or = GateOr(A=save_config_to_file, B=override_config_and_save_to_rhino)

# ---- group: OPEN BLOCK / Make Floor
explode = Explode(Curve=curve, Recursive=True)  # -> Segments, Vertices
stream_gate_3 = StreamGate(Stream=curve, Gate=divide_by_distance_true_count_false)  # -> Target0, Target1
end_points = EndPoints(Curve=curve)  # -> Start, End

# ---- group: OPEN BLOCK
open_buildings_curve = Data(curve)

# ---- group: OPEN BLOCK / Buffer Circle
integer = Integer("2")
unit_z = UnitZ(Factor=1)

# ---- group: CLOSED BLOCK
polyline = PolyLine(Vertices=explode.Vertices, Closed=invert(False))

# ---- group: CLOSED BLOCK / MAKE FOOTPRINT
unit_z_2 = UnitZ(Factor=1)

# ---- group: OPEN BLOCK
unit_z_3 = UnitZ(Factor=Slider(50, range=0..100))

# ---- group: Error Checking / Check minimum Angle
colour_swatch_2 = ColourSwatch(SwatchColor=RGB(204, 0, 0))
panel_13 = Panel("ISSUE : Angle out of threshold")
panel_14 = Panel("3")

# ---- group: Error Checking / Issues Panel
stream_filter_2 = StreamFilter(Gate=ghpython_script_2.a, Stream0="Change Model Units to meters!", Stream1="Model units are fine!")

# ---- group: Show Block Numbers
panel_15 = Panel("black")

# ---- group: Random Roof Box
number_slider_5 = Slider(0.5, range=0..1)
point = Point(Point(0, 0, 0))
center_box = CenterBox(Base=PlaneXY(0, 0, 0), X="0.3", Y=number_slider_5, Z=number_slider_5)
colour_swatch_3 = ColourSwatch(SwatchColor=RGB(169, 186, 214))

# ---- group: CALCULATE AREA
colour_swatch_4 = ColourSwatch(SwatchColor=RGB(0, 0, 0))

# ---- group: Error Checking
panel_16 = Panel("ISSUE : Unit Smaller than Minimum Unit Area")

panel_17 = Panel("ISSUE : Wall shorter than Minimum Edge Length")

# ---- group: bake
panel_18 = Panel([concatenate, concatenate_2, concatenate_3, concatenate_4, concatenate_5, concatenate_8, concatenate_7, concatenate_6])
create_modify_materials = CreateModifyMaterials(Name="Material_Roof_objects", Diffuse=colour_swatch_3)
layers = CreateModifyLayers(LayerName=panel_18, DeleteLayer=False, enableFullPath=True)  # -> LayerNames, LayerFullPath

# ---- group: Annotation Bake
font = Font(Family="Arial", Size="2", Bold=False, Italic=False, Underline=False)
colour_swatch_5 = ColourSwatch(SwatchColor=RGB(0, 0, 0))
gate_or_2 = GateOr(A=save_to_rhino, B=override_config_and_save_to_rhino)
visible_in_layer = BooleanToggle(False)
gate_or_3 = GateOr(A=save_to_rhino, B=override_config_and_save_to_rhino)

# ---- group: bake
list_item_3 = ListItem(List=layers.LayerFullPath, Index=0, Wrap=True)  # -> Item, Item1, Item2, Item3, Item4, Item5, Item6, Item7
panel_19 = Panel("black")
createattributes = CreateAttributes(LayerName=list_item_3.Item4, Color=panel_19, enableFullPath=True)
createattributes_2 = CreateAttributes(LayerName=list_item_3.Item5, MaterialName=create_modify_materials, enableFullPath=True)
gate_or_4 = GateOr(A=save_to_rhino, B=override_config_and_save_to_rhino)
gate_or_5 = GateOr(A=save_to_rhino, B=override_config_and_save_to_rhino)
gate_or_6 = GateOr(A=save_to_rhino, B=override_config_and_save_to_rhino)
gate_or_7 = GateOr(A=save_to_rhino, B=override_config_and_save_to_rhino)
gate_or_8 = GateOr(A=save_to_rhino, B=override_config_and_save_to_rhino)
gate_or_9 = GateOr(A=save_to_rhino, B=override_config_and_save_to_rhino)

# ---- group: Annotation Bake (continued)
define_object_attributes = DefineObjectAttributes(Layer=list_item_3.Item7)
createattributes_3 = CreateAttributes(Color=panel_19, enableFullPath=False)
createattributes_4 = CreateAttributes(LayerName=list_item_3.Item6, Color=panel_19, Visibility=visible_in_layer, enableFullPath=False)

# ---- group: EXPORT / Excel Export
gate_or_10 = GateOr(A=override_config_and_save_to_rhino, B=save_to_rhino)
stream_filter_3 = StreamFilter(Gate=save_at_the_end, Stream0=list_length, Stream1=x_minus_one)
ghpython_script_9 = GhPythonScript(write_excel=save_to_excel)  # -> out, a
# ---------- ghpython_script_9: Python ----------
import Grasshopper as gh
import os
import csv
from os.path import exists
if write_excel:
    #Geth the local directory
    gh_path = str(os.path.dirname(gh.Instances.DocumentServer.Document[0].FilePath))+'\\csv\\'
    if not os.path.exists(gh_path):
        os.makedirs(gh_path)
    csv_paths = []
    for path in os.listdir(gh_path):
        full_path = os.path.join(gh_path, path)
        if os.path.isfile(full_path):
            csv_paths.append(full_path)
        dict_list = []
    for csv_path in csv_paths:
        reader = csv.reader(open(csv_path, 'r'))
        d = {}
        for row in reader:
           k, u, v = row
           d[k] = u, v
           dict_list.append(d)
    output_csv = gh_path + 'BTA_Summary.csv'
    header_saved = False
    with open(output_csv,'wb') as fout:
        for filename in csv_paths:
            with open(filename) as fin:
                header = next(fin)
                if not header_saved:
                    fout.write(header)
                    header_saved = True
                for line in fin:
                    fout.write(line)
                fin.close()
# ---------- end ghpython_script_9 ----------

# ----
ghpython_script_10 = GhPythonScript(
    save=gate_or,
    config_item=stream_filter_3,
    read_from_file=read_from_existing_file,
    active_curve=x_minus_one,
    default_flr_ht=default_floor_height,
    default_flr_no=default_floor_number,
    check_min_flr_area=check_minimum_floor_area,
    check_min_edge_length=check_minimum_edge_length,
    check_min_angle=check_minimum_angle_tolerence,
    div_unit_type=divide_by_distance_true_count_false,
    color_bldg_by=color_building_by_0_1_2_3_4,
    label_bldg_by=label_by_building_by_0_1_2,
    input_bldg_depth=building_depth,
    input_sidewalk_ht=sidewalk_height,
    input_sidewalk_depth=sidewalk_depth,
    input_unit_divide_count=unit_divide_count,
    input_unit_divide_distance=unit_divide_distance,
    input_courtyard_offset=courtyard_offset,
    input_corner_unit_buffer=corner_unit_tolerance,
    default_roof_type=default_roof_0_flat_1_green_2_sloped,
    input_grn_roof_offset=green_roof_offset,
    input_roof_offset=roof_offset,
    input_roof_sloped_ht=roof_sloped_height,
    input_roof_vertical_ht=roof_vertical_height,
    color_courtyard=panel,
    color_sidewalk=panel_2,
    color_buildings=panel_4,
    color_sloped_roof=panel_5,
    color_flat_roof=panel_3,
    global_ground=global_ground_floor,
    global_last=global_last_floor,
    list_floor_ht=merge,
    list_floor_num=merge_2,
    list_roof_type=ghpython_script.a)  # -> out, test, active_curve, default_flr_ht, default_flr_no, check_min_flr_area, check_min_edge_length, check_min_angle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; inputs save: Boolean, config_item: Int32, active_curve: Int32, default_flr_no: Int32, check_min_flr_area: Int32, div_unit_type: Int32, color_bldg_by: Int32, label_bldg_by: Int32, default_roof_type: Int32, list_floor_ht: list, list_floor_num: list, list_roof_type: list
# ---------- ghpython_script_10: Python ----------
import Grasshopper as gh
import os
import json
from os.path import exists
#Geth the local directory
gh_path = str(os.path.dirname(gh.Instances.DocumentServer.Document[0].FilePath))+'\config'
if not os.path.exists(gh_path):
    os.makedirs(gh_path)
config_key = [
'active_curve',
'default_flr_ht',
'default_flr_no',
'check_min_flr_area',
'check_min_edge_length',
'check_min_angle',
'div_unit_type',
'color_bldg_by',
'label_bldg_by',
'input_bldg_depth',
'input_sidewalk_ht',
'input_sidewalk_depth',
'input_unit_divide_count',
'input_unit_divide_distance',
'input_courtyard_offset',
'input_corner_unit_buffer',
'default_roof_type',
'input_grn_roof_offset',
'input_roof_offset',
'input_roof_sloped_ht',
'input_roof_vertical_ht',
'color_courtyard',
'color_sidewalk',
'color_buildings',
'color_sloped_roof',
'color_flat_roof',
'global_ground',
'global_last',
'list_floor_ht',
'list_floor_num',
'list_roof_type'
]
config_in_val = [
_active_curve,
_default_flr_ht,
_default_flr_no,
_check_min_flr_area,
_check_min_edge_length,
_check_min_angle,
_div_unit_type,
_color_bldg_by,
_label_bldg_by,
_input_bldg_depth,
_input_sidewalk_ht,
_input_sidewalk_depth,
_input_unit_divide_count,
_input_unit_divide_distance,
_input_courtyard_offset,
_input_corner_unit_buffer,
_default_roof_type,
_input_grn_roof_offset,
_input_roof_offset,
_input_roof_sloped_ht,
_input_roof_vertical_ht,
_color_courtyard,
_color_sidewalk,
_color_buildings,
_color_sloped_roof,
_color_flat_roof,
_global_ground,
_global_last,
_list_floor_ht,
_list_floor_num,
_list_roof_type
]
config_out_val = [
active_curve_,
default_flr_ht_,
default_flr_no_,
check_min_flr_area_,
check_min_edge_length_,
check_min_angle_,
div_unit_type_,
color_bldg_by_,
label_bldg_by_,
input_bldg_depth_,
input_sidewalk_ht_,
input_sidewalk_depth_,
input_unit_divide_count_,
input_unit_divide_distance_,
input_courtyard_offset_,
input_corner_unit_buffer_,
default_roof_type_,
input_grn_roof_offset_,
input_roof_offset_,
input_roof_sloped_ht_,
input_roof_vertical_ht_,
color_courtyard_,
color_sidewalk_,
color_buildings_,
color_sloped_roof_,
color_flat_roof_,
global_ground_,
global_last_,
list_floor_ht_,
list_floor_num_,
list_roof_type_
]

active_curve_path = gh_path+'\config_curve_'+str(_config_item)+'.json'
in_dict = dict(zip(config_key, config_in_val))
if _save:
    with open(active_curve_path, 'w') as fp:
        json.dump(in_dict, fp, indent = 2)
file_exists = exists(active_curve_path)
if file_exists and _read_from_file:
    with open(active_curve_path) as json_file:
        in_dict = json.load(json_file)
        print ('We found a saved configuration!')
        print ('Reading from file now...')
else:
    print('No Saved file found, reading from live inputs...')
active_curve_ = in_dict['active_curve']
default_flr_ht_ =in_dict['default_flr_ht']
default_flr_no_ =in_dict['default_flr_no']
check_min_flr_area_ =in_dict['check_min_flr_area']
check_min_edge_length_ =in_dict['check_min_edge_length']
check_min_angle_ =in_dict['check_min_angle']
div_unit_type_ =in_dict['div_unit_type']
color_bldg_by_ =in_dict['color_bldg_by']
label_bldg_by_ =in_dict['label_bldg_by']
input_bldg_depth_ =in_dict['input_bldg_depth']
input_sidewalk_ht_ =in_dict['input_sidewalk_ht']
input_sidewalk_depth_ =in_dict['input_sidewalk_depth']
input_unit_divide_count_ =in_dict['input_unit_divide_count']
input_unit_divide_distance_ =in_dict['input_unit_divide_distance']
input_courtyard_offset_ =in_dict['input_courtyard_offset']
input_corner_unit_buffer_ =in_dict['input_corner_unit_buffer']
default_roof_type_ =in_dict['default_roof_type']
input_grn_roof_offset_ =in_dict['input_grn_roof_offset']
input_roof_offset_ =in_dict['input_roof_offset']
input_roof_sloped_ht_ =in_dict['input_roof_sloped_ht']
input_roof_vertical_ht_ =in_dict['input_roof_vertical_ht']
color_courtyard_ =in_dict['color_courtyard']
color_sidewalk_ =in_dict['color_sidewalk']
color_buildings_ = in_dict['color_buildings']
color_sloped_roof_ =in_dict['color_sloped_roof']
color_flat_roof_ =in_dict['color_flat_roof']
global_ground_ = in_dict['global_ground']
global_last_ = in_dict['global_last']
list_floor_ht_ =in_dict['list_floor_ht']
list_floor_num_ =in_dict['list_floor_num']
list_roof_type_ =in_dict['list_roof_type']
# ---------- end ghpython_script_10 ----------

# ---- group: OPEN BLOCK / Make Floor (continued)
negative = Negative(Value=ghpython_script_10.input_bldg_depth)
stream_filter_4 = StreamFilter(Gate=flip_open_curve, Stream0=ghpython_script_10.input_bldg_depth, Stream1=negative)
offset_curve = OffsetCurve(Curve=curve, Distance=stream_filter_4, Corners=1)
end_points_2 = EndPoints(Curve=offset_curve)  # -> Start, End
line = Line(StartPoint=end_points.Start, EndPoint=end_points_2.Start)
sweep1 = Sweep1(Rail=curve, Sections=line, Miter=1)

# ---- group: CLOSED BLOCK / SITE_PARTS / MAKE SIDEWALK
sidewalk_2 = SideWalk(
    edges=[flip_curve.Curve, sweep1],
    distance=ghpython_script_10.input_sidewalk_depth,
    factor=ghpython_script_10.input_sidewalk_ht)  # disabled
close_sidewalk = OPEN_SIDEWALK(curve=flip_curve.Curve, distance=ghpython_script_10.input_sidewalk_depth, factor=ghpython_script_10.input_sidewalk_ht)
open_sidewalk = OPEN_SIDEWALK(curve=sweep1, distance=ghpython_script_10.input_sidewalk_depth, factor=ghpython_script_10.input_sidewalk_ht)
brep = Brep([open_sidewalk, close_sidewalk])

# ---- group: CLOSED BLOCK / SITE_PARTS
bld_inner = OffsetCurve(Curve=flip_curve.Curve, Distance=expr("-x", ghpython_script_10.input_bldg_depth), Corners=1)

# ---- group: OPEN BLOCK / Divide floor
divide_distance = DivideDistance(Curve=stream_gate_3.Target1, Distance=ghpython_script_10.input_unit_divide_distance)  # -> Points, Tangents, Parameters
divide_curve = DivideCurve(Curve=stream_gate_3.Target0, Count=ghpython_script_10.input_unit_divide_count, Kinks=False)  # -> Points, Tangents, Parameters

# ---- group: CLOSED BLOCK / SITE_PARTS / MAKE COURTYARD
courtyard_2 = OffsetCurve(Curve=bld_inner, Distance=expr("-x", ghpython_script_10.input_courtyard_offset), Corners=1)
boundary_surfaces = BoundarySurfaces(Edges=courtyard_2)

# ---- group: OPEN BLOCK / Buffer Circle (continued)
circle_cnr = CircleCNR(Center=explode.Vertices, Normal=Vector(0, 0, 1), Radius=ghpython_script_10.input_corner_unit_buffer)
point_in_curves = PointInCurves(Point=[divide_curve.Points, divide_distance.Points], Curves=circle_cnr)  # -> Relationship, Index, Point
member_index = MemberIndex(Set=point_in_curves.Relationship, Member=integer)  # -> Index, Count
cross_product = CrossProduct(VectorA=[divide_curve.Tangents, divide_distance.Tangents], VectorB=unit_z, Unitize=invert(False))  # -> Vector, Length
cull_index = CullIndex(List=member_index.Index, Indices="0", Wrap=True)
cull_index_2 = CullIndex(List=[divide_curve.Points, divide_distance.Points], Indices=cull_index, Wrap=True)
cull_index_3 = CullIndex(List=cross_product.Vector, Indices=cull_index, Wrap=True)

# ---- group: OPEN BLOCK
negative_2 = Negative(Value=cull_index_3)
stream_filter_5 = StreamFilter(Gate=flip_open_curve, Stream0=cull_index_3, Stream1=negative_2)
line_sdl = LineSDL(Start=cull_index_2, Direction=stream_filter_5, Length=ghpython_script_10.input_bldg_depth)
end_points_3 = EndPoints(Cutter=line_sdl)  # -> Start, End

# ---- group: CLOSED BLOCK / CLEAN CORNERS
explode_2 = Explode(Curve=bld_inner, Recursive=True)  # -> Segments, Vertices
clean_corners = CleanCorners(
    plane=explode_2.Vertices,
    radius=ghpython_script_10.input_corner_unit_buffer,
    gate=ghpython_script_10.div_unit_type,
    stream=bld_inner,
    count=ghpython_script_10.input_unit_divide_count,
    divide_distance=ghpython_script_10.input_unit_divide_distance)  # -> index, points, tangents, circle_2, parameters

# ---- group: CLOSED BLOCK / MAKE FOOTPRINT (continued)
data = Data(clean_corners.index)
cull_index_4 = CullIndex(List=clean_corners.points, Indices=data, Wrap=True)
cull_index_5 = CullIndex(List=clean_corners.tangents, Indices=data, Wrap=True)
cross_product_2 = CrossProduct(VectorA=cull_index_5, VectorB=unit_z_2, Unitize=False)  # -> Vector, Length
boundary_surfaces_2 = BoundarySurfaces(Edges=flatten([bld_inner, flip_curve.Curve]))
line_sdl_2 = LineSDL(Start=cull_index_4, Direction=cross_product_2.Vector, Length=ghpython_script_10.input_bldg_depth)
surface_split = SurfaceSplit(Surface=boundary_surfaces_2, Curves=line_sdl_2)

# ----
sessiontime = GhPythonScript(x=gate_or_10)  # -> out, current_time
# ---------- sessiontime: Python ----------
from datetime import datetime
if x:
    now = datetime.now()
    current_time = now.strftime("%Y%m%d%H%M%S")
# ---------- end sessiontime ----------

# ---- group: OPEN BLOCK (continued)
roof_vertical_height_2 = Data(ghpython_script_10.input_roof_vertical_ht)
roof_sloped_height_2 = Data(ghpython_script_10.input_roof_sloped_ht)
sloped_roof_offset = Data(ghpython_script_10.input_roof_offset)
building_depth_2 = Data(ghpython_script_10.input_bldg_depth)

# ---- group: OPEN BLOCK / Remake roofs
negative_3 = Negative(Value=sloped_roof_offset)
negative_4 = Negative(Value=building_depth_2)
stream_filter_6 = StreamFilter(Gate=flip_open_curve, Stream0=sloped_roof_offset, Stream1=negative_3)
stream_filter_7 = StreamFilter(Gate=flip_open_curve, Stream0=building_depth_2, Stream1=negative_4)
offset_curve_2 = OffsetCurve(Curve=open_buildings_curve, Distance=stream_filter_6, Corners=1)
offset_curve_3 = OffsetCurve(Curve=open_buildings_curve, Distance=stream_filter_7, Corners=1)
curve_closest_point = CurveClosestPoint(Point=cull_index_2, Curve=reparameterize(open_buildings_curve))  # -> Point, Parameter, Distance
curve_closest_point_2 = CurveClosestPoint(Point=cull_index_2, Curve=reparameterize(offset_curve_2))  # -> Point, Parameter, Distance
curve_closest_point_3 = CurveClosestPoint(Point=end_points_3.End, Curve=reparameterize(offset_curve_3))  # -> Point, Parameter, Distance
line_2 = Line(StartPoint=curve_closest_point.Point, EndPoint=curve_closest_point_3.Point)

# ---- group: OPEN BLOCK
surface_split_2 = SurfaceSplit(Surface=sweep1, Curves=line_2)
area = Area(Geometry=surface_split_2)  # -> Area, Centroid
sort_along_curve = SortAlongCurve(Points=area.Centroid, Curve=curve)  # -> Points, Indices
list_item_4 = ListItem(List=surface_split_2, Index=sort_along_curve.Indices, Wrap=True)

# ---- group: CLOSED BLOCK (continued)
boundary_surfaces_3 = BoundarySurfaces(Edges=[clean_corners.circle_2, circle_cnr])
move = Move(Geometry=boundary_surfaces_3, Motion="0,0,-0.1")  # -> Geometry, Transform
stream_gate_4 = StreamGate(Stream=move.Geometry, Gate=show_corner_unit_circle)  # -> Target0, Target1
footprints = Geometry([surface_split, list_item_4])

# ----
flip_curve_2 = FlipCurve(Curve=footprints, Guide=rectangle.Rectangle)  # -> Curve, Flag
list_length_2 = ListLength(List=flip_curve_2.Curve)
series = Series(Start=0, Step=1, Count=list_length_2)
list_item_5 = ListItem(List=ghpython_script_10.list_roof_type, Index=series, Wrap=True)
list_item_6 = ListItem(List=ghpython_script_10.list_floor_num, Index=series, Wrap=True)
list_item_7 = ListItem(List=ghpython_script_10.list_floor_ht, Index=series, Wrap=True)

# ---- group: Error Checking
min_max = GhPythonScript(x=flatten([list_item_7, ghpython_script_10.default_flr_ht]))  # -> a, b; inputs x: list
# ---------- min_max: Python ----------
a = min(x)
b = max(x)
# ---------- end min_max ----------
min_max_2 = GhPythonScript(x=flatten([ghpython_script_10.default_flr_no, list_item_6]))  # -> a, b; inputs x: list; same code as min_max
multiplication = Multiplication(A=min_max.a, B=min_max_2.a)
addition = Addition(A=multiplication, B="10")

# ---- group: CLOSED BLOCK / CHEAP CONTOUR
chp_ctr = GhPythonScript(
    footprint=flip_curve_2.Curve,
    default_height=ghpython_script_10.default_flr_ht,
    default_floors=ghpython_script_10.default_flr_no,
    ht=list_item_7,
    flr=list_item_6,
    global_ground=ghpython_script_10.global_ground,
    global_last=ghpython_script_10.global_last)  # -> out, list_height, list_floors, mass_add, building_height; inputs footprint: list of Brep, ht: list, flr: list
# ---------- chp_ctr: Python ----------
from ghpythonlib import treehelpers as th
len_zones = len(footprint)
list_height = []
list_floors = []

for x in ht:
    list_height.append(x)
for x in flr:
    list_floors.append(x)
for i in range(0,len_zones-len(ht)):
    list_height.append(default_height)
    list_floors.append(default_floors)
mass_add = []
extrude_height = []

for i in range(len_zones):
    extrude_height = []
    single_ht = list_height[i]
    single_flr = list_floors[i]
    counter = 1
    while single_flr>0:
        extrude_height.append(single_ht*counter)
        counter +=1
        single_flr-=1
    mass_add.append(extrude_height)

if global_ground:
    for building_floors in mass_add:
        floor_diff = global_ground - building_floors[0]
        for i in range(len(building_floors)):
            building_floors[i] += floor_diff

if global_last:
    i = 0
    for building_floors in mass_add:
        last_diff = global_last - list_height[i]
        building_floors[-1] += last_diff
        i+=1

building_height = []
for building_floors in mass_add:
    building_height.append(building_floors[-1])
mass_add = th.list_to_tree(mass_add)
# ---------- end chp_ctr ----------
unit_z_4 = UnitZ(Factor=chp_ctr.mass_add)
flip_matrix = FlipMatrix(Data=unit_z_4)
move_2 = Move(Geometry=flip_curve_2.Curve, Motion=flip_matrix)  # -> simplify(Geometry), Transform
explode_3 = Explode(Curve=flip_curve_2.Curve, Recursive=True)  # -> simplify(Segments), Vertices

# ---- group: CLOSED BLOCK / MASS BUILDING
unit_z_5 = UnitZ(Factor=chp_ctr.building_height)
extrude = Extrude(Base=flip_curve_2.Curve, Direction=unit_z_5)

# ---- group: OPEN BLOCK (continued)
building_heights = Data(unit_z_5)

unit_z_6 = UnitZ(Factor=roof_vertical_height_2)
unit_z_7 = UnitZ(Factor=roof_sloped_height_2)
unit_z_8 = UnitZ(Factor=roof_vertical_height_2)
list_item_8 = ListItem(List=curve_closest_point_2.Point, Index=0, Wrap=True)
list_item_9 = ListItem(List=curve_closest_point_3.Point, Index=0, Wrap=True)
move_3 = Move(Geometry=list_item_9, Motion=unit_z_6)  # -> Geometry, Transform
move_4 = Move(Geometry=list_item_8, Motion=unit_z_7)  # -> Geometry, Transform
list_item_10 = ListItem(List=curve_closest_point.Point, Index=0, Wrap=True)
move_5 = Move(Geometry=list_item_10, Motion=unit_z_8)  # -> Geometry, Transform
extrude_2 = Extrude(Base=line_2, Direction=unit_z_3)
polyline_2 = PolyLine(Vertices=[list_item_9, move_3.Geometry, move_4.Geometry, move_5.Geometry, list_item_10], Closed=invert(False))
sweep1_2 = Sweep1(Rail=offset_curve_2, Sections=polyline_2, Miter=1)
split_brep_multiple = SplitBrepMultiple(Brep=sweep1_2, Cutters=extrude_2)  # -> flatten(Result)
cap_holes_ex = CapHolesEx(Brep=split_brep_multiple)  # -> flatten(Brep), Caps, Solid
volume = Volume(Geometry=cap_holes_ex.Brep)  # -> Volume, Centroid
sort_along_curve_2 = SortAlongCurve(Points=volume.Centroid, Curve=curve)  # -> Points, flatten(Indices)
vector = Vector(building_heights)
list_item_11 = ListItem(List=flatten(cap_holes_ex.Brep), Index=sort_along_curve_2.Indices, Wrap=True)  # -> flatten(Item)
move_6 = Move(Geometry=list_item_11, Motion=vector)  # -> flatten(Geometry), Transform

# ---- group: OLD ROOF (continued)
unit_z_9 = UnitZ(Factor=roof_vertical_height_2)  # disabled
unit_z_10 = UnitZ(Factor=roof_sloped_height_2)  # disabled
shatter = Shatter(Curve=reparameterize(open_buildings_curve), Parameters=curve_closest_point.Parameter)  # -> graft(Segments); disabled
shatter_2 = Shatter(Curve=reparameterize(offset_curve_2), Parameters=curve_closest_point_2.Parameter)  # disabled
shatter_3 = Shatter(Curve=reparameterize(offset_curve_3), Parameters=curve_closest_point_3.Parameter)  # -> graft(Segments); disabled
move_7 = Move(Geometry=flatten(shatter), Motion=vector)  # -> Geometry, Transform; disabled
move_8 = Move(Geometry=shatter_2, Motion=vector)  # -> Geometry, Transform; disabled
move_9 = Move(Geometry=move_8.Geometry, Motion=unit_z_9)  # -> Geometry, Transform; disabled
move_10 = Move(Geometry=flatten(curve_closest_point.Point), Motion=vector)  # -> Geometry, Transform; disabled
move_11 = Move(Geometry=flatten(curve_closest_point_3.Point), Motion=vector)  # -> Geometry, Transform; disabled
move_12 = Move(Geometry=curve_closest_point_2.Point, Motion=vector)  # -> Geometry, Transform; disabled
move_13 = Move(Geometry=move_9.Geometry, Motion=unit_z_10)  # -> Geometry, Transform; disabled
move_14 = Move(Geometry=move_12.Geometry, Motion=unit_z_9)  # -> Geometry, Transform; disabled
move_15 = Move(Geometry=move_14.Geometry, Motion=unit_z_10)  # -> Geometry, Transform; disabled
move_16 = Move(Geometry=move_10.Geometry, Motion=unit_z_9)  # -> Geometry, Transform; disabled
move_17 = Move(Geometry=move_11.Geometry, Motion=unit_z_9)  # -> Geometry, Transform; disabled
point_2 = Point(move_16.Geometry)  # disabled
point_3 = Point(move_11.Geometry)  # disabled
point_4 = Point(move_10.Geometry)  # disabled
point_5 = Point(move_15.Geometry)  # disabled
point_6 = Point(move_17.Geometry)  # disabled
entwine = Entwine(Branch00=point_4, Branch01=point_2, Branch02=point_5, Branch03=point_6, Branch04=point_3, FlattenInputs=True)  # disabled
flip_matrix_2 = FlipMatrix(Data=entwine)  # disabled
polyline_3 = PolyLine(Vertices=flip_matrix_2, Closed=invert(False))  # -> flatten(Polyline); disabled
sweep1_3 = Sweep1(Rail=graft(move_13.Geometry), Sections=graft(polyline_3), Miter=number_slider_4)  # -> flatten(Brep); disabled
cap_holes = CapHoles(Brep=sweep1_3)  # -> flatten(Brep); disabled
sloped_roofs_2 = Data(cap_holes)  # disabled

# ---- group: NEW ROOF (continued)
move_18 = Move(Geometry=flatten(shatter_3), Motion=vector)  # -> Geometry, Transform; disabled
move_19 = Move(Geometry=flatten(move_18.Geometry), Motion=unit_z_9)  # -> Geometry, Transform; disabled
move_20 = Move(Geometry=flatten(shatter), Motion=vector)  # -> Geometry, Transform; disabled
move_21 = Move(Geometry=move_9.Geometry, Motion=unit_z_10)  # -> Geometry, Transform; disabled
move_22 = Move(Geometry=move_20.Geometry, Motion=unit_z_9)  # -> Geometry, Transform; disabled
entwine_2 = Entwine(
    Branch00=move_18.Geometry,
    Branch01=move_19.Geometry,
    Branch02=move_21.Geometry,
    Branch03=move_22.Geometry,
    Branch04=move_20.Geometry,
    FlattenInputs=True)  # disabled
flip_matrix_3 = FlipMatrix(Data=entwine_2)  # disabled
loft = Loft(Curves=flip_matrix_3, Options=loft_options)  # -> flatten(Loft); disabled
cap_holes_ex_2 = CapHolesEx(Brep=loft)  # -> Brep, Caps, Solid; disabled

# ---- group: Error Checking / Check minimum Angle (continued)
cluster = Cluster(C=[stream_gate_2.Target1, sweep1], second_number=ghpython_script_10.check_min_angle)  # -> simplify(L), larger_than_2
cull_pattern = CullPattern(List=cluster.L, CullPattern=cluster.larger_than_2)
unit_z_11 = UnitZ(Factor=addition)
move_23 = Move(Geometry=cull_pattern, Motion=unit_z_11)  # -> Geometry, Transform
move_24 = Move(Geometry=cull_pattern, Motion=unit_z_11)  # -> Geometry, Transform
line_3 = Line(StartPoint=cull_pattern, EndPoint=move_24.Geometry)
stream_gate_5 = StreamGate(Stream=move_23.Geometry, Gate=hide_all_issues)  # -> Target0, Target1
stream_gate_6 = StreamGate(Stream=line_3, Gate=hide_all_issues)  # -> Target0, Target1

# ---- group: Error Checking (continued)
length = Length(Curve=explode_3.Segments)  # -> flatten(Length)
smaller_than = SmallerThan(FirstNumber=length, SecondNumber=ghpython_script_10.check_min_edge_length)  # -> SmallerThan, OrEqualTo
cull_pattern_2 = CullPattern(List=flatten(explode_3.Segments), CullPattern=smaller_than.SmallerThan)
cull_pattern_3 = CullPattern(List=length, CullPattern=smaller_than.SmallerThan)
curve_middle = CurveMiddle(Curve=cull_pattern_2)
move_25 = Move(Geometry=curve_middle, Motion=unit_z_11)  # -> Geometry, Transform
line_4 = Line(StartPoint=curve_middle, EndPoint=move_25.Geometry)
stream_gate_7 = StreamGate(Stream=line_4, Gate=hide_all_issues)  # -> Target0, Target1
stream_gate_8 = StreamGate(Stream=move_25.Geometry, Gate=hide_all_issues)  # -> Target0, Target1

list_length_3 = ListLength(List=explode_3.Vertices)  # -> flatten(Length)
min_max_3 = GhPythonScript(x=list_length_3)  # -> a, b; inputs x: list of Int32; same code as min_max
gradient = Gradient(
    LowerLimit=min_max_3.a,
    UpperLimit=min_max_3.b,
    Parameter=list_length_3,
    stops=[0.15: RGB(255, 130, 160), 0.85: RGB(220, 0, 40)])

# ---- group: MAKE ROOFS
# wishlist - Force rotated ridge roof
deconstruct_brep = DeconstructBrep(Brep=extrude)  # -> Faces, Edges, Vertices
surface = Surface(flip_curve_2.Curve)
move_26 = Move(Geometry=surface, Motion=unit_z_5)  # -> Geometry, Transform
rf_flat = RF_FLAT(surface=move_26.Geometry)
rf_green = RF_GREEN(curve=rf_flat, distance=ghpython_script_10.input_grn_roof_offset)
rf_sloped = GableRoof2(
    roofverticalheight=ghpython_script_10.input_roof_vertical_ht,
    geometry=line_sdl_2,
    motion_2=unit_z_5,
    curve=flip_curve.Curve,
    distance=ghpython_script_10.input_roof_offset,
    motion=unit_z_5,
    buildingfootprint=flip_curve_2.Curve,
    factor=ghpython_script_10.input_roof_sloped_ht)  # -> flatten(brep)
sloped_roof = Brep([rf_sloped, move_6.Geometry])
list_item_12 = ListItem(List=deconstruct_brep.Faces, Index=0, Wrap=True)  # -> flatten(Item1), Item

# ---- group: COLOR ROOFS
stream_filter_8 = StreamFilter(Gate=ghpython_script_10.default_roof_type, Stream0=rf_flat, Stream1=rf_green, Stream2=sloped_roof)
stream_filter_9 = StreamFilter(
    Gate=ghpython_script_10.default_roof_type,
    Stream0=ghpython_script_10.color_flat_roof,
    Stream1=ghpython_script_10.color_courtyard,
    Stream2=ghpython_script_10.color_sloped_roof)
clr_roof = GhPythonScript(
    roof_type=list_item_5,
    default=stream_filter_8,
    default_colour=stream_filter_9,
    flat_colour=ghpython_script_10.color_flat_roof,
    green_colour=ghpython_script_10.color_courtyard,
    gable_colour=ghpython_script_10.color_sloped_roof,
    flat=rf_flat,
    green=rf_green,
    gable=sloped_roof)  # -> out, roof, colours; inputs roof_type: list, default: list of Brep, flat: list of Brep, green: list of Brep, gable: list of Brep
# ---------- clr_roof: Python ----------
roof=[]
colours = []
l = len(flat)
l_in = len(roof_type)
for i in range(len(roof_type)):
    if roof_type[i] == 'green':
        roof.append(green[i])
        colours.append(green_colour)
    elif roof_type[i] == 'gable':
        roof.append(gable[i])
        colours.append(gable_colour)
    else:
        roof.append(flat[i])
        colours.append(flat_colour)
for i in range(l_in,l):
    if i<len(default):
        roof.append(default[i])
        colours.append(default_colour)
# ---------- end clr_roof ----------
brep_wireframe = BrepWireframe(Brep=[extrude, clr_roof.roof, move_2.Geometry], Density=-1)
curve_2 = Curve(flatten(brep_wireframe))

# ---- group: Error Checking / Block Area
min_max_4 = GhPythonScript(x=list_item_6)  # -> a, b; inputs x: list of Int32; same code as min_max
gradient_2 = Gradient(
    LowerLimit=min_max_4.a,
    UpperLimit=min_max_4.b,
    Parameter=flatten(list_item_6),
    stops=[0: RGB(0, 128, 0), 0.5: RGB(255, 255, 0), 1: RGB(255, 0, 0)])

# ---- group: Random Roof Box (continued)
filter_by_type = FilterByType(Geometry=clr_roof.roof, ObjectType="Surface")
flip_curve_3 = FlipCurve(Curve=filter_by_type, Guide=rectangle.Rectangle)  # -> Curve, Flag
offset_curve_4 = OffsetCurve(Curve=flip_curve_3.Curve, Distance=expr("-1", 1), Corners=1)  # -> flatten(Curve)
boundary_surfaces_4 = BoundarySurfaces(Edges=offset_curve_4)
populate_geometry = PopulateGeometry(Geometry=flatten(boundary_surfaces_4), Count=Slider(3, range=0..10), Seed=Slider(2, range=0..10))
move_to_point = MoveToPoint(Geometry=center_box, PointA=point, PointB=populate_geometry)  # -> Moved, Vector, Transform
list_item_13 = ListItem(List=flatten(populate_geometry), Index=0, Wrap=True)
null_item_2 = NullItem(Item=list_item_13)  # -> flatten(NullFlags), InvalidFlags, Description
stream_filter_10 = StreamFilter(Gate=null_item_2.NullFlags, Stream0=move_to_point.Moved)

# ---- group: Error Checking
area_2 = Area(Geometry=footprints)  # -> Area, Centroid
stream_filter_11 = StreamFilter(Gate=hide_all_annotations, Stream0=stream_gate_7.Target0)
stream_filter_12 = StreamFilter(Gate=hide_all_annotations, Stream0=stream_gate_8.Target0)
stream_filter_13 = StreamFilter(Gate=hide_all_annotations, Stream0=stream_gate_6.Target0)
stream_filter_14 = StreamFilter(Gate=hide_all_annotations, Stream0=stream_gate_5.Target0)

# ----
multiplication_2 = Multiplication(A=area_2.Area, B=chp_ctr.list_floors)
round = Round(Number=multiplication_2)  # -> Nearest, Floor, Ceiling
concatenate_9 = Concatenate(FragmentA=round.Nearest, FragmentB=" m²")

# ---- group: Error Checking (continued)
smaller_than_2 = SmallerThan(FirstNumber=area_2.Area, SecondNumber=ghpython_script_10.check_min_flr_area)  # -> SmallerThan, OrEqualTo
cull_pattern_4 = CullPattern(List=area_2.Centroid, CullPattern=smaller_than_2.SmallerThan)
move_27 = Move(Geometry=cull_pattern_4, Motion=unit_z_11)  # -> Geometry, Transform
line_5 = Line(StartPoint=cull_pattern_4, EndPoint=move_27.Geometry)
stream_gate_9 = StreamGate(Stream=line_5, Gate=hide_all_issues)  # -> Target0, Target1
stream_gate_10 = StreamGate(Stream=move_27.Geometry, Gate=hide_all_issues)  # -> Target0, Target1

# ----
round_2 = Round(Number=area_2.Area)  # -> Nearest, Floor, Ceiling
concatenate_10 = Concatenate(FragmentA=round_2.Nearest, FragmentB=" m²")

# ---- group: CALCULATE AREA (continued)
mass_addition = MassAddition(Input=round.Nearest)  # -> Result, PartialResults
addition_2 = Addition(A=chp_ctr.building_height, B=ghpython_script_10.input_roof_sloped_ht, C="1")
unit_z_12 = UnitZ(Factor=addition_2)
concatenate_11 = Concatenate(D="Block ", C=stream_filter_3, B=" -", A="Total Area ", Fragment_A=mass_addition.Result, Fragment_B=" m²")
area_3 = Area(Geometry=[boundary_surfaces, polyline])  # -> Area, Centroid
move_28 = Move(Geometry=area_2.Centroid, Motion=unit_z_12)  # -> Geometry, Transform
stream_filter_15 = StreamFilter(Gate=hide_all_annotations, Stream0=area_3.Centroid)

# ----
stream_filter_16 = StreamFilter(Gate=hide_all_annotations, Stream0=move_28.Geometry)
stream_filter_17 = StreamFilter(Gate=ghpython_script_10.label_bldg_by, Stream0=concatenate_10, Stream1=concatenate_9)

# ---- group: Show Block Numbers (continued)
addition_3 = Addition(A="5", B=ghpython_script_10.input_sidewalk_depth)
bld_inner_2 = OffsetCurve(Curve=[flip_curve.Curve, sweep1], Distance=addition_3, Corners=1)
curve_closest_point_4 = CurveClosestPoint(Point=move_28.Geometry, Curve=bld_inner_2)  # -> Point, Parameter, Distance
list_length_4 = ListLength(List=curve_closest_point_4.Point)
series_2 = Series(Start="1", Step=1, Count=list_length_4)
stream_filter_18 = StreamFilter(Gate=hide_all_annotations, Stream0=curve_closest_point_4.Point)

# ---- group: Error Checking / Floorplate Area
min_max_5 = GhPythonScript(x=area_2.Area)  # -> a, b; inputs x: list; same code as min_max
gradient_3 = Gradient(
    LowerLimit=min_max_5.a,
    UpperLimit=min_max_5.b,
    Parameter=area_2.Area,
    stops=[0: RGB(0, 128, 0), 0.5: RGB(255, 255, 0), 1: RGB(255, 0, 0)])

# ---- group: Error Checking / Block Area
min_max_6 = GhPythonScript(x=multiplication_2)  # -> a, b; inputs x: list; same code as min_max
gradient_4 = Gradient(
    LowerLimit=min_max_6.a,
    UpperLimit=min_max_6.b,
    Parameter=multiplication_2,
    stops=[0: RGB(0, 128, 0), 0.5: RGB(255, 255, 0), 1: RGB(255, 0, 0)])

# ---- group: Annotation Bake (continued)
define_text_dot = DefineTextDot(Text=stream_filter_17, Location=stream_filter_16, Font="Arial", Size=14)
define_text_dot_2 = DefineTextDot(Text=concatenate_11, Location=area_3.Centroid, Font="Arial", Size=14)
define_text_dot_3 = DefineTextDot(Text=series_2, Location=stream_filter_18, Font="Arial", Size=14)
text_curves = TextCurves(Plane=stream_filter_16, Text=stream_filter_17, Font=font)  # -> flatten(Curves)
text_curves_2 = TextCurves(Plane=area_3.Centroid, Text=concatenate_11, Font=font)  # -> flatten(Curves)
text_curves_3 = TextCurves(Plane=stream_filter_18, Text=series_2, Font=font)  # -> flatten(Curves)
bake_objects = BakeObjects(
    Geometry=flatten([define_text_dot, define_text_dot_2, define_text_dot_3]),
    Attributes=define_object_attributes,
    Bake=gate_or_2)
panel_20 = Panel(bake_objects)
bake_geometry = BakeGeometry(
    Bake=gate_or_3,
    Geometry=[text_curves, text_curves_2, text_curves_3],
    Attributes=createattributes_4,
    DeleteOldBakes=False,
    PreserveTrees=False)

# ---- group: EXPORT / Excel Export (continued)
ghpython_script_11 = GhPythonScript(write_csv=gate_or_10, active_curve=stream_filter_3, units=extrude, bta=round.Nearest)  # -> out, a; inputs active_curve: Int32, units: list, bta: list
# ---------- ghpython_script_11: Python ----------
import Grasshopper as gh
import os
import csv
from os.path import exists
#Geth the local directory
gh_path = str(os.path.dirname(gh.Instances.DocumentServer.Document[0].FilePath))+'\csv'
if not os.path.exists(gh_path):
    os.makedirs(gh_path)
csv_key = []
for i in range(len(units)):
    csv_key.append('unit '+ str(i))
csv_value = []
csv_block = []
for i in bta:
    csv_block.append('Block ' + str(active_curve))
#csv_value.append(active_curve)
for i in bta:
    csv_value.append(i)
if write_csv:
    filepath = gh_path + "\\" + "block_" + str(active_curve) + '.csv'
    file = open(filepath, "wb")
    writer = csv.writer(file)
    for w in range(len(units)):
      writer.writerow([csv_block[w], csv_key[w], csv_value[w]])
    file.close()
# ---------- end ghpython_script_11 ----------

# ---- group: Error Checking / Issues Panel (continued)
list_length_5 = ListLength(List=flatten([line_5, line_4, line_3]))

# ---- group: Error Checking (continued)
null_item_3 = NullItem(Item=list_length_5)  # -> NullFlags, InvalidFlags, Description
stream_filter_19 = StreamFilter(Gate=null_item_3.NullFlags, Stream0=list_length_5, Stream1="0")
stream_filter_20 = StreamFilter(Gate=hide_all_annotations, Stream0=stream_gate_9.Target0)
stream_filter_21 = StreamFilter(Gate=hide_all_annotations, Stream0=stream_gate_10.Target0)
stream_filter_22 = StreamFilter(
    Gate=ghpython_script_10.color_bldg_by,
    Stream0=ghpython_script_10.color_buildings,
    Stream1=gradient_3,
    Stream2=gradient_4,
    Stream3=gradient,
    Stream4=gradient_2)

# ---- group: Error Checking / Issues Panel (continued)
concatenate_12 = Concatenate(FragmentA=stream_filter_19, FragmentB=" Issues detected")
merge_4 = Merge(Data1="Ensure layer IN is set to default!", Data2=concatenate_12, Data3=stream_filter_2, Data4=ghpython_script_10.out)  # -> flatten(Result)

# ----
panel_21 = Panel(merge_4)

# ---- group: Display
custom_preview_lineweights_4 = CustomPreviewLineweights(Geometry=stream_filter_20, Shader=colour_swatch_2, Thickness=panel_14, Absolute=False)
custom_preview_lineweights_5 = CustomPreviewLineweights(Geometry=stream_filter_11, Shader=colour_swatch_2, Thickness=panel_14, Absolute=False)
custom_preview_lineweights_6 = CustomPreviewLineweights(Geometry=stream_filter_13, Shader=colour_swatch_2, Thickness=panel_14, Absolute=False)
text_tag_2 = TextTag(Location=stream_filter_21, Text=panel_16, Colour=colour_swatch_2)
text_tag_3 = TextTag(Location=stream_filter_12, Text=panel_17, Colour=colour_swatch_2)
text_tag_4 = TextTag(Location=stream_filter_14, Text=panel_13, Colour=colour_swatch_2)
text_tag_5 = TextTag(Location=stream_filter_15, Text=concatenate_11, Colour=colour_swatch_4)
text_tag_6 = TextTag(Location=stream_filter_18, Text=series_2, Colour=panel_15)
text_tag_7 = TextTag(Location=stream_filter_16, Text=stream_filter_17, Colour=colour_swatch_4)

custom_preview_5 = CustomPreview(
    Geometry=stream_gate_4.Target1,
    Material={diffuse=RGB(221, 160, 221), emission=RGB(66, 48, 66), shine=0.5, specular=RGB(255, 255, 255), transparency=0})
walls = CustomPreview(Geometry=extrude, Material=stream_filter_22)
custom_preview_lineweights_7 = CustomPreviewLineweights(Geometry=curve_2, Shader="black", Thickness="1", Absolute=False)
custom_preview_6 = CustomPreview(Geometry=boundary_surfaces, Material=ghpython_script_10.color_courtyard)
custom_preview_7 = CustomPreview(Geometry=brep, Material=ghpython_script_10.color_sidewalk)
custom_preview_8 = CustomPreview(Geometry=[stream_filter_10, move_26.Geometry], Material=colour_swatch_3)
custom_preview_9 = CustomPreview(Geometry=clr_roof.roof, Material=clr_roof.colours)

# ---- group: bake (continued)
create_modify_materials_2 = CreateModifyMaterials(Name="Material_Wall", Diffuse=stream_filter_22)
create_modify_materials_3 = CreateModifyMaterials(Name="Material_Courtyard", Diffuse=ghpython_script_10.color_courtyard)
create_modify_materials_4 = CreateModifyMaterials(Name="Material_Sidewalk", Diffuse=ghpython_script_10.color_sidewalk)
create_modify_materials_5 = CreateModifyMaterials(Name="Material_Roof_flat", Diffuse=ghpython_script_10.color_flat_roof)
create_modify_materials_6 = CreateModifyMaterials(Name="Material_Roof_green", Diffuse=ghpython_script_10.color_courtyard)
create_modify_materials_7 = CreateModifyMaterials(Name="Material_Roof_gable", Diffuse=ghpython_script_10.color_sloped_roof)

concatenate_13 = Concatenate(FragmentA="Material_Roof_", FragmentB=list_item_5)
createattributes_5 = CreateAttributes(LayerName=list_item_3.Item1, MaterialName=create_modify_materials_3, enableFullPath=True)
createattributes_6 = CreateAttributes(LayerName=list_item_3.Item, MaterialName=create_modify_materials_2, enableFullPath=True)
createattributes_7 = CreateAttributes(LayerName=list_item_3.Item2, MaterialName=create_modify_materials_4, enableFullPath=True)
createattributes_8 = CreateAttributes(LayerName=list_item_3.Item3, MaterialName=concatenate_13, enableFullPath=True)
bake_geometry_2 = BakeGeometry(Bake=gate_or_4, Geometry=extrude, Attributes=createattributes_6, DeleteOldBakes=False, PreserveTrees=False)
bake_geometry_3 = BakeGeometry(Bake=gate_or_5, Geometry=boundary_surfaces, Attributes=createattributes_5, DeleteOldBakes=False, PreserveTrees=False)
bake_geometry_4 = BakeGeometry(Bake=gate_or_6, Geometry=brep, Attributes=createattributes_7, DeleteOldBakes=False, PreserveTrees=False)
bake_geometry_5 = BakeGeometry(Bake=gate_or_7, Geometry=clr_roof.roof, Attributes=createattributes_8, DeleteOldBakes=False, PreserveTrees=False)
bake_geometry_6 = BakeGeometry(Bake=gate_or_8, Geometry=curve_2, Attributes=createattributes, DeleteOldBakes=False, PreserveTrees=False)
bake_geometry_7 = BakeGeometry(Bake=gate_or_9, Geometry=move_to_point.Moved, Attributes=createattributes_2, DeleteOldBakes=False, PreserveTrees=False)

# ==== cluster RF_GREEN
curve = ClusterInput()
distance = ClusterInput()

# ---- group: Green Roof
offset_curve = OffsetCurve(Curve=flatten(curve), Distance=expr("-x", distance), Corners=1)  # -> flatten(Curve)

# ----
surface = Surface(offset_curve)

# ---- group: Green Roof (continued)
move = Move(Geometry=surface, Motion="0,0,0.05")  # -> flatten(Geometry), Transform

# ----
geometry = ClusterOutput(move.Geometry)

# ==== cluster RF_FLAT
surface = ClusterInput()

# ---- group: Flat Roof
surface_2 = Surface(flatten(surface))
move = Move(Geometry=surface_2, Motion="0,0,0.01")  # -> Geometry, Transform

# ----
geometry = ClusterOutput(move.Geometry)

# ==== cluster CleanCorners
divide_distance = ClusterInput()
gate = ClusterInput()
stream = ClusterInput()
count = ClusterInput()
stream_gate = StreamGate(Stream=stream, Gate=gate)  # -> Target0, Target1
plane = ClusterInput()
radius = ClusterInput()
divide_distance_2 = DivideDistance(Curve=stream_gate.Target1, Distance=divide_distance)  # -> Points, Tangents, Parameters

# ---- group: No corners
divide_curve = DivideCurve(Curve=stream_gate.Target0, Count=count, Kinks=False)  # -> Points, Tangents, Parameters
circle = Circle(Plane=plane, Radius=radius)
point_in_curves = PointInCurves(Point=[divide_curve.Points, divide_distance_2.Points], Curves=circle)  # -> Relationship, Index, Point
integer = Integer("2")
member_index = MemberIndex(Set=point_in_curves.Relationship, Member=integer)  # -> Index, Count

# ----
points = ClusterOutput([divide_curve.Points, divide_distance_2.Points])
tangents = ClusterOutput([divide_curve.Tangents, divide_distance_2.Tangents])
parameters = ClusterOutput([divide_curve.Parameters, divide_distance_2.Parameters])
index = ClusterOutput(member_index.Index)
circle_2 = ClusterOutput(circle)

# ==== cluster SideWalk
edges = ClusterInput()
curve = Curve(edges)
distance = ClusterInput()
polyline_offset = PolylineOffset(
    Polylines=curve,
    Distance=distance,
    Plane=Plane(origin=(0, 0, 0), x=(0, 0, 0), y=(0, 0, 0)),
    Tolerance=0.01,
    ClosedFillet=1,
    OpenFillet=1,
    Miter=2)  # -> Contour, Holes
length = Length(Curve=polyline_offset.Holes)
highest_lowest_numbers = HighestLowestNumbers(Numbers=length)  # -> Highest, Lowest
member_index = MemberIndex(Set=length, Member=highest_lowest_numbers.Highest)  # -> Index, Count
list_item = ListItem(List=polyline_offset.Holes, Index=member_index.Index, Wrap=True)
curve_2 = Curve(flatten([polyline_offset.Contour, list_item]))
factor = ClusterInput()

# ---- group: Sidewalk
unit_z = UnitZ(Factor=factor)
fillet = Fillet(Curve=curve_2, Radius="5")
boundary_surfaces = BoundarySurfaces(Edges=flatten([fillet, edges]))
extrude = Extrude(Base=boundary_surfaces, Direction=unit_z)

# ----
list_item_2 = ListItem(List=extrude, Index=0, Wrap=True)
i = ClusterOutput(list_item_2)

# ==== cluster GableRoof2
buildingfootprint = ClusterInput()
curve = ClusterInput()
distance = ClusterInput()
roofverticalheight = ClusterInput()
curve_2 = Curve(buildingfootprint)
offset_curve = OffsetCurve(Curve=curve, Distance=expr("-x", distance), Corners=1)
trim_with_region = TrimWithRegion(Curve=offset_curve, Region=curve_2)  # -> flatten(Inside), Outside
motion = ClusterInput()
factor = ClusterInput()
unit_z = UnitZ(Factor=roofverticalheight)
move = Move(Geometry=trim_with_region.Inside, Motion=motion)  # -> Geometry, Transform
unit_z_2 = UnitZ(Factor=factor)
geometry = ClusterInput()
motion_2 = ClusterInput()
move_2 = Move(Geometry=geometry, Motion=motion_2)  # -> Geometry, Transform
move_3 = Move(Geometry=move_2.Geometry, Motion=unit_z)  # -> Geometry, Transform
move_4 = Move(Geometry=move.Geometry, Motion=unit_z_2)  # -> Geometry, Transform
move_5 = Move(Geometry=move_4.Geometry, Motion=unit_z)  # -> Geometry, Transform
end_points = EndPoints(Curve=move_3.Geometry)  # -> Start, End
end_points_2 = EndPoints(Curve=move_2.Geometry)  # -> Start, End
end_points_3 = EndPoints(Curve=move_5.Geometry)  # -> Start, End
point = Point(end_points_2.Start)
point_2 = Point(end_points.Start)
point_3 = Point(end_points.End)
point_4 = Point(end_points_2.End)
point_5 = Point(end_points_3.Start)
entwine = Entwine(Branch00=point, Branch01=point_2, Branch02=point_5, Branch03=point_3, Branch04=point_4, FlattenInputs=True)
flip_matrix = FlipMatrix(Data=entwine)
polyline = PolyLine(Vertices=flip_matrix, Closed=invert(False))
sweep1 = Sweep1(Rail=graft(move_5.Geometry), Sections=polyline, Miter=Slider(1, range=0..2))
cap_holes = CapHoles(Brep=sweep1)
brep = ClusterOutput(cap_holes)

# ==== cluster Cluster
C = ClusterInput()
explode = Explode(Curve=C, Recursive=True)  # -> Segments, Vertices
shift = ShiftList(List=explode.Segments, Shift=1, Wrap=True)
entwine = Entwine(Branch00=explode.Segments, Branch01=shift, FlattenInputs=True)
shift_2 = ShiftList(List=explode.Vertices, Shift=1, Wrap=False)
flip = FlipMatrix(Data=entwine)
item = ListItem(List=flip, Index=0, Wrap=True)  # -> Item, Item1
L = ClusterOutput(shift_2)
angle = Angle(VectorA=item.Item, VectorB=item.Item1)  # -> flatten(Angle), Reflex
second_number = ClusterInput()
deg = Degrees(Radians=angle.Angle)
subtraction = Subtraction(A="180", B=deg)
subtraction_2 = Subtraction(A=subtraction, B="90")
absolute = Absolute(Value=subtraction_2)
larger_than = LargerThan(FirstNumber=absolute, SecondNumber=second_number)  # -> LargerThan, OrEqualTo
larger_than_2 = ClusterOutput(larger_than.LargerThan)
panel = Panel(subtraction)

# ==== cluster OPEN_SIDEWALK
curve = ClusterInput()
distance = ClusterInput()
curve_2 = Curve(curve)
factor = ClusterInput()
offset_curve = OffsetCurve(Curve=curve_2, Distance=distance, Corners=1)
fillet = Fillet(Curve=offset_curve, Radius=Slider(2, range=0..10))
unit_z = UnitZ(Factor=factor)
boundary_surfaces = BoundarySurfaces(Edges=flatten([curve_2, fillet]))
extrude = Extrude(Base=boundary_surfaces, Direction=unit_z)
extrusion = ClusterOutput(extrude)

# ==== cluster SimpleClosedParking
parking_width = ClusterInput()
walkway_depth = ClusterInput()
select_direction = ClusterInput()
streetlamp_distance = ClusterInput()
streetlamp_height = ClusterInput()
parking_curve = ClusterInput()
parking_depth = ClusterInput()
road_width = ClusterInput()
pavement_height = ClusterInput()
inner_parking_angle = ClusterInput()
parking_width_2 = Number(parking_width)
walkway_depth_2 = Number(walkway_depth)
select_direction_2 = Number(select_direction)
streetlamp_distance_2 = Number(streetlamp_distance)
streetlamp_height_2 = Number(streetlamp_height)
parking_curve_2 = Curve(parking_curve)
parking_depth_2 = Number(parking_depth)
road_width_2 = Number(road_width)
pavement_height_2 = Number(pavement_height)
inner_parking_angle_2 = Number(inner_parking_angle)
rectangle = Rectangle(Plane=PlaneXY(0, 0, 0), XSize=Domain(-1, 1), YSize=Domain(-2, 2), Radius=0)  # -> Rectangle, Length
flip_curve = FlipCurve(Curve=parking_curve_2, Guide=rectangle.Rectangle)  # -> Curve, Flag
offset_curve = OffsetCurve(Curve=flip_curve.Curve, Distance=expr("-x", parking_depth_2), Corners=1)
radians = Radians(Degrees=inner_parking_angle_2)
absolute = Absolute(Value=radians)
explode = Explode(Curve=flip_curve.Curve, Recursive=True)  # -> Segments, Vertices
explode_2 = Explode(Curve=offset_curve, Recursive=True)  # -> Segments, Vertices
offset_curve_2 = OffsetCurve(Curve=offset_curve, Distance=expr("-x/2", road_width_2), Corners=1)
offset_curve_3 = OffsetCurve(Curve=offset_curve, Distance=expr("-x", road_width_2), Corners=1)
explode_3 = Explode(Curve=offset_curve_3, Recursive=True)  # -> Segments, Vertices
list_item = ListItem(List=explode_3.Segments, Index=select_direction_2, Wrap=True)
triangle_trigonometry = TriangleTrigonometry(Alpha=absolute, Beta="pi/2", BLength=parking_depth_2)  # -> Alpha, Beta, Gamma, ALength, BLength, CLength
divide_distance = DivideDistance(Curve=explode_2.Segments, Distance=parking_width_2)  # -> Points, Tangents, Parameters
unit_z = UnitZ(Factor=1)
evaluate_curve = EvaluateCurve(Curve=reparameterize(list_item), Parameter="0.5")  # -> Point, Tangent, Angle
curve_closest_point = CurveClosestPoint(Point=divide_distance.Points, Curve=graft(explode.Segments))  # -> Point, Parameter, Distance
fillet = Fillet(Curve=offset_curve_2, Radius=Slider(3, range=0..10))
unit_z_2 = UnitZ(Factor=1)
cross_product = CrossProduct(VectorA=divide_distance.Tangents, VectorB=unit_z, Unitize=invert(False))  # -> Vector, Length
end_points = EndPoints(Curve=list_item)  # -> Start, End
null_item = NullItem(Item=triangle_trigonometry.CLength)  # -> NullFlags, InvalidFlags, Description
construct_plane = ConstructPlane(Origin=end_points.Start, XAxis=unit_z_2, YAxis=evaluate_curve.Tangent)
stream_filter = StreamFilter(Gate=null_item.NullFlags, Stream0=triangle_trigonometry.CLength, Stream1=parking_depth_2)
expression = Expression(pD=stream_filter, rW=road_width_2, wW=walkway_depth_2, Expression="(2*pD)+rW+wW")
line = Line(StartPoint=curve_closest_point.Point, EndPoint=divide_distance.Points)  # -> simplify(Line)
list_item_2 = ListItem(List=line, Index=0, Wrap=True)
list_item_3 = ListItem(List=line, Index="-1", Wrap=True)
line_sdl = LineSDL(Start=divide_distance.Points, Direction=cross_product.Vector, Length=expr("X+0.5", parking_depth_2))  # -> simplify(Line)
loft = Loft(
    Curves=[list_item_2, list_item_3],
    Options={Adjust=False, Closed=False, LoftEnds=0, LoftSimp=0, LoftType=0, Rebuild=10, Refit=0.01})  # -> flatten(Loft)
division = Division(A=road_width_2, B="2")
region_difference = RegionDifference(CurvesA=flip_curve.Curve, CurvesB=offset_curve)
division_2 = Division(A=walkway_depth_2, B="2")
merge = Merge(Data1="0", Data2=stream_filter, Data3=division_2, Data4=division_2, Data5=stream_filter, Data6=division, Data7=division)
boundary_surfaces = BoundarySurfaces(Edges=region_difference)
surface_split = SurfaceSplit(Surface=boundary_surfaces, Curves=loft)
duplicate_data = DuplicateData(Data=merge, Number="100", Order=True)
mass_addition = MassAddition(Input=duplicate_data)  # -> Result, PartialResults
area = Area(Geometry=surface_split)  # -> Area, Centroid
area_2 = Area(Geometry=loft)  # -> Area, Centroid
contour_ex = ContourEx(Shape=offset_curve_3, Plane=construct_plane, Offsets=mass_addition.PartialResults, Distances=expression)  # -> flatten(Contours)
member_index = MemberIndex(Set=area.Area, Member=area_2.Area)  # -> flatten(Index), Count
cull_index = CullIndex(List=surface_split, Indices=member_index.Index, Wrap=True)
partition_list_adv = PartitionListAdv(List=contour_ex, Size="7")  # -> Chunk, Remainder
list_item_4 = ListItem(List=partition_list_adv.Remainder, Index=0, Wrap=invert(True))  # -> Item, Item1, Item2, Item3, Item4, Item5, Item6
list_item_5 = ListItem(List=partition_list_adv.Chunk, Index=0, Wrap=True)  # -> Item, Item1, Item2, Item3, Item4, Item5, Item6
curve = Curve([list_item_5.Item, list_item_4.Item])
curve_2 = Curve([list_item_5.Item1, list_item_4.Item1])
curve_3 = Curve([list_item_5.Item3, list_item_4.Item3])
curve_4 = Curve([list_item_5.Item4, list_item_4.Item4])
curve_5 = Curve([list_item_5.Item6, list_item_4.Item6])
curve_6 = Curve([list_item_5.Item2, list_item_4.Item2])
curve_7 = Curve([list_item_5.Item5, list_item_4.Item5])
unit_z_3 = UnitZ(Factor=1)
divide_distance_2 = DivideDistance(Curve=curve_3, Distance=parking_width_2)  # -> Points, Tangents, Parameters
divide_distance_3 = DivideDistance(Curve=curve_2, Distance=parking_width_2)  # -> Points, Tangents, Parameters
negative = Negative(Value=inner_parking_angle_2)
radians_2 = Radians(Degrees=negative)
cross_product_2 = CrossProduct(VectorA=unit_z, VectorB=divide_distance_2.Tangents, Unitize=invert(False))  # -> Vector, Length
cross_product_3 = CrossProduct(VectorA=divide_distance_3.Tangents, VectorB=unit_z, Unitize=invert(False))  # -> Vector, Length
rotate = Rotate(Vector=cross_product_2.Vector, Axis=unit_z_3, Angle=radians_2)
rotate_2 = Rotate(Vector=cross_product_3.Vector, Axis=unit_z_3, Angle=radians)
line_sdl_2 = LineSDL(Start=divide_distance_3.Points, Direction=rotate_2, Length=parking_depth_2)
line_sdl_3 = LineSDL(Start=divide_distance_2.Points, Direction=rotate, Length=parking_depth_2)
divide_distance_4 = DivideDistance(Curve=curve_6, Distance=streetlamp_distance_2)  # -> Points, Tangents, Parameters
unit_z_footpath = UnitZ(Factor=pavement_height_2)
unit_z_4 = UnitZ(Factor=streetlamp_height_2)
end_points_2 = EndPoints(Curve=line_sdl_2)  # -> Start, End
end_points_3 = EndPoints(Curve=line_sdl_3)  # -> Start, End
line_sdl_4 = LineSDL(Start=divide_distance_4.Points, Direction=unit_z_footpath, Length=streetlamp_height_2)
point_in_curve = PointInCurve(Point=end_points_2.End, Curve=offset_curve_3)  # -> Relationship, Point
point_in_curve_2 = PointInCurve(Point=end_points_3.End, Curve=offset_curve_3)  # -> Relationship, Point
move = Move(Geometry=divide_distance_4.Points, Motion=unit_z_4)  # -> Geometry, Transform
integer = Integer(0)
curve_8 = Curve(curve_7)
sphere = Sphere(Base="0,0,0", Radius=Slider(0.2, range=0..1))
member_index_2 = MemberIndex(Set=point_in_curve.Relationship, Member=integer)  # -> Index, Count
member_index_3 = MemberIndex(Set=point_in_curve_2.Relationship, Member=integer)  # -> Index, Count
end_points_4 = EndPoints(Curve=line)  # -> Start, End
move_to_point = MoveToPoint(Geometry=sphere, PointA="0,0,0", PointB=move.Geometry)  # -> Moved, Vector, Transform
dash_pattern = DashPattern(Curve=flatten([fillet, curve_8]), Pattern="2")  # -> Dashes, Gaps
shift_list = ShiftList(List=end_points_4.End, Shift=1, Wrap=True)
cull_index_2 = CullIndex(List=line_sdl_2, Indices=member_index_2.Index, Wrap=True)  # -> simplify(List)
end_points_5 = EndPoints(Curve=cull_index_2)  # -> Start, End
shift_list_2 = ShiftList(List=end_points_5.End, Shift=1, Wrap=True)
cull_index_3 = CullIndex(List=line_sdl_3, Indices=member_index_3.Index, Wrap=True)  # -> simplify(List)
end_points_6 = EndPoints(Curve=cull_index_3)  # -> Start, End
shift_list_3 = ShiftList(List=end_points_6.End, Shift=1, Wrap=True)
line_2 = Line(StartPoint=end_points_5.Start, EndPoint=shift_list_2)
line_3 = Line(StartPoint=end_points_6.Start, EndPoint=shift_list_3)
line_4 = Line(StartPoint=end_points_4.Start, EndPoint=shift_list)
cull_index_4 = CullIndex(List=line_2, Indices="-1", Wrap=True)
cull_index_5 = CullIndex(List=line_3, Indices="-1", Wrap=True)
cull_index_6 = CullIndex(List=line_4, Indices="-1", Wrap=True)
curve_middle = CurveMiddle(Curve=flatten([cull_index_4, cull_index_5, cull_index_6]))
list_length = ListLength(List=curve_middle)
series = Series(Start="1", Step="1", Count=list_length)
list_item_6 = ListItem(List=cull_index_2, Index=0, Wrap=True)  # -> Item1, Item
list_item_7 = ListItem(List=cull_index_3, Index=0, Wrap=True)  # -> Item1, Item
end_points_7 = EndPoints(Curve=list_item_7.Item1)  # -> Start, End
end_points_8 = EndPoints(Curve=list_item_7.Item)  # -> Start, End
end_points_9 = EndPoints(Curve=curve_2)  # -> Start, End
end_points_10 = EndPoints(Curve=curve_3)  # -> Start, End
end_points_11 = EndPoints(Curve=curve)  # -> Start, End
end_points_12 = EndPoints(Curve=curve_4)  # -> Start, End
end_points_13 = EndPoints(Curve=list_item_6.Item1)  # -> Start, End
end_points_14 = EndPoints(Curve=list_item_6.Item)  # -> Start, End
point = Point(end_points_12.End)
point_2 = Point(end_points_7.Start)
point_3 = Point(end_points_7.End)
point_4 = Point(end_points_10.Start)
point_5 = Point(end_points_8.Start)
point_6 = Point(end_points_8.End)
point_7 = Point(end_points_11.End)
point_8 = Point(end_points_13.End)
point_9 = Point(end_points_9.Start)
point_10 = Point(end_points_14.Start)
point_11 = Point(end_points_14.End)
point_12 = Point(end_points_10.End)
point_13 = Point(end_points_12.Start)
point_14 = Point(end_points_9.End)
point_15 = Point(end_points_13.Start)
point_16 = Point(end_points_11.Start)
merge_2 = Merge(Data1=simplify(point), Data2=simplify(point_12), Data3=simplify(point_2), Data4=simplify(point_3))
merge_3 = Merge(Data1=simplify(point_13), Data2=simplify(point_4), Data3=simplify(point_5), Data4=simplify(point_6))
merge_4 = Merge(Data1=simplify(point_16), Data2=simplify(point_9), Data3=simplify(point_10), Data4=simplify(point_11))
merge_5 = Merge(Data1=simplify(point_7), Data2=simplify(point_14), Data3=simplify(point_15), Data4=simplify(point_8))
merge_6 = Merge(Data1=end_points_9.Start, Data2=end_points_10.Start, Data3=end_points_10.End, Data4=end_points_9.End)
polyline = PolyLine(Vertices=merge_2, Closed=invert(False))
polyline_2 = PolyLine(Vertices=merge_3, Closed=invert(False))
polyline_3 = PolyLine(Vertices=merge_4, Closed=invert(False))
polyline_4 = PolyLine(Vertices=merge_5, Closed=invert(False))
polyline_5 = PolyLine(Vertices=merge_6, Closed=invert(False))
extrude = Extrude(Base=[polyline, cull_index, polyline_3, polyline_2, polyline_4], Direction=unit_z_footpath)
extrude_2 = Extrude(Base=polyline_5, Direction=unit_z_footpath)
cap_holes = CapHoles(Brep=extrude)
cap_holes_2 = CapHoles(Brep=extrude_2)
islands = ClusterOutput(cap_holes)
walkway = ClusterOutput(cap_holes_2)
boundary_surfaces_2 = BoundarySurfaces(Edges=flip_curve.Curve)
lamppole = Curve(line_sdl_4)
lamp_bulb = Geometry(move_to_point.Moved)
road_marking = Curve(dash_pattern.Dashes)
parking_lines = Curve([cull_index_2, cull_index_3, line])
parking_location = Point(curve_middle)
parking_text = Text(series)
total_parking = Number(list_length)
parkingsurfaces = ClusterOutput(boundary_surfaces_2)
lamppole_2 = ClusterOutput(lamppole)
lamp_bulb_2 = ClusterOutput(lamp_bulb)
road_marking_2 = ClusterOutput(road_marking)
parking_lines_2 = ClusterOutput(parking_lines)
parking_location_2 = ClusterOutput(parking_location)
parking_text_2 = ClusterOutput(parking_text)
total_parking_2 = ClusterOutput(total_parking)
