# Grasshopper definition Town Plan 2021-11-09.gh (Grasshopper 1.0.7)
# plug-ins: Pufferfish, Wombat, MetaHopper, Human

list = ValueList({"Normal": 0, "Faint": 1, "Hidden": 2}, selected="Faint")
custom = BooleanToggle(True)
canvas = ColourSwatch(SwatchColor=RGB(204, 204, 204))
canvas_2 = ColourSwatch(SwatchColor=RGB(242, 242, 242))
wiredisplay = ControlWireDisplay(WireDisplay=list, AllObjects_Object=[offcrv, crv, lanes, lane_width, multiplication_2, terrain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])
canvas_color = CanvasColor(Toggle=custom, BackgroundColor=canvas_2, GridColor=canvas, GridCellWidth=200, GridCellHeight=100)

# ----
# Street
# Centerline
lane_width = Slider(5, range=3..6)
sidewalk_width = Slider(2, range=0..8)
crv = Curve(<curve referenced from the Rhino model>)
lanes = Slider(4, range=2..4)

# ----
# Free Line
# House Typology
floor_height = Slider(3, range=2..6)
house_selector = Slider(2, range=1..5)
brep = Brep(<brep referenced from the Rhino model>)
brep_2 = Brep(<brep referenced from the Rhino model>)
parcel_depth = Slider(30, range=0..60)
parcel_width = Slider(20, range=10..40)
recess_value = Slider(15, range=0..40)
filter = StreamFilter(Gate=house_selector, Stream1=brep, Stream2=brep_2)

# ----
# 1st Side
# House Typology
parcel_depth_2 = Slider(30, range=0..60)
parcel_width_2 = Slider(20, range=10..40)
recess_value_2 = Slider(15, range=0..30)
floor_height_2 = Slider(3, range=2..6)
house_selector_2 = Slider(2, range=1..5)
brep_3 = Brep(<brep referenced from the Rhino model>)
brep_4 = Brep(<brep referenced from the Rhino model>)
filter_2 = StreamFilter(Gate=house_selector_2, Stream1=brep_3, Stream2=brep_4)

# ----
# 2nd Sides
# House Typology
brep_5 = Brep(<brep referenced from the Rhino model>)
parcel_depth_3 = Slider(30, range=0..60)
parcel_width_3 = Slider(20, range=10..40)
recess_value_3 = Slider(15, range=0..40)
brep_6 = Brep(<brep referenced from the Rhino model>)
floor_height_3 = Slider(3, range=2..6)
house_selector_3 = Slider(1, range=1..5)
filter_3 = StreamFilter(Gate=house_selector_3, Stream1=brep_6, Stream2=brep_5)

larger = LargerThan(FirstNumber=lanes, SecondNumber=2)  # -> LargerThan, OrEqualTo
expression = Expression(x=lanes, y=lane_width, Expression="(x * y) / 2")
onoff = EnableDisableObject(Enabled=larger.LargerThan, AllObjects_Object=offset)
multiplication = Multiplication(A=lane_width, B=-1)
addition = Addition(A=expression, B=sidewalk_width)
merge = Merge(Data1=lane_width, Data2=multiplication)
multiplication_2 = Multiplication(A=expression, B=-1)
multiplication_3 = Multiplication(A=addition, B=-1)
multiplication_4 = Multiplication(A=expression, B=-1)
offset = OffsetCurve(Curve=crv, Distance=merge, Corners=1)

# ----
# Street Surface
offcrv = OffsetCurve(Curve=crv, Plane=PlaneXY(0, 0, 0), Distance=expression, BothSides=multiplication_2, Kinks=0, CapType=1)
boundary = BoundarySurfaces(Edges=offcrv)
street = ColourSwatch(SwatchColor=RGB(76, 76, 76))
custom_preview = CustomPreview(Geometry=boundary, Material=street)

# ----
# Sidewalks
offcrv_2 = OffsetCurve(Curve=crv, Plane=PlaneXY(0, 0, 0), Distance=addition, BothSides=expression, Kinks=0, CapType=1)
offcrv_3 = OffsetCurve(Curve=crv, Plane=PlaneXY(0, 0, 0), Distance=multiplication_3, BothSides=multiplication_4, Kinks=0, CapType=1)
boundary_2 = BoundarySurfaces(Edges=offcrv_2)
boundary_3 = BoundarySurfaces(Edges=offcrv_3)
Z = UnitZ(Factor=0.2)
Z_2 = UnitZ(Factor=0.2)
sidewalk = ColourSwatch(SwatchColor=RGB(153, 153, 153))
extr = Extrude(Base=boundary_2, Direction=Z)
extr_2 = Extrude(Base=boundary_3, Direction=Z_2)
custom_preview_2 = CustomPreview(Geometry=flatten([extr, extr_2]), Material=sidewalk)
wires = BrepWireframe(Brep=flatten([extr, extr_2]), Density=-1)

# ----
# Center Buffer Surface
offcrv_4 = OffsetCurve(Curve=crv, Plane=PlaneXY(0, 0, 0), Distance=0.5, BothSides=-0.5, Kinks=0, CapType=1)
boundary_4 = BoundarySurfaces(Edges=offcrv_4)
Z_3 = UnitZ(Factor=0.2)
extr_3 = Extrude(Base=boundary_4, Direction=Z_3)
custom_preview_3 = CustomPreview(Geometry=extr_3, Material=sidewalk)
wires_2 = BrepWireframe(Brep=extr_3, Density=-1)

dash = DashPattern(Curve=offset, Pattern=5)  # -> Dashes, Gaps
panel = Panel(" m²")
panel_2 = Panel(" m²")
panel_3 = Panel(" m²")

display_data = BooleanToggle(False)
onoff_2 = EnableDisableObject(Enabled=display_data, AllObjects_Object=[tag_3, tag, tag_5, tag_2, tag_4, tag_6, tag_8, scale_5, tag_7, scale_4])

panel_4 = Panel("")
panel_5 = Panel("")

# ----
# Houses
# Base Line
base_line_selector = Slider(4, range=0..4)
houses_base_line = Curve(<curve referenced from the Rhino model>)
gate = StreamGate(Stream=crv, Gate=base_line_selector)  # -> Target0, Target1, Target2, Target3, Target4
geo = Geometry(gate.Target2)
geo_2 = Geometry(gate.Target3)
geo_3 = Geometry(gate.Target4)

flip = FlipCurve(Curve=houses_base_line)  # -> Curve, Flag

filter_4 = StreamFilter(Gate=base_line_selector, Stream0=houses_base_line, Stream1=flip.Curve)
geo_4 = Geometry(filter_4)

# ----
# Parcels Side 1
addition_2 = Addition(A=sidewalk_width, B=parcel_depth_2)
addition_3 = Addition(A=expression, B=addition_2)
addition_4 = Addition(A=expression, B=sidewalk_width)
expression_2 = Expression(x=addition_3, y=addition_4, Expression="(x + y) / 2")
offcrv_5 = OffsetCurve(Curve=[geo, geo_3], Plane=PlaneXY(0, 0, 0), Distance=addition_3, BothSides=addition_4, Kinks=0, CapType=1)
offcrv_6 = OffsetCurve(Curve=[geo, geo_3], Plane=PlaneXY(0, 0, 0), Distance=expression_2, BothSides=0, Kinks=0, CapType=0)
boundary_5 = BoundarySurfaces(Edges=offcrv_5)

# ----
# Houses Recess
selobj = GetSelectedObjects(AllObjects_Object=recess_value_2)  # -> ComponentObjects, ParamObjects, OtherObjects
dom = ConstructDomain(DomainStart=0, DomainEnd=parcel_depth_2)
set_slider = SetSliderProperties(Slider=selobj.ParamObjects, Range=dom, Type=1)
addition_5 = Addition(A=addition_4, B=recess_value_2)
offcrv_7 = OffsetCurve(Curve=[geo, geo_3], Plane=PlaneXY(0, 0, 0), Distance=addition_5, BothSides=0, Kinks=0, CapType=0)

# ----
# Parcels Side 2
addition_6 = Addition(A=sidewalk_width, B=parcel_depth_3)
addition_7 = Addition(A=expression, B=addition_6)
addition_8 = Addition(A=expression, B=sidewalk_width)
multiplication_5 = Multiplication(A=addition_7, B=-1)
multiplication_6 = Multiplication(A=addition_8, B=-1)
expression_3 = Expression(x=addition_7, y=addition_8, Expression="(x + y) / -2")
offcrv_8 = OffsetCurve(Curve=[geo_2, geo_3], Plane=PlaneXY(0, 0, 0), Distance=multiplication_5, BothSides=multiplication_6, Kinks=0, CapType=1)
offcrv_9 = OffsetCurve(Curve=[geo_2, geo_3], Plane=PlaneXY(0, 0, 0), Distance=expression_3, BothSides=0, Kinks=0, CapType=0)
boundary_6 = BoundarySurfaces(Edges=offcrv_8)

# ----
# Houses Recess
selobj_2 = GetSelectedObjects(AllObjects_Object=recess_value_2)  # -> ComponentObjects, ParamObjects, OtherObjects
dom_2 = ConstructDomain(DomainStart=0, DomainEnd=parcel_depth_3)
set_slider_2 = SetSliderProperties(Slider=selobj_2.ParamObjects, Range=dom_2, Type=1)
addition_9 = Addition(A=addition_8, B=recess_value_3)
multiplication_7 = Multiplication(A=addition_9, B=-1)
offcrv_10 = OffsetCurve(Curve=[geo_2, geo_3], Plane=PlaneXY(0, 0, 0), Distance=multiplication_7, BothSides=0, Kinks=0, CapType=0)

# ----
# Parcels Side 1
offcrv_11 = OffsetCurve(Curve=geo_4, Plane=PlaneXY(0, 0, 0), Distance=parcel_depth, BothSides=0, Kinks=0, CapType=1)
division = Division(A=parcel_depth, B=2)
offcrv_12 = OffsetCurve(Curve=geo_4, Plane=PlaneXY(0, 0, 0), Distance=division, BothSides=0, Kinks=0, CapType=0)
boundary_7 = BoundarySurfaces(Edges=offcrv_11)

# ----
# Houses Recess
selobj_3 = GetSelectedObjects(AllObjects_Object=recess_value_2)  # -> ComponentObjects, ParamObjects, OtherObjects
dom_3 = ConstructDomain(DomainStart=0, DomainEnd=parcel_depth)
set_slider_3 = SetSliderProperties(Slider=selobj_3.ParamObjects, Range=dom_3, Type=1)
offcrv_13 = OffsetCurve(Curve=geo_4, Plane=PlaneXY(0, 0, 0), Distance=recess_value, BothSides=0, Kinks=0, CapType=0)

# ----
# Parcels
divlength = DivideLength(Curve=offcrv_6, Length=parcel_width_2)  # -> Points, Tangents, Parameters
pframe = PerpFrame(Curve=offcrv_6, Parameter=divlength.Parameters)
xz = XZPlane(Origin=Point(0, 0, 0))
align = AlignPlanes(Planes=pframe, Master=xz)
multiplication_8 = Multiplication(A=parcel_depth_2, B=-1)
deplane = DeconstructPlane(Plane=align)  # -> Origin, XAxis, YAxis, ZAxis
line = LineSDL(Start=divlength.Points, Direction=deplane.XAxis, Length=multiplication_8)
midpt = CurveMiddle(Curve=line)
scale = Scale(Geometry=line, Center=midpt, Factor=2.1)  # -> Geometry, Transform
trim = TrimWithRegion(Curve=scale.Geometry, Region=boundary_5)  # -> Inside, Outside
srfsplit = SurfaceSplit(Surface=flatten(boundary_5), Curves=flatten(trim.Inside))

# ----
# Parcels
divlength_2 = DivideLength(Curve=offcrv_9, Length=parcel_width_3)  # -> Points, Tangents, Parameters
pframe_2 = PerpFrame(Curve=offcrv_9, Parameter=divlength_2.Parameters)
xz_2 = XZPlane(Origin=Point(0, 0, 0))
align_2 = AlignPlanes(Planes=pframe_2, Master=xz_2)
multiplication_9 = Multiplication(A=parcel_depth_3, B=-1)
deplane_2 = DeconstructPlane(Plane=align_2)  # -> Origin, XAxis, YAxis, ZAxis
line_2 = LineSDL(Start=divlength_2.Points, Direction=deplane_2.XAxis, Length=multiplication_9)
midpt_2 = CurveMiddle(Curve=line_2)
scale_2 = Scale(Geometry=line_2, Center=midpt_2, Factor=2.1)  # -> Geometry, Transform
trim_2 = TrimWithRegion(Curve=scale_2.Geometry, Region=boundary_6)  # -> Inside, Outside
srfsplit_2 = SurfaceSplit(Surface=flatten(boundary_6), Curves=flatten(trim_2.Inside))

# ----
# Parcels
divlength_3 = DivideLength(Curve=offcrv_12, Length=parcel_width)  # -> Points, Tangents, Parameters
pframe_3 = PerpFrame(Curve=offcrv_12, Parameter=divlength_3.Parameters)
xz_3 = XZPlane(Origin=Point(0, 0, 0))
align_3 = AlignPlanes(Planes=pframe_3, Master=xz_3)
multiplication_10 = Multiplication(A=parcel_depth, B=-1)
deplane_3 = DeconstructPlane(Plane=align_3)  # -> Origin, XAxis, YAxis, ZAxis
line_3 = LineSDL(Start=divlength_3.Points, Direction=deplane_3.XAxis, Length=multiplication_10)
midpt_3 = CurveMiddle(Curve=line_3)
scale_3 = Scale(Geometry=line_3, Center=midpt_3, Factor=2.1)  # -> Geometry, Transform
trim_3 = TrimWithRegion(Curve=scale_3.Geometry, Region=boundary_7)  # -> Inside, Outside
srfsplit_3 = SurfaceSplit(Surface=flatten(boundary_7), Curves=flatten(trim_3.Inside))

# ----
# Predicted Parcel Area (20% Tolerance)
# Most Common Parcel Area
# Merge Neighbouring Regions
area = Area(Geometry=srfsplit)  # -> Area, Centroid
multiplication_11 = Multiplication(A=parcel_depth_2, B=parcel_width_2)
multiplication_12 = Multiplication(A=multiplication_11, B=0.2)
equalst = EqualityWithinTolerance(FirstNumber=multiplication_11, SecondNumber=area.Area, Tolerance=multiplication_12)  # -> Equality, Inequality
cull = CullPattern(List=srfsplit, CullPattern=equalst.Equality)
cull_2 = CullPattern(List=srfsplit, CullPattern=equalst.Inequality)
runion = RegionUnion(Curves=cull_2)
area_2 = Area(Geometry=runion)  # -> Area, Centroid
larger_2 = LargerThan(FirstNumber=area_2.Area, SecondNumber=multiplication_11)  # -> LargerThan, OrEqualTo
cull_3 = CullPattern(List=cull_2, CullPattern=larger_2.OrEqualTo)
merge_2 = Merge(Data1=cull, Data2=cull_3)
area_3 = Area(Geometry=flatten(merge_2))  # -> Area, Centroid
courtyard = ColourSwatch(SwatchColor=RGB(149, 178, 89))
custom_preview_4 = CustomPreview(Geometry=flatten(merge_2), Material=courtyard)
wires_3 = BrepWireframe(Brep=flatten(merge_2), Density=-1)

# ----
# Rotate & Orient
ccx = CurveCurve(CurveA=offcrv_7, CurveB=scale.Geometry)  # -> Points, ParamsA, ParamsB
volume = Volume(Geometry=filter_2)  # -> Volume, Centroid
shatter = Shatter(Curve=offcrv_7, Parameters=flatten(ccx.ParamsA))
midpt_4 = CurveMiddle(Curve=shatter)
cp = ClosestPoint(Point=area_3.Centroid, Cloud=midpt_4)  # -> ClosestPoint, CPIndex, Distance
item = ListItem(List=midpt_4, Index=cp.CPIndex, Wrap=True)
crv_cp = CurveClosestPoint(Point=cp.ClosestPoint, Curve=offcrv_7)  # -> Point, Parameter, Distance
pframe_4 = PerpFrame(Curve=offcrv_7, Parameter=crv_cp.Parameter)
xz_4 = XZPlane(Origin=Point(0, 0, 0))
move2pt = MoveToPoint(Geometry=filter_2, PointA=cp.ClosestPoint, PointB=item)  # -> Moved, Vector, Transform
align_4 = AlignPlanes(Planes=pframe_4, Master=xz_4)
volume_2 = Volume(Geometry=move2pt.Moved)  # -> Volume, Centroid
yz = YZPlane(Origin=volume_2.Centroid)
orient = Orient(Geometry=move2pt.Moved, Source=yz, Target=align_4)  # -> Geometry, Transform

# ----
# Align Houses on Surface
buildings = Geometry(orient.Geometry)
terrain = Surface(boundary_5)
bbox = BoundingBox(Content=buildings, Plane=PlaneXY(0, 0, 0))  # -> Box, Box_2
explode = BrepComponents(Brep=bbox.Box)  # -> Faces, Edges, Vertices
item_2 = ListItem(List=explode.Faces, Index=4, Wrap=True)
mcomp = Decompose(Mesh=item_2)  # -> Vertices, Faces, Colours, Normals
Z_4 = UnitZ(Factor=1)
project = ProjectPoint(Point=mcomp.Vertices, Direction=Z_4, Geometry=terrain)  # -> Point, Index
dist = Distance(PointA=mcomp.Vertices, PointB=project.Point)
sort = SortList(Keys=dist)  # -> reverse(Keys), ValuesA
item_3 = ListItem(List=sort.Keys, Index=0, Wrap=True)
Z_5 = UnitZ(Factor=item_3)
move = Move(Geometry=graft(buildings), Motion=Z_5)  # -> Geometry, Transform
debrep = DeconstructBrep(Brep=move.Geometry)  # -> Faces, Edges, Vertices

# ----
# Predicted Parcel Area (20% Tolerance)
# Most Common Parcel Area
# Merge Neighbouring Regions
area_4 = Area(Geometry=srfsplit_2)  # -> Area, Centroid
multiplication_13 = Multiplication(A=parcel_depth_3, B=parcel_width_3)
multiplication_14 = Multiplication(A=multiplication_13, B=0.2)
equalst_2 = EqualityWithinTolerance(FirstNumber=multiplication_13, SecondNumber=area_4.Area, Tolerance=multiplication_14)  # -> Equality, Inequality
cull_4 = CullPattern(List=srfsplit_2, CullPattern=equalst_2.Equality)
cull_5 = CullPattern(List=srfsplit_2, CullPattern=equalst_2.Inequality)
runion_2 = RegionUnion(Curves=cull_5)
area_5 = Area(Geometry=runion_2)  # -> Area, Centroid
larger_3 = LargerThan(FirstNumber=area_5.Area, SecondNumber=multiplication_13)  # -> LargerThan, OrEqualTo
cull_6 = CullPattern(List=cull_5, CullPattern=larger_3.OrEqualTo)
merge_3 = Merge(Data1=cull_4, Data2=cull_6)
area_6 = Area(Geometry=flatten(merge_3))  # -> Area, Centroid
courtyard_2 = ColourSwatch(SwatchColor=RGB(149, 178, 89))
custom_preview_5 = CustomPreview(Geometry=flatten(merge_3), Material=courtyard_2)
wires_4 = BrepWireframe(Brep=flatten(merge_3), Density=-1)

# ----
# Rotate & Orient
ccx_2 = CurveCurve(CurveA=offcrv_10, CurveB=scale_2.Geometry)  # -> Points, ParamsA, ParamsB
volume_3 = Volume(Geometry=filter_3)  # -> Volume, Centroid
shatter_2 = Shatter(Curve=offcrv_10, Parameters=flatten(ccx_2.ParamsA))
midpt_5 = CurveMiddle(Curve=shatter_2)
cp_2 = ClosestPoint(Point=area_6.Centroid, Cloud=midpt_5)  # -> ClosestPoint, CPIndex, Distance
crv_cp_2 = CurveClosestPoint(Point=cp_2.ClosestPoint, Curve=offcrv_10)  # -> Point, Parameter, Distance
item_4 = ListItem(List=midpt_5, Index=cp_2.CPIndex, Wrap=True)
pframe_5 = PerpFrame(Curve=offcrv_10, Parameter=crv_cp_2.Parameter)
xz_5 = XZPlane(Origin=Point(0, 0, 0))
move2pt_2 = MoveToPoint(Geometry=filter_3, PointA=cp_2.ClosestPoint, PointB=item_4)  # -> Moved, Vector, Transform
align_5 = AlignPlanes(Planes=pframe_5, Master=xz_5)
volume_4 = Volume(Geometry=move2pt_2.Moved)  # -> Volume, Centroid
yz_2 = YZPlane(Origin=volume_4.Centroid)
orient_2 = Orient(Geometry=move2pt_2.Moved, Source=yz_2, Target=align_5)  # -> Geometry, Transform

# ----
# Align Houses on Surface
buildings_2 = Geometry(orient_2.Geometry)
terrain_2 = Surface(boundary_6)
bbox_2 = BoundingBox(Content=buildings_2, Plane=PlaneXY(0, 0, 0))  # -> Box, Box_2
explode_2 = BrepComponents(Brep=bbox_2.Box)  # -> Faces, Edges, Vertices
item_5 = ListItem(List=explode_2.Faces, Index=4, Wrap=True)
mcomp_2 = Decompose(Mesh=item_5)  # -> Vertices, Faces, Colours, Normals
Z_6 = UnitZ(Factor=1)
project_2 = ProjectPoint(Point=mcomp_2.Vertices, Direction=Z_6, Geometry=terrain_2)  # -> Point, Index
dist_2 = Distance(PointA=mcomp_2.Vertices, PointB=project_2.Point)
sort_2 = SortList(Keys=dist_2)  # -> reverse(Keys), ValuesA
item_6 = ListItem(List=sort_2.Keys, Index=0, Wrap=True)
Z_7 = UnitZ(Factor=item_6)
move_2 = Move(Geometry=graft(buildings_2), Motion=Z_7)  # -> Geometry, Transform
debrep_2 = DeconstructBrep(Brep=move_2.Geometry)  # -> Faces, Edges, Vertices

# ----
# Predicted Parcel Area (20% Tolerance)
# Most Common Parcel Area
# Merge Neighbouring Regions
area_7 = Area(Geometry=srfsplit_3)  # -> Area, Centroid
multiplication_15 = Multiplication(A=parcel_depth, B=parcel_width)
multiplication_16 = Multiplication(A=multiplication_15, B=0.2)
equalst_3 = EqualityWithinTolerance(FirstNumber=multiplication_15, SecondNumber=area_7.Area, Tolerance=multiplication_16)  # -> Equality, Inequality
cull_7 = CullPattern(List=srfsplit_3, CullPattern=equalst_3.Equality)
cull_8 = CullPattern(List=srfsplit_3, CullPattern=equalst_3.Inequality)
runion_3 = RegionUnion(Curves=cull_8)
area_8 = Area(Geometry=runion_3)  # -> Area, Centroid
larger_4 = LargerThan(FirstNumber=area_8.Area, SecondNumber=multiplication_15)  # -> LargerThan, OrEqualTo
cull_9 = CullPattern(List=cull_8, CullPattern=larger_4.OrEqualTo)
merge_4 = Merge(Data1=cull_7, Data2=cull_9)
area_9 = Area(Geometry=flatten(merge_4))  # -> Area, Centroid
courtyard_3 = ColourSwatch(SwatchColor=RGB(149, 178, 89))
custom_preview_6 = CustomPreview(Geometry=flatten(merge_4), Material=courtyard_3)
wires_5 = BrepWireframe(Brep=flatten(merge_4), Density=-1)

# ----
# Rotate & Orient
ccx_3 = CurveCurve(CurveA=offcrv_13, CurveB=scale_3.Geometry)  # -> Points, ParamsA, ParamsB
volume_5 = Volume(Geometry=filter)  # -> Volume, Centroid
shatter_3 = Shatter(Curve=offcrv_13, Parameters=flatten(ccx_3.ParamsA))
midpt_6 = CurveMiddle(Curve=shatter_3)
cp_3 = ClosestPoint(Point=area_9.Centroid, Cloud=midpt_6)  # -> ClosestPoint, CPIndex, Distance
item_7 = ListItem(List=midpt_6, Index=cp_3.CPIndex, Wrap=True)
crv_cp_3 = CurveClosestPoint(Point=cp_3.ClosestPoint, Curve=offcrv_13)  # -> Point, Parameter, Distance
pframe_6 = PerpFrame(Curve=offcrv_13, Parameter=crv_cp_3.Parameter)
xz_6 = XZPlane(Origin=Point(0, 0, 0))
move2pt_3 = MoveToPoint(Geometry=filter, PointA=cp_3.ClosestPoint, PointB=item_7)  # -> Moved, Vector, Transform
align_6 = AlignPlanes(Planes=pframe_6, Master=xz_6)
volume_6 = Volume(Geometry=move2pt_3.Moved)  # -> Volume, Centroid
yz_3 = YZPlane(Origin=volume_6.Centroid)
orient_3 = Orient(Geometry=move2pt_3.Moved, Source=yz_3, Target=align_6)  # -> Geometry, Transform

# ----
# Align Houses on Surface
buildings_3 = Geometry(orient_3.Geometry)
terrain_3 = Surface(boundary_7)
bbox_3 = BoundingBox(Content=buildings_3, Plane=PlaneXY(0, 0, 0))  # -> Box, Box_2
explode_3 = BrepComponents(Brep=bbox_3.Box)  # -> Faces, Edges, Vertices
item_8 = ListItem(List=explode_3.Faces, Index=4, Wrap=True)
mcomp_3 = Decompose(Mesh=item_8)  # -> Vertices, Faces, Colours, Normals
Z_8 = UnitZ(Factor=1)
project_3 = ProjectPoint(Point=mcomp_3.Vertices, Direction=Z_8, Geometry=terrain_3)  # -> Point, Index
dist_3 = Distance(PointA=mcomp_3.Vertices, PointB=project_3.Point)
sort_3 = SortList(Keys=dist_3)  # -> reverse(Keys), ValuesA
item_9 = ListItem(List=sort_3.Keys, Index=0, Wrap=True)
Z_9 = UnitZ(Factor=item_9)
move_3 = Move(Geometry=graft(buildings_3), Motion=Z_9)  # -> Geometry, Transform
debrep_3 = DeconstructBrep(Brep=move_3.Geometry)  # -> Faces, Edges, Vertices

# ----
# Parcel Area
crv_cp_4 = CurveClosestPoint(Point=area_3.Centroid, Curve=offcrv_6)  # -> Point, Parameter, Distance
xz_7 = XZPlane(Origin=Point(0, 0, 0))
pframe_7 = PerpFrame(Curve=offcrv_6, Parameter=crv_cp_4.Parameter)
align_7 = AlignPlanes(Planes=pframe_7, Master=xz_7)
multiplication_17 = Multiplication(A=parcel_depth_2, B=-0.8)
deplane_4 = DeconstructPlane(Plane=align_7)  # -> Origin, XAxis, YAxis, ZAxis
line_4 = LineSDL(Start=area_3.Centroid, Direction=deplane_4.XAxis, Length=multiplication_17)
roundf = RoundToFactor(NumberX=area_3.Area, Factor=1, RoundType=0)  # -> Rounded, Difference, MultiplierR, MultiplierX
end = EndPoints(Curve=line_4)  # -> Start, End
tag = TextTag(Location=end.End, Text=roundf.Rounded, Colour=RGB(0, 0, 0))  # disabled

# ----
# House Area
contour = Contour(Shape=filter_2, Point=Point(0, 0, 0), Direction=Vector(0, 0, 1), Distance=floor_height_2, UseTasks=False)
area_10 = Area(Geometry=contour)  # -> Area, Centroid
ma = MassAddition(Input=flatten(area_10.Area))  # -> Result, PartialResults
panel_6 = Panel("")
merge_5 = Merge(Data1=panel_6, Data2=ma.Result, Data3=panel)
join = TextJoin(Text=merge_5)
tag_2 = TextTag(Location=end.End, Text=join, Colour=RGB(0, 0, 0))  # disabled

# ----
# Parcel Area
crv_cp_5 = CurveClosestPoint(Point=area_6.Centroid, Curve=offcrv_9)  # -> Point, Parameter, Distance
xz_8 = XZPlane(Origin=Point(0, 0, 0))
pframe_8 = PerpFrame(Curve=offcrv_9, Parameter=crv_cp_5.Parameter)
align_8 = AlignPlanes(Planes=pframe_8, Master=xz_8)
multiplication_18 = Multiplication(A=parcel_depth_3, B=0.8)
deplane_5 = DeconstructPlane(Plane=align_8)  # -> Origin, XAxis, YAxis, ZAxis
line_5 = LineSDL(Start=area_6.Centroid, Direction=deplane_5.XAxis, Length=multiplication_18)
roundf_2 = RoundToFactor(NumberX=area_6.Area, Factor=1, RoundType=0)  # -> Rounded, Difference, MultiplierR, MultiplierX
end_2 = EndPoints(Curve=line_5)  # -> Start, End
tag_3 = TextTag(Location=end_2.End, Text=roundf_2.Rounded, Colour=RGB(0, 0, 0))  # disabled

# ----
# House Area
contour_2 = Contour(Shape=filter_3, Point=Point(0, 0, 0), Direction=Vector(0, 0, 1), Distance=floor_height_3, UseTasks=False)
area_11 = Area(Geometry=contour_2)  # -> Area, Centroid
ma_2 = MassAddition(Input=flatten(area_11.Area))  # -> Result, PartialResults
panel_7 = Panel("")
merge_6 = Merge(Data1=panel_7, Data2=ma_2.Result, Data3=panel_3)
join_2 = TextJoin(Text=merge_6)
tag_4 = TextTag(Location=end_2.End, Text=join_2, Colour=RGB(0, 0, 0))  # disabled

# ----
# Parcel Area
crv_cp_6 = CurveClosestPoint(Point=area_9.Centroid, Curve=offcrv_12)  # -> Point, Parameter, Distance
xz_9 = XZPlane(Origin=Point(0, 0, 0))
pframe_9 = PerpFrame(Curve=offcrv_12, Parameter=crv_cp_6.Parameter)
align_9 = AlignPlanes(Planes=pframe_9, Master=xz_9)
multiplication_19 = Multiplication(A=parcel_depth, B=0.7)
deplane_6 = DeconstructPlane(Plane=align_9)  # -> Origin, XAxis, YAxis, ZAxis
line_6 = LineSDL(Start=area_9.Centroid, Direction=deplane_6.XAxis, Length=multiplication_19)
roundf_3 = RoundToFactor(NumberX=area_9.Area, Factor=1, RoundType=0)  # -> Rounded, Difference, MultiplierR, MultiplierX
end_3 = EndPoints(Curve=line_6)  # -> Start, End
tag_5 = TextTag(Location=end_3.End, Text=roundf_3.Rounded, Colour=RGB(0, 0, 0))  # disabled

# ----
# House Area
contour_3 = Contour(Shape=filter, Point=Point(0, 0, 0), Direction=Vector(0, 0, 1), Distance=floor_height, UseTasks=False)
area_12 = Area(Geometry=contour_3)  # -> Area, Centroid
ma_3 = MassAddition(Input=flatten(area_12.Area))  # -> Result, PartialResults
panel_8 = Panel("")
merge_7 = Merge(Data1=panel_8, Data2=ma_3.Result, Data3=panel_2)
join_3 = TextJoin(Text=merge_7)
tag_6 = TextTag(Location=end_3.End, Text=join_3, Colour=RGB(0, 0, 0))  # disabled

geo_5 = Geometry(flatten([move.Geometry, move_2.Geometry, move_3.Geometry]))

# ----
# Units Count
end_4 = EndPoints(Curve=crv)  # -> Start, End
lng = ListLength(List=flatten([merge_4, merge_2]))
cp_4 = ClosestPoint(Point=end_4.Start, Cloud=end.End)  # -> ClosestPoint, CPIndex, Distance
Z_10 = UnitZ(Factor=30)
panel_9 = Panel("  Houses")
move_4 = Move(Geometry=cp_4.ClosestPoint, Motion=Z_10)  # -> Geometry, Transform
ln = Line(StartPoint=cp_4.ClosestPoint, EndPoint=move_4.Geometry)
scale_4 = Scale(Geometry=ln, Center=cp_4.ClosestPoint, Factor=0.75)  # -> Geometry, Transform; disabled
panel_10 = Panel("1st Side")

merge_8 = Merge(Data1=lng, Data2=panel_9)
join_4 = TextJoin(Text=merge_8)

merge_9 = Merge(Data1=panel_10, Data2=join_4)
join_5 = TextJoin(Text=merge_9, Join=panel_4)
tag_7 = TextTag(Location=move_4.Geometry, Text=join_5, Colour=RGB(0, 0, 0))  # disabled

# ----
# Units Count
end_5 = EndPoints(Curve=crv)  # -> Start, End
lng_2 = ListLength(List=flatten([merge_4, merge_3]))
cp_5 = ClosestPoint(Point=end_5.Start, Cloud=end_2.End)  # -> ClosestPoint, CPIndex, Distance
Z_11 = UnitZ(Factor=30)
panel_11 = Panel("  Houses")
move_5 = Move(Geometry=cp_5.ClosestPoint, Motion=Z_11)  # -> Geometry, Transform
ln_2 = Line(StartPoint=cp_5.ClosestPoint, EndPoint=move_5.Geometry)
scale_5 = Scale(Geometry=ln_2, Center=cp_5.ClosestPoint, Factor=0.75)  # -> Geometry, Transform; disabled
panel_12 = Panel("2nd Side")

geo_6 = Geometry([wires_2, wires, dash.Dashes, wires_3, debrep_2.Edges, debrep.Edges, debrep_3.Edges, wires_4, wires_5, scale_5.Geometry, scale_4.Geometry])
swatch = ColourSwatch(SwatchColor=RGB(0, 0, 0))
number_slider = Slider(1, range=0..5)
buildings_4 = ColourSwatch(SwatchColor=RGB(209, 207, 188))
swatch_2 = ColourSwatch(SwatchColor=RGB(153, 204, 255))
roofs = ColourSwatch(SwatchColor=RGB(140, 133, 112))
preview = CustomPreview(Geometry=flatten(geo_5), Material=buildings_4)
previewlw = CustomPreviewLineweights(Geometry=flatten(geo_6), Shader=swatch, Thickness=number_slider, Absolute=False)

merge_10 = Merge(Data1=lng_2, Data2=panel_11)
join_6 = TextJoin(Text=merge_10)

merge_11 = Merge(Data1=panel_12, Data2=join_6)
join_7 = TextJoin(Text=merge_11, Join=panel_5)
tag_8 = TextTag(Location=move_5.Geometry, Text=join_7, Colour=RGB(0, 0, 0))  # disabled
